# Grasshopper definition flower_plate_master.gh (Grasshopper 1.0.8)
# plug-ins: Pufferfish, Human, LegoPod, eleFront Rhino 6 Legacy, LunchBox, MetaHopper, eleFront

外形_多角形a = Slider(0.3, range=0..0.3)
外形_t_c = Slider(10, range=0..10)
外形_t_e = Slider(10, range=0..10)
外形_hk = Slider(3, range=0..10)
外形_r_ko = Slider(6, range=0..100)
外形_rko = Slider(4, range=0..100)
外形_n角形 = Slider(10, range=0..10)
# 皿外形
外形_ri = Slider(64, range=0..125)
外形_d1 = Slider(14, range=0..125)
外形_rc = Slider(49, range=0..125)
外形_wk = Slider(3.2, range=0..10)
外形_h = Slider(15, range=0..25)
neg = Negative(Value=Slider(7, range=0..100))
input = DataInput(
    Destination="H:\マイドライブ\project\完了\おはなのこざら\paramdata\角皿外形.ghdata",
    RelativePath="H:\マイドライブ\project\完了\おはなのこざら\paramdata\角皿外形.ghdata|..\..\完了\おはなのこざら\paramdata\角皿外形.ghdata",
    UpdateDelay=50000)  # -> 皿内側半径, d1, rc, 皿高さ, 中央厚み, 縁厚み, 高台高さ, 高台外半径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
皿外形n角形 = Data(外形_n角形)
高台外半径 = Data(外形_r_ko)
高台影響半径 = Data(外形_rko)
多角形a = Data(外形_多角形a)
皿外形n角形_2 = Data(input.皿外形n角形)
高台高さ = Data(外形_hk)
皿内側半径 = Data(外形_ri)
高台影響半径_2 = Data(input.高台影響半径)
高台外半径_2 = Data(input.高台外半径)
中央厚み = Data(外形_t_c)
縁厚み = Data(外形_t_e)
高台幅 = Data(外形_wk)
多角形a_2 = Data(input.多角形a)
data = Data(外形_d1)
data_2 = Data(外形_rc)
皿内側半径_2 = Data(input.皿内側半径)
高台高さ_2 = Data(input.高台高さ)
中央厚み_2 = Data(input.中央厚み)
縁厚み_2 = Data(input.縁厚み)
皿高さ = Data(外形_h)
高台幅_2 = Data(input.高台幅)
data_3 = Data(input.d1)
data_4 = Data(input.rc)
皿高さ_2 = Data(input.皿高さ)
散乱_seed = Slider(0, range=0..100)
材料w = Slider(0, range=0..1000)
材料l = Slider(12, range=0..1000)
材料h = Slider(50, range=0..1000)
重なり層数 = Slider(1, range=0..10)
散乱_toggle = Slider(1, range=0..1)
散乱_n = Slider(1, range=0..20)
散乱_範囲半径 = Slider(0, range=0..100)
重なり高さギャップ = Slider(10, range=0..10)
花弁掘り込み_花弁ふくらみ = Slider(6, range=-1..6)
外形掘り込みピッチ = Slider(10, range=0..10)
仕上彫りピッチ = Slider(1, range=0..3)
花弁掘り込み_花弁回転 = Slider(1, range=0..1)
花弁掘り込み_多角形回転 = Slider(1, range=0..1)
重なり間回転 = Slider(2, range=0..2)
重なりスケール最小値 = Slider(1, range=0..1)
ビット径 = Slider(6, range=0..20)
花弁掘り込み_花弁中央半径 = Slider(1, range=0..10)
花弁掘り込み_花弁枚数 = Slider(1, range=0..30)
花弁掘り込み_花弁先形状 = Slider(1, range=0..1)
花弁掘り込み_花弁先オフセット = Slider(1.6, range=0..10)
中央掘り込み_掘り込み深さ = Slider(4.7, range=0..10)
中央掘り込み_中央部半径 = Slider(1, range=0..100)
中央掘り込み_円周沿い点ピッチ = Slider(10, range=0..10)
花弁掘り込み_花弁角度 = Slider(0.01, range=0..1)
花弁掘り込み_花弁筋本数 = Slider(0, range=0..20)
中央掘り込み_同心円数 = Slider(0, range=0..20)
花弁掘り込み_中央部直径 = Slider(0, range=0..125)
# 彫り込み
花弁掘り込み_rd = Slider(41, range=0..125)
花弁掘り込み_td = Slider(8, range=0..10)
panel = Panel("H:\マイドライブ\project\完了\おはなのこざら\パラメータcsv\")
entwine = Entwine(
    Branch00=皿内側半径_2,
    Branch01=data_3,
    Branch02=data_4,
    Branch03=皿高さ_2,
    Branch04=中央厚み_2,
    Branch05=縁厚み_2,
    Branch06=高台高さ_2,
    Branch07=高台外半径_2,
    Branch08=高台幅_2,
    Branch09=高台影響半径_2,
    Branch010=皿外形n角形_2,
    Branch011=多角形a_2,
    FlattenInputs=True)
output = DataOutput(
    皿内側半径=皿内側半径,
    d1=data,
    rc=data_2,
    皿高さ=皿高さ,
    中央厚み=中央厚み,
    縁厚み=縁厚み,
    高台高さ=高台高さ,
    高台外半径=高台外半径,
    高台幅=高台幅,
    高台影響半径=高台影響半径,
    皿外形n角形=皿外形n角形,
    多角形a=多角形a,
    Destination="H:\マイドライブ\project\完了\おはなのこざら\paramdata\角皿外形.ghdata",
    RelativePath="H:\マイドライブ\project\完了\おはなのこざら\paramdata\角皿外形.ghdata|..\..\完了\おはなのこざら\paramdata\角皿外形.ghdata")
path = FilePath(panel)
entwine_2 = Entwine(
    Branch00=皿内側半径,
    Branch01=data,
    Branch02=data_2,
    Branch03=皿高さ,
    Branch04=中央厚み,
    Branch05=縁厚み,
    Branch06=高台高さ,
    Branch07=高台外半径,
    Branch08=高台幅,
    Branch09=高台影響半径,
    Branch010=皿外形n角形,
    Branch011=多角形a,
    FlattenInputs=True)
list = ValueList({"slider": 0, "input": 1}, selected="slider")
# Read file
directory = Directory(FilePath=path, Pattern="*.csv", All=True)
# Save paramater
selobj = GetSelectedObjects(AllObjects_Object=[外形_r_ko, 外形_ri, 外形_h, 外形_t_c, 外形_t_e, 外形_hk, 外形_wk, 外形_rko, 材料w, 材料l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])  # -> ComponentObjects, ParamObjects, OtherObjects
split = TextSplit(Text=directory, Separators="\")  # -> reverse(Result)
filter = StreamFilter(Gate=list, Stream0=entwine_2, Stream1=entwine_2)
item = ListItem(List=split, Index=0, Wrap=True)  # -> flatten(Item)
bang = ExplodeTree(Data=filter)  # -> Branch0, Branch1, Branch2, Branch3, Branch4, Branch5, Branch6, Branch7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
tsort = SortText(Keys=item, Culture=127)  # -> Keys, Values
皿外形n角形_3 = Data(bang.Branch10)
高台影響半径_3 = Data(bang.Branch9)
高台外半径_3 = Data(bang.Branch7)
多角形a_3 = Data(bang.Branch11)
皿内側半径_3 = Data(bang.Branch0)
高台高さ_3 = Data(bang.Branch6)
縁厚み_3 = Data(bang.Branch5)
中央厚み_3 = Data(bang.Branch4)
高台幅_3 = Data(bang.Branch8)
data_5 = Data(bang.Branch1)
data_6 = Data(bang.Branch2)
皿高さ_3 = Data(bang.Branch3)
paramdata = GetParamData(Param=selobj.ParamObjects)  # -> Data, DataPaths
param_info = ParamInfo(Param=selobj.ParamObjects)  # -> Name, NickName, DataType, Pivot, Bounds, Sources, Recipients, Kind
皿内側半径_4 = Data(皿内側半径_3)
data_7 = Data(data_6)
皿高さ_4 = Data(皿高さ_3)
中央厚み_4 = Data(中央厚み_3)
縁厚み_4 = Data(縁厚み_3)
高台高さ_4 = Data(高台高さ_3)
高台外半径_4 = Data(高台外半径_3)
高台幅_4 = Data(高台幅_3)
高台影響半径_4 = Data(高台影響半径_3)
多角形a_4 = Data(多角形a_3)
data_8 = Data(data_5)
皿外形n角形_4 = Data(皿外形n角形_3)
devec = DeconstructVector(Vector=param_info.Pivot)  # -> XComponent, YComponent, ZComponent
sort = SortList(Keys=devec.YComponent, ValuesA=param_info.NickName, ValuesB=paramdata.Data)  # -> Keys, reverse(ValuesA), reverse(ValuesB)
重なり高さギャップ_2 = Data(重なり高さギャップ)
panel_2 = Panel(sort.ValuesA)
仕上彫りピッチ_2 = Data(仕上彫りピッチ)
外形掘り込みピッチ_2 = Data(外形掘り込みピッチ)
花弁先オフセット = Data(花弁掘り込み_花弁先オフセット)
panel_3 = Panel("""01_suisen
02_ume
03_tampopo
04_sakura
05_magaret
06_azisai
07_nichi
08_himawari
09_cosmos
10_kinmoku
11_rindo
12_tubaki""")
中央部半径 = Data(花弁掘り込み_中央部直径)
ビット径_2 = Data(ビット径)
彫り半径 = Data(花弁掘り込み_rd)
彫り厚み = Data(花弁掘り込み_td)
材料w_2 = Data(材料w)
材料l_2 = Data(材料l)
材料h_2 = Data(材料h)
散乱 = Data(散乱_toggle)
重なり層数_2 = Data(重なり層数)
panel_4 = Panel(sort.ValuesB)
散乱_n_2 = Data(散乱_n)
散乱_範囲半径_2 = Data(散乱_範囲半径)
散乱_seed_2 = Data(散乱_seed)
list_2 = ValueList({"AngularDimension", "Arc", "Block", "Brep", "Circle", "Curve", "Dimension", "Ellipse", "Extrusion", "Hatch", "Leader", "Line", "LinearDimension", "Mesh", "Point", "Polyline", "Polysurface", "RadialDimension", "Surface", "Text", "TextDot"}, selected="Curve")  # disabled
list_3 = ValueList({"AngularDimension", "Arc", "Block", "Brep", "Circle", "Curve", "Dimension", "Ellipse", "Extrusion", "Hatch", "Leader", "Line", "LinearDimension", "Mesh", "Point", "Polyline", "Polysurface", "RadialDimension", "Surface", "Text", "TextDot"}, selected="Point")  # disabled
彫り厚み_2 = Data(彫り厚み)
xy = XYPlane(Origin=Point(0, 0, 0))  # disabled
param_info_2 = ParamInfo(Param=selobj.ParamObjects)  # -> Name, NickName, DataType, Pivot, Bounds, Sources, Recipients, Kind
中央掘り込み_掘り込み深さ_2 = Data(中央掘り込み_掘り込み深さ)
中央掘り込み_掘り込み深さ_3 = Data(中央掘り込み_中央部半径)
中央掘り込み_円周沿い点ピッチ_2 = Data(中央掘り込み_円周沿い点ピッチ)
中央掘り込み_同心円数_2 = Data(中央掘り込み_同心円数)
花弁中央半径 = Data(花弁掘り込み_花弁中央半径)
外形掘り込みピッチ_3 = Data(外形掘り込みピッチ_2)
ビット径_3 = Data(ビット径_2)
花弁筋本数 = Data(花弁掘り込み_花弁筋本数)
中央部半径_2 = Data(中央部半径)
多角形回転 = Data(花弁掘り込み_多角形回転)
花弁角度 = Data(花弁掘り込み_花弁角度)
花弁形状 = Data(花弁掘り込み_花弁ふくらみ)
花弁枚数 = Data(花弁掘り込み_花弁枚数)
花弁回転 = Data(花弁掘り込み_花弁回転)
彫り半径_2 = Data(彫り半径)
材料w_3 = Data(材料w_2)
材料l_3 = Data(材料l_2)
材料h_3 = Data(材料h_2)
花弁先 = Data(花弁掘り込み_花弁先形状)
number_slider = Slider(2, range=0..10)  # disabled
# INPUT
wiredisplay = ControlWireDisplay(WireDisplay=2, AllObjects_Object=[高台外半径_4, 高台幅_4, 皿内側半径_4, 皿高さ_4, 中央厚み_4, 高台高さ_4])
csv = CreateCSV(DataGridHeaders=panel_2, ValueTree=graft(panel_4), Delimiter=",", QuoteItems=False, DataStruct=False)
number_slider_2 = Slider(0.8, range=0..10)  # disabled
neg_2 = Negative(Value=number_slider)  # disabled
panel_5 = Panel("2")  # disabled
panel_6 = Panel("3D::line")  # disabled
皿内側半径_5 = Data(皿内側半径_4)
皿内側半径_6 = Data(皿内側半径_4)
皿内側半径_7 = Data(皿内側半径_4)
# 材料
材料w_4 = Data(材料w_2)
材料h_4 = Data(材料h_2)
材料l_4 = Data(材料l_2)
data_9 = Data(data_7)
data_10 = Data(data_8)
中央厚み_5 = Data(中央厚み_4)
皿高さ_5 = Data(皿高さ_4)
高台高さ_5 = Data(高台高さ_4)
subtraction = Subtraction(A=皿高さ_5, B=中央厚み_5, C=高台高さ_5)
dom = ConstructDomain(DomainStart=expr("-x/2", 材料l_4), DomainEnd=expr("x/2", 材料l_4))
expression = Expression(R=皿内側半径_7, c=data_9, Expression="R*c/100")
dom_2 = ConstructDomain(DomainStart=expr("-x/2", 材料w_4), DomainEnd=expr("x/2", 材料w_4))
皿深さ = Data(subtraction)
皿深さ_2 = Data(皿深さ)
皿深さ_3 = Data(皿深さ)
expression_2 = Expression(R=皿内側半径_6, D=皿深さ_2, Expression="(R^2+D^2)/(2*D)")
expression_3 = Expression(H=皿深さ_3, d=data_10, Expression="H*d/100")
rectangle = Rectangle(Plane=PlaneXY(0, 0, 0), XSize=dom, YSize=dom_2, Radius=0)  # -> Rectangle, Length
d1 = Data(expression_3)
d1_2 = Data(d1)
d1_3 = Data(d1)
rc = Data(expression)
rc_2 = Data(rc)
expression_4 = Expression(d=d1_3, r=rc_2, Expression="atan(d/r)*2")
thetac = Data(expression_4)
expression_5 = Expression(D=d1_2, c=thetac, Expression="D/(1-cos(c))")
thetac_2 = Data(expression_4)
rt = Data(expression_2)
rt_2 = Data(rt)
division = Division(A=皿内側半径_5, B=rt_2)
asin = ArcSine(Value=division)
shita0 = Data(asin)
ac = Data(expression_5)
boxrec = BoxRectangle(Rectangle=rectangle.Rectangle, Height=材料h_4)
button = Button()
material = Geometry(boxrec)

swatch = ColourSwatch(SwatchColor=RGBA(163, 131, 83, 16))  # disabled
# OUTPUT
material_2 = Geometry(material)  # disabled
preview = CustomPreview(Geometry=material_2, Material=swatch)  # disabled
toggle = GroupToggle(ToggleActive=True, ToggleVisible=False)  # disabled

皿外形cp = Slider(36, range=0..100)
皿外形n角形_5 = Data(皿外形n角形_4)
多角形a_5 = Data(多角形a_4)
皿高さ_6 = Data(皿高さ_4)
皿内側半径_8 = Data(皿内側半径_4)
高台影響半径_5 = Data(高台影響半径_4)
thetac_3 = Data(thetac_2)
# 内側ライン
中央厚み_6 = Data(中央厚み_4)
ac_2 = Data(ac)
縁厚み_5 = Data(縁厚み_4)
高台高さ_6 = Data(高台高さ_4)
高台外半径_5 = Data(高台外半径_4)
series = Series(Start=0, Step=expr("1/x", 皿外形cp), Count=expr("x+1", 皿外形cp))
data_11 = Data(data_8)
ac_3 = Data(ac)
高台幅_5 = Data(高台幅_4)
中央厚み_7 = Data(中央厚み_4)
縁厚み_6 = Data(縁厚み_4)
xy_2 = XYPlane(Origin=Point(0, 0, 0))
addition = Addition(A=中央厚み_6, B=高台高さ_6, C=ac_2)
expression_6 = Expression(t=series, n=皿外形n角形_5, a=多角形a_5, Expression="1-a+a*cos(2*Pi*t*n)")
外形掘り込みピッチ_4 = Data(外形掘り込みピッチ_2)
pt = ConstructPoint(XCoordinate=皿内側半径_8, YCoordinate=0, ZCoordinate=皿高さ_6)
twn2nums = TweenTwoNumbers(NumberA=中央厚み_7, NumberB=縁厚み_6, Factor=expr("x/100", data_11))
仕上彫りピッチ_3 = Data(仕上彫りピッチ)
expression_7 = Expression(t=series, Expression="2*Pi*t")
expression_8 = Expression(x=縁厚み_5, Expression="x/2")
ビット径_4 = Data(ビット径_2)
scale_f = Data(expression_6)
rotate = Data(expression_7)
pln = Plane(xy_2)
step = Panel("0.48")
subtraction_2 = Subtraction(A=高台外半径_5, B=高台幅_5)
xz = XZPlane(Origin=Point(0, 0, 0))
pt_2 = ConstructPoint(XCoordinate=0, YCoordinate=0, ZCoordinate=addition)
expression_9 = Expression(x=thetac_3, Expression="x+3/2*Pi")
Z = UnitZ(Factor=1)
pt_3 = ConstructPoint(XCoordinate=subtraction_2, YCoordinate=0, ZCoordinate=0)
pt_4 = ConstructPoint(XCoordinate=高台外半径_5, YCoordinate=0, ZCoordinate=0)
縁フィレット = Data(expression_8)
p0 = Point(pt_2)
Z_2 = UnitZ(Factor=expr("x/2", ビット径_4))
xz_2 = XZPlane(Origin=Point(0, 0, 0))
dom_3 = ConstructDomain(DomainStart="3/2*Pi", DomainEnd=expression_9)
addition_2 = Addition(A=ac_3, B=twn2nums)
xz_3 = XZPlane(Origin=pt_4)
X = UnitX(Factor="200")
xz_4 = XZPlane(Origin=pt_3)
xz_5 = XZPlane(Origin=p0)
Z_3 = UnitZ(Factor=expr("-x/2", ビット径_4))
cir = Circle(Plane=xz_3, Radius=高台影響半径_5)
neg_3 = Negative(Value=中央厚み_7)
cir_2 = Circle(Plane=xz_4, Radius=高台影響半径_5)
arc = Arc(Plane=xz_5, Radius=ac_2, Angle=dom_3)  # -> Arc, Length
xz_6 = XZPlane(Origin=Point(0, 0, 0))
Z_4 = UnitZ(Factor=neg_3)
multiplication = Multiplication(A=ビット径_4, B=step)
multiplication_2 = Multiplication(A=ビット径_4, B=step)
eval = EvaluateCurve(Curve=reparameterize(arc.Arc), Parameter="1")  # -> Point, Tangent, Angle
X_2 = UnitX(Factor="0.1")
xy_3 = XYPlane(Origin=Point(0, 0, 0))
Z_5 = UnitZ(Factor=1)
X_3 = UnitX(Factor="0.1")
X_4 = UnitX(Factor="0.1")
arc_2 = ArcSED(Start=eval.Point, End=pt, Direction=eval.Tangent)  # -> Arc, Plane, Radius
Z_6 = UnitZ(Factor=expr("-x", 外形掘り込みピッチ_4))
line = LineSDL(Start=xy_3, Direction=Z_5, Length=100)
ln = Line(StartPoint=pt_3, EndPoint=pt_4)
merge = Merge(Data1=arc.Arc, Data2=arc_2.Arc)
X_5 = UnitX(Factor="0.1")
join = JoinCurves(Curves=merge, Preserve=False)
p1 = Point(arc_2.Plane)
p1_2 = Point(p1)
p0_2 = Point(p0)
p0_3 = Point(p0_2)
re = Data(arc_2.Radius)
re_2 = Data(re)
addition_3 = Addition(A=縁厚み_6, B=re_2)
arc_top = Geometry(join)
# ライン合成
arc_top_2 = Geometry(arc_top)
# 外側ライン
arc_top_3 = Geometry(arc_top)
end = EndPoints(Curve=arc_top_2)  # -> Start, End
explode = Explode(Curve=arc_top_3, Recursive=True)  # -> Segments, Vertices
item_2 = ListItem(List=explode.Segments, Index=0, Wrap=True)  # -> Item, Item1
end_2 = EndPoints(Curve=item_2.Item1)  # -> Start, End
end_3 = EndPoints(Curve=item_2.Item)  # -> Start, End
vec2pt = Vector2Pt(PointA=p1_2, PointB=end_2.End, Unitize=False)  # -> Vector, Length
vec2pt_2 = Vector2Pt(PointA=p0_3, PointB=end_3.End, Unitize=False)  # -> Vector, Length
eval_2 = EvaluateCurve(Curve=arc_top_3, Parameter="0")  # -> Point, Tangent, Angle
amp = Amplitude(Vector=vec2pt_2.Vector, Amplitude=addition_2)
amp_2 = Amplitude(Vector=vec2pt.Vector, Amplitude=addition_3)
move = Move(Geometry=p1_2, Motion=amp_2)  # -> Geometry, Transform
move_2 = Move(Geometry=p0_3, Motion=amp)  # -> Geometry, Transform
move_3 = Move(Geometry=end_3.Start, Motion=Z_4)  # -> Geometry, Transform
arc_3 = ArcSED(Start=move_3.Geometry, End=move_2.Geometry, Direction=eval_2.Tangent)  # -> Arc, Plane, Radius
eval_3 = EvaluateCurve(Curve=reparameterize(arc_3.Arc), Parameter="1")  # -> Point, Tangent, Angle
end_4 = EndPoints(Curve=arc_3.Arc)  # -> Start, End
arc_4 = ArcSED(Start=end_4.End, End=move.Geometry, Direction=eval_3.Tangent)  # -> Arc, Plane, Radius
merge_2 = Merge(Data1=arc_3.Arc, Data2=arc_4.Arc)
join_2 = JoinCurves(Curves=merge_2, Preserve=False)
arc_bottom = Geometry(join_2)
# 高台ライン
arc_bottom_2 = Geometry(arc_bottom)
ccx = CurveCurve(CurveA=arc_bottom_2, CurveB=cir)  # -> Points, ParamsA, ParamsB
ccx_2 = CurveCurve(CurveA=arc_bottom_2, CurveB=cir_2)  # -> Points, ParamsA, ParamsB
item_3 = ListItem(List=ccx.ParamsA, Index=0, Wrap=True)  # -> Item, Item1
item_4 = ListItem(List=ccx_2.ParamsA, Index=0, Wrap=True)  # -> Item, Item1
eval_4 = EvaluateCurve(Curve=arc_bottom_2, Parameter=item_3.Item1)  # -> Point, Tangent, Angle
eval_5 = EvaluateCurve(Curve=arc_bottom_2, Parameter=item_4.Item)  # -> Point, Tangent, Angle
merge_3 = Merge(Data1=item_4.Item, Data2=item_3.Item1)
neg_4 = Negative(Value=eval_4.Tangent)
shatter = Shatter(Curve=arc_bottom_2, Parameters=merge_3)
arc_5 = ArcSED(Start=eval_5.Point, End=pt_3, Direction=eval_5.Tangent)  # -> Arc, Plane, Radius
arc_6 = ArcSED(Start=eval_4.Point, End=pt_4, Direction=neg_4)  # -> Arc, Plane, Radius
item_5 = ListItem(List=shatter, Index=0, Wrap=True)  # -> Item, Item1, Item2
merge_4 = Merge(
    Data1=flatten(item_5.Item),
    Data2=flatten(arc_5.Arc),
    Data3=flatten(ln),
    Data4=flatten(arc_6.Arc),
    Data5=flatten(item_5.Item2))
join_3 = JoinCurves(Curves=merge_4, Preserve=False)
crv_bottom = Geometry(join_3)
crv_bottom_2 = Geometry(crv_bottom)
end_5 = EndPoints(Curve=crv_bottom_2)  # -> Start, End
ln_2 = Line(StartPoint=end.End, EndPoint=end_5.End)
join_4 = JoinCurves(Curves=flatten([arc_top_2, crv_bottom_2, ln_2]), Preserve=False)
fillet = Fillet(Curve=flatten(join_4), Radius=縁フィレット)
外形ライン = Geometry(fillet)
# 多角形
外形ライン_2 = Geometry(外形ライン)
end_6 = EndPoints(Curve=外形ライン_2)  # -> Start, End
line_2 = LineSDL(Start=end_6.Start, Direction=Z, Length="200")
move_4 = Move(Geometry=line_2, Motion=X)  # -> Geometry, Transform
crvprox = CurveProximity(CurveA=外形ライン_2, CurveB=move_4.Geometry)  # -> PointA, PointB, Distance
crv_cp = CurveClosestPoint(Point=crvprox.PointA, Curve=外形ライン_2)  # -> Point, Parameter, Distance
# 回転体
外形ライン_3 = Geometry(外形ライン)
shatter_2 = Shatter(Curve=外形ライン_2, Parameters=crv_cp.Parameter)
join_5 = JoinCurves(Curves=shatter_2, Preserve=False)
rotate_2 = Rotate(Geometry=join_5, Angle=expression_7, Plane=xy_2)  # -> Geometry, Transform
scale_nu = ScaleNU(Geometry=rotate_2.Geometry, Plane=rotate_2.Geometry, ScaleX=expression_6, ScaleY=1, ScaleZ=1)  # -> Geometry, Transform
item_6 = ListItem(List=shatter_2, Index=0, Wrap=True)  # -> Item, Item1
merge_5 = Merge(Data1=graft(rotate_2.Transform), Data2=graft(scale_nu.Transform))
revsrf = Revolution(Curve=外形ライン_3, Axis=line, Domain=Domain(0, 6.283185307))
comp = Compound(Transforms=merge_5)
皿外形 = Geometry(revsrf)
transform = Transform(Geometry=crvprox.PointA, Transform=comp)  # -> flatten(Geometry)
intcrv = Interpolate(Vertices=transform, Degree=3, Periodic=False, KnotStyle=1)  # -> Curve, Length, Domain
railrev = RailRevolution(Curve=item_6.Item1, Rail=intcrv.Curve, Axis=line_2, Scale=False)
railrev_2 = RailRevolution(Curve=item_6.Item, Rail=intcrv.Curve, Axis=line_2, Scale=False)
皿外形n角形_6 = Data(皿外形n角形_5)
多角形回転_2 = Data(多角形回転)
皿外形n角形_7 = Data(皿外形n角形_5)
皿外形n角形_8 = Data(皿外形n角形_5)
多角形回転_3 = Data(多角形回転)
多角形回転_4 = Data(多角形回転)
expression_10 = Expression(x=皿外形n角形_6, Expression="Pi/x")
expression_11 = Expression(x=皿外形n角形_7, Expression="Pi/x")
expression_12 = Expression(x=皿外形n角形_8, Expression="Pi/x")
join_6 = BrepJoin(Breps=[railrev_2, railrev])  # -> Breps, Closed
bottom_arc = Geometry(item_6.Item1)
crv_bottom_3 = Geometry(bottom_arc)
offset = OffsetCurve(Curve=crv_bottom_3, Distance=expr("-x/2", ビット径_4), Plane=xz, Corners=1)
move_5 = Move(Geometry=offset, Motion=Z_2)  # -> Geometry, Transform
end_7 = EndPoints(Curve=crv_bottom_3)  # -> Start, End
explode_2 = Explode(Curve=move_5.Geometry, Recursive=True)  # -> Segments, Vertices
len = Length(Curve=explode_2.Segments)
division_2 = Division(A=len, B=仕上彫りピッチ_3)
round = Round(Number=division_2)  # -> Nearest, Floor, Ceiling
integer_division = IntegerDivision(A=len, B=multiplication)
divide = DivideCurve(Curve=explode_2.Segments, Count=round.Ceiling, Kinks=False)  # -> flatten(Points), Tangents, Parameters
geo = Geometry(reverse(flatten(divide.Points)))
item_7 = ListItem(List=geo, Index="0", Wrap=True)
divide_2 = DivideCurve(Curve=explode_2.Segments, Count=integer_division, Kinks=False)  # -> flatten(Points), Tangents, Parameters
move_6 = Move(Geometry=item_7, Motion=X_2)  # -> Geometry, Transform
geo_2 = Geometry(flatten(divide_2.Points))
item_8 = ListItem(List=geo_2, Index="0", Wrap=True)
move_7 = Move(Geometry=item_8, Motion=X_3)  # -> Geometry, Transform
item_9 = ListItem(List=geo, Index=0, Wrap=True)
end_8 = EndPoints(Curve=crv_bottom_3)  # -> Start, End
replace = ReplaceItems(List=geo, Item=move_6.Geometry, Indices="0", Wrap=False)
replace_2 = ReplaceItems(List=geo_2, Item=move_7.Geometry, Indices="0", Wrap=False)
rotate_3 = Rotate(Geometry=end_8.Start, Angle=graft(rotate), Plane=pln)  # -> Geometry, Transform
rotate_4 = Rotate(Geometry=flatten(replace), Angle=graft(rotate), Plane=pln)  # -> Geometry, Transform
rotate_5 = Rotate(Geometry=flatten(replace_2), Angle=graft(rotate), Plane=pln)  # -> Geometry, Transform
bottom_srf = Geometry(railrev)
皿外形_2 = Geometry(join_6.Breps)

皿外形_3 = Geometry(皿外形_2)
preview_2 = CustomPreview(Geometry=皿外形_3, Material=ColourSwatch(SwatchColor=RGBA(166, 127, 88, 110)))
toggle_2 = GroupToggle(ToggleActive=True, ToggleVisible=False)  # disabled

top_arc = Geometry(item_6.Item)
top_arc_2 = Geometry(top_arc)
# 外形掘り込みパス
offset_2 = OffsetCurve(Curve=top_arc_2, Distance=expr("-x/2", ビット径_4), Plane=xz_2, Corners=1)
join_7 = JoinCurves(Curves=[top_arc_2, crv_bottom_3], Preserve=False)
rotate_6 = Rotate(Geometry=join_7, Angle=rotate, Plane=pln)  # -> Geometry, Transform
end_9 = EndPoints(Curve=top_arc_2)  # -> Start, End
move_8 = Move(Geometry=offset_2, Motion=Z_3)  # -> Geometry, Transform
len_2 = Length(Curve=move_8.Geometry)
division_3 = Division(A=len_2, B=仕上彫りピッチ_3)
ln_3 = Line(StartPoint=end_9.End, EndPoint=end_7.End)
round_2 = Round(Number=division_3)  # -> Nearest, Floor, Ceiling
offset_3 = OffsetCurve(Curve=ln_3, Distance=expr("-x/2", ビット径_4), Plane=xz_6, Corners=1)
len_3 = Length(Curve=move_8.Geometry)
divide_3 = DivideCurve(Curve=move_8.Geometry, Count=round_2.Ceiling, Kinks=False)  # -> flatten(Points), Tangents, Parameters
integer_division_2 = IntegerDivision(A=len_3, B=multiplication_2)
end_10 = EndPoints(Curve=offset_3)  # -> Start, End
midpt = CurveMiddle(Curve=offset_3)
geo_3 = Geometry(flatten(divide_3.Points))
item_10 = ListItem(List=geo_3, Index="0", Wrap=True)
divide_4 = DivideCurve(Curve=move_8.Geometry, Count=integer_division_2, Kinks=False)  # -> Points, Tangents, Parameters
merge_6 = Merge(Data1=midpt, Data2=end_10.End)
move_9 = Move(Geometry=item_10, Motion=X_4)  # -> Geometry, Transform
item_11 = ListItem(List=divide_4.Points, Index=0, Wrap=True)
move_10 = Move(Geometry=merge_6, Motion=Z_6)  # -> Geometry, Transform
replace_3 = ReplaceItems(List=geo_3, Item=move_9.Geometry, Indices="0", Wrap=False)
move_11 = Move(Geometry=item_11, Motion=X_5)  # -> Geometry, Transform
rotate_7 = Rotate(Geometry=move_10.Geometry, Angle=graft(rotate), Plane=pln)  # -> Geometry, Transform
rotate_8 = Rotate(Geometry=flatten(replace_3), Angle=graft(rotate), Plane=pln)  # -> Geometry, Transform
replace_4 = ReplaceItems(List=divide_4.Points, Item=move_11.Geometry, Indices="0", Wrap=False)
rotate_9 = Rotate(Geometry=replace_4, Angle=graft(rotate), Plane=pln)  # -> Geometry, Transform
scale_nu_2 = ScaleNU(Geometry=rotate_3.Geometry, Plane=graft(rotate_6.Geometry), ScaleX=graft(scale_f), ScaleY=1, ScaleZ=1)  # -> Geometry, Transform
scale_nu_3 = ScaleNU(Geometry=rotate_9.Geometry, Plane=graft(rotate_6.Geometry), ScaleX=graft(scale_f), ScaleY=1, ScaleZ=1)  # -> Geometry, Transform
scale_nu_4 = ScaleNU(Geometry=rotate_7.Geometry, Plane=graft(rotate_6.Geometry), ScaleX=graft(scale_f), ScaleY=1, ScaleZ=1)  # -> Geometry, Transform
scale_nu_5 = ScaleNU(Geometry=rotate_4.Geometry, Plane=graft(rotate_6.Geometry), ScaleX=graft(scale_f), ScaleY=1, ScaleZ=1)  # -> Geometry, Transform
scale_nu_6 = ScaleNU(Geometry=rotate_8.Geometry, Plane=graft(rotate_6.Geometry), ScaleX=graft(scale_f), ScaleY=1, ScaleZ=1)  # -> Geometry, Transform
flip = FlipMatrix(Data=scale_nu_2.Geometry)
scale_nu_7 = ScaleNU(Geometry=rotate_5.Geometry, Plane=graft(rotate_6.Geometry), ScaleX=graft(scale_f), ScaleY=1, ScaleZ=1)  # -> Geometry, Transform
flip_2 = FlipMatrix(Data=scale_nu_3.Geometry)
flip_3 = FlipMatrix(Data=scale_nu_4.Geometry)
flip_4 = FlipMatrix(Data=scale_nu_5.Geometry)
flip_5 = FlipMatrix(Data=scale_nu_6.Geometry)
intcrv_2 = Interpolate(Vertices=flip, Degree=3, Periodic=False, KnotStyle=1)  # -> flatten(Curve), Length, Domain
flip_6 = FlipMatrix(Data=scale_nu_7.Geometry)
intcrv_3 = Interpolate(Vertices=flip_2, Degree=3, Periodic=False, KnotStyle=1)  # -> flatten(Curve), Length, Domain
intcrv_4 = Interpolate(Vertices=flip_3, Degree=3, Periodic=False, KnotStyle=1)  # -> flatten(Curve), Length, Domain
intcrv_5 = Interpolate(Vertices=flip_4, Degree=3, Periodic=False, KnotStyle=1)  # -> flatten(Curve), Length, Domain
panel_7 = Panel(intcrv_5.Curve)
intcrv_6 = Interpolate(Vertices=flip_5, Degree=3, Periodic=False, KnotStyle=1)  # -> flatten(Curve), Length, Domain
intcrv_7 = Interpolate(Vertices=flip_6, Degree=3, Periodic=False, KnotStyle=1)  # -> flatten(Curve), Length, Domain

# ----
# 螺旋化
number_slider_3 = Slider(100, range=0..100)
divide_5 = DivideCurve(Curve=intcrv_5.Curve, Count=number_slider_3, Kinks=False)  # -> Points, Tangents, Parameters
tstat = TreeStatistics(Tree=divide_5.Points)  # -> Paths, Length, Count
shift = ShiftList(List=tstat.Paths, Shift=1, Wrap=False)
cull_i = CullIndex(List=tstat.Paths, Indices=-1, Wrap=True)
branch = TreeBranch(Tree=divide_5.Points, Path=shift, MaintainPaths=True)
branch_2 = TreeBranch(Tree=divide_5.Points, Path=cull_i, MaintainPaths=True)
intcrv_8 = Interpolate(Vertices=branch, Degree=3, Periodic=True, KnotStyle=1)  # -> Curve, Length, Domain
crv_cp_2 = CurveClosestPoint(Point=branch_2, Curve=intcrv_8.Curve)  # -> Point, Parameter, Distance
item_12 = ListItem(List=tstat.Paths, Index=0, Wrap=True)  # -> Item, Item1
tstat_2 = TreeStatistics(Tree=intcrv_8.Curve)  # -> Paths, Length, Count
lng = ListLength(List=branch_2)
geo_4 = Geometry(crv_cp_2.Point)
geo_5 = Geometry(flatten(intcrv_8.Curve))
vec2pt_3 = Vector2Pt(PointA=branch_2, PointB=crv_cp_2.Point, Unitize=False)  # -> Vector, Length
item_13 = ListItem(List=tstat.Paths, Index=0, Wrap=True)  # -> Item1, Item
division_4 = Division(A="1", B=lng)
branch_3 = TreeBranch(Tree=divide_5.Points, Path=item_13.Item1, MaintainPaths=True)  # -> flatten(Branch)
branch_4 = TreeBranch(Tree=divide_5.Points, Path=item_13.Item, MaintainPaths=True)  # -> flatten(Branch)
series_2 = Series(Start=0, Step=division_4, Count=lng)
multiplication_3 = Multiplication(A=vec2pt_3.Vector, B=series_2)
move_12 = Move(Geometry=branch_2, Motion=multiplication_3)  # -> flatten(Geometry), Transform
merge_7 = Merge(Data1=branch_4, Data2=move_12.Geometry, Data3=branch_3)
intcrv_9 = Interpolate(Vertices=merge_7, Degree=3, Periodic=False, KnotStyle=1)  # -> Curve, Length, Domain

item_14 = ListItem(List=intcrv_5.Curve, Index=0, Wrap=True)  # -> Item1, Item

# ----
# 螺旋化
number_slider_4 = Slider(100, range=0..100)
divide_6 = DivideCurve(Curve=intcrv_6.Curve, Count=number_slider_4, Kinks=False)  # -> Points, Tangents, Parameters
tstat_3 = TreeStatistics(Tree=divide_6.Points)  # -> Paths, Length, Count
shift_2 = ShiftList(List=tstat_3.Paths, Shift=1, Wrap=False)
cull_i_2 = CullIndex(List=tstat_3.Paths, Indices=-1, Wrap=True)
branch_5 = TreeBranch(Tree=divide_6.Points, Path=shift_2, MaintainPaths=True)
branch_6 = TreeBranch(Tree=divide_6.Points, Path=cull_i_2, MaintainPaths=True)
intcrv_10 = Interpolate(Vertices=branch_5, Degree=3, Periodic=True, KnotStyle=1)  # -> Curve, Length, Domain
crv_cp_3 = CurveClosestPoint(Point=branch_6, Curve=intcrv_10.Curve)  # -> Point, Parameter, Distance
item_15 = ListItem(List=tstat_3.Paths, Index=0, Wrap=True)  # -> Item, Item1
tstat_4 = TreeStatistics(Tree=intcrv_10.Curve)  # -> Paths, Length, Count
lng_2 = ListLength(List=branch_6)
geo_6 = Geometry(crv_cp_3.Point)
geo_7 = Geometry(flatten(intcrv_10.Curve))
vec2pt_4 = Vector2Pt(PointA=branch_6, PointB=crv_cp_3.Point, Unitize=False)  # -> Vector, Length
item_16 = ListItem(List=tstat_3.Paths, Index=0, Wrap=True)  # -> Item1, Item
division_5 = Division(A="1", B=lng_2)
branch_7 = TreeBranch(Tree=divide_6.Points, Path=item_16.Item1, MaintainPaths=True)  # -> flatten(Branch)
branch_8 = TreeBranch(Tree=divide_6.Points, Path=item_16.Item, MaintainPaths=True)  # -> flatten(Branch)
series_3 = Series(Start=0, Step=division_5, Count=lng_2)
multiplication_4 = Multiplication(A=vec2pt_4.Vector, B=series_3)
move_13 = Move(Geometry=branch_6, Motion=multiplication_4)  # -> flatten(Geometry), Transform
merge_8 = Merge(Data1=branch_8, Data2=move_13.Geometry, Data3=branch_7)
intcrv_11 = Interpolate(Vertices=merge_8, Degree=3, Periodic=False, KnotStyle=1)  # -> Curve, Length, Domain

rotate_10 = Rotate(Geometry=intcrv_2.Curve, Angle=expression_10, Plane=PlaneXY(0, 0, 0))  # -> Geometry, Transform
geo_8 = Geometry(item_14.Item1)
filter_2 = StreamFilter(Gate=多角形回転_2, Stream0=intcrv_2.Curve, Stream1=rotate_10.Geometry)
rotate_11 = Rotate(Geometry=intcrv_4.Curve, Angle=expression_11, Plane=PlaneXY(0, 0, 0))  # -> Geometry, Transform
rotate_12 = Rotate(Geometry=intcrv_7.Curve, Angle=expression_12, Plane=PlaneXY(0, 0, 0))  # -> Geometry, Transform
len_4 = Length(Curve=geo_8)
filter_3 = StreamFilter(Gate=多角形回転_3, Stream0=intcrv_4.Curve, Stream1=rotate_11.Geometry)
filter_4 = StreamFilter(Gate=多角形回転_4, Stream0=intcrv_7.Curve, Stream1=rotate_12.Geometry)
offset_4 = OffsetCurve(Curve=intcrv_2.Curve, Distance=expr("x/2", ビット径_4), Corners=1)
top_srf = Geometry(railrev_2)
外形カットパス_表 = Geometry(intcrv_4.Curve)
外形パス_裏 = Geometry(intcrv_7.Curve)
皿外形n角形_9 = Data(皿外形n角形_5)
多角形回転_5 = Data(多角形回転)
panel_8 = Panel(intcrv_9.Curve)
expression_13 = Expression(x=皿外形n角形_9, Expression="Pi/x")
flip_7 = FlipCurve(Curve=intcrv_11.Curve)  # -> Curve, Flag
panel_9 = Panel(intcrv_11.Curve)
rotate_13 = Rotate(Geometry=intcrv_9.Curve, Angle=expression_13, Plane=PlaneXY(0, 0, 0))  # -> Geometry, Transform
中央厚み_8 = Data(中央厚み_4)
高台高さ_7 = Data(高台高さ_4)
彫り厚み_3 = Data(彫り厚み)
flip_8 = FlipCurve()  # -> Curve, Flag
花弁先オフセット_2 = Data(花弁掘り込み_花弁先オフセット)
花弁中央半径_2 = Data(花弁掘り込み_花弁中央半径)
彫り半径_3 = Data(彫り半径)
花弁筋本数_2 = Data(花弁掘り込み_花弁筋本数)
filter_5 = StreamFilter(Gate=多角形回転_5, Stream0=intcrv_9.Curve, Stream1=rotate_13.Geometry)
花弁枚数_2 = Data(花弁掘り込み_花弁枚数)
花弁角度_2 = Data(花弁掘り込み_花弁角度)
花弁形状_2 = Data(花弁掘り込み_花弁ふくらみ)
topsrf = Geometry(top_srf)
addition_4 = Addition(A=中央厚み_8, B=高台高さ_7)
外形カットパス_裏 = Geometry(offset_4)
subtraction_3 = Subtraction(A=addition_4, B=彫り厚み_3)
裏面仕上げパス = Geometry(intcrv_9.Curve)
# 花弁形状
pt_5 = ConstructPoint(XCoordinate=0, YCoordinate=0, ZCoordinate=subtraction_3)
表面仕上げパス = Geometry(intcrv_11.Curve)
pt_6 = ConstructPoint(XCoordinate=花弁中央半径_2, YCoordinate=0, ZCoordinate=0)
division_6 = Division(A=彫り半径_3, B=花弁中央半径_2)
外形パス_表 = Geometry(intcrv_3.Curve)
皿中心pt = Geometry(pt_5)
vec = Vector(皿中心pt)
addition_5 = Addition(A=vec, B=pt_6)
pt_7 = ConstructPoint(XCoordinate=0, YCoordinate="1", ZCoordinate=0)
pi = Pi(Factor=花弁角度_2)
addition_6 = Addition(A=vec, B=pt_7)
xy_4 = XYPlane(Origin=皿中心pt)
rotate_14 = Rotate(Geometry=addition_6, Angle=expr("-x", pi), Plane=xy_4)  # -> flatten(Geometry), Transform
pt_8 = Point(xy_4)
X_6 = UnitX(Factor=花弁形状_2)
move_14 = Move(Geometry=rotate_14.Geometry, Motion=X_6)  # -> Geometry, Transform
xz_7 = XZPlane(Origin=Point(0, 0, 0))
mirror = Mirror(Geometry=rotate_14.Geometry, Plane=PlaneYZ(0, 0, 0))  # -> Geometry, Transform
mirror_2 = Mirror(Geometry=move_14.Geometry, Plane=xz_7)  # -> flatten(Geometry), Transform
curve_t = Slider(3, range=0..10)
sphere_r = Slider(55, range=0..100)
voronoi_n = Slider(30, range=0..100)
merge_9 = Merge(
    Data1=flatten(pt_8),
    Data2=flatten(move_14.Geometry),
    Data3=flatten(addition_5),
    Data4=flatten(mirror_2.Geometry),
    Data5=flatten(pt_8))
subtraction_4 = Subtraction(A=mirror.Geometry, B=pt_8)
subtraction_5 = Subtraction(A=rotate_14.Geometry, B=pt_8)
中央掘り込み_円周沿い点ピッチ_3 = Data(中央掘り込み_円周沿い点ピッチ_2)
散乱_n_3 = Data(散乱_n)
bottom_srf_2 = Geometry(bottom_srf)
# Voronoi
top_srf_2 = Geometry(top_srf)
top_srf_3 = Geometry(top_srf)
彫り厚み_4 = Data(彫り厚み)
散乱_範囲半径_3 = Data(散乱_範囲半径)
# 中央部掘り込み
中央掘り込み_掘り込み深さ_4 = Data(中央掘り込み_掘り込み深さ_2)
中央掘り込み_掘り込み深さ_5 = Data(中央掘り込み_掘り込み深さ_3)
中央掘り込み_同心円数_3 = Data(中央掘り込み_同心円数_2)
# 散乱
xy_5 = XYPlane(Origin=Point(0, 0, 0))
project = Project(Geometry=top_srf_2, Plane=PlaneXY(0, 0, 0))  # -> flatten(Geometry), Transform
散乱_seed_3 = Data(散乱_seed)
intcrv_t = InterpolateT(Vertices=merge_9, TangentStart=subtraction_5, TangentEnd=subtraction_4, KnotStyle=Slider(2, range=0..10))  # -> Curve, Length, Domain
edges = BrepEdges(Brep=project.Geometry)  # -> Naked, Interior, NonManifold
top_srf_4 = Geometry(top_srf)
ビット径_5 = Data(ビット径_2)
cyl = Cylinder(Base=xy_5, Radius=散乱_範囲半径_3, Length="100")
offset_5 = OffsetCurve(Curve=edges.Naked, Distance=expr("-x", Slider(3, range=0..100)), Corners=1)
xy_6 = XYPlane(Origin=Point(0, 0, 0))
divide_7 = DivideCurve(Curve=intcrv_t.Curve, Count=2, Kinks=False)  # -> Points, Tangents, Parameters
splitmul = SplitBrepMultiple(Brep=top_srf_3, Cutters=cyl)
expression_14 = Expression(x=ビット径_5, Expression="x/2")
division_7 = Division(A=中央掘り込み_掘り込み深さ_5, B=中央掘り込み_同心円数_3)
boundary = BoundarySurfaces(Edges=offset_5)
Z_7 = UnitZ(Factor="100")
shatter_3 = Shatter(Curve=intcrv_t.Curve, Parameters=divide_7.Parameters)  # -> flatten(Segments)
popgeo = PopulateGeometry(Geometry=splitmul, Count=1, Seed=1)  # -> flatten(Population)
series_4 = Series(Start=expr("x/2", division_7), Step=division_7, Count=中央掘り込み_同心円数_3)
extr = Extrude(Base=boundary, Direction=Z_7)
expression_15 = Expression(x=中央掘り込み_同心円数_3, Expression="2*Pi/x")
dist = Distance(PointA=xy_5, PointB=popgeo)
item_17 = ListItem(List=flatten(shatter_3), Index=0, Wrap=True)  # -> Item, Item1
split_2 = SplitBrep(Brep=top_srf_2, Cutter=extr)
cir_3 = Circle(Plane=xy_6, Radius=series_4)
xy_7 = XYPlane(Origin=Point(0, 0, 0))
sort_2 = SortList(Keys=dist, ValuesA=splitmul)  # -> Keys, ValuesA
series_5 = Series(Start=0, Step=expression_15, Count=中央掘り込み_同心円数_3)
area = Area(Geometry=split_2)  # -> Area, Centroid
len_5 = Length(Curve=cir_3)
flip_9 = FlipCurve(Curve=item_17.Item1)  # -> Curve, Flag
item_18 = ListItem(List=sort_2.ValuesA, Index=0, Wrap=True)
subtraction_6 = Subtraction(A=sphere_r, B=curve_t)
popgeo_2 = PopulateGeometry(Geometry=item_18, Count=散乱_n_3, Seed=散乱_seed_3)
rotate_15 = Rotate(Geometry=cir_3, Angle=series_5, Plane=xy_6)  # -> Geometry, Transform
sort_3 = SortList(Keys=area.Area, ValuesA=split_2)  # -> Keys, reverse(ValuesA)
integer_division_3 = IntegerDivision(A=len_5, B=中央掘り込み_円周沿い点ピッチ_3)
merge_10 = Merge(Data1=item_17.Item, Data2=flip_9.Curve)  # -> flatten(Result)
srf_cp = SurfaceClosestPoint(Point=popgeo_2, Surface=top_srf_3)  # -> Point, UVPoint, Distance
花弁先_2 = Data(花弁先)
brep_cp = BrepClosestPoint(Point=popgeo_2, Brep=top_srf_3)  # -> Point, Normal, Distance
Z_8 = UnitZ(Factor=1)
item_19 = ListItem(List=sort_3.ValuesA, Index=0, Wrap=True)
popgeo_3 = PopulateGeometry(Geometry=item_19, Count=voronoi_n, Seed=1)  # -> flatten(Population)
voronoi = Voronoi(Points=popgeo_3, Plane=xy_7, BruteForceOverride=False)  # -> simplify(Cells)
panel_10 = Panel(voronoi)
brep_cp_2 = BrepClosestPoint(Point=popgeo_3, Brep=top_srf_2)  # -> Point, Normal, Distance
trim = TrimWithRegion(Curve=graft(voronoi), Region=item_19)  # -> simplify(Inside), Outside
trim_2 = TrimWithRegion(Curve=item_19, Region=graft(voronoi))  # -> simplify(Inside), Outside
line_3 = LineSDL(Start=brep_cp_2.Point, Direction=brep_cp_2.Normal, Length=Slider(100, range=0..100))
amp_3 = Amplitude(Vector=brep_cp_2.Normal, Amplitude=subtraction_6)
divide_8 = DivideCurve(Curve=rotate_15.Geometry, Count=integer_division_3, Kinks=False)  # -> flatten(Points), Tangents, Parameters
neg_5 = Negative(Value=花弁先_2)
geo_9 = Geometry(trim_2.Inside)
geo_10 = Geometry(trim.Inside)
evalsrf = EvaluateSurface(Surface=item_18, Point=srf_cp.UVPoint)  # -> Point, Normal, UDirection, VDirection, Frame
neg_6 = Negative(Value=amp_3)
Z_9 = UnitZ(Factor=1)
ext = ExtendCurve(Curve=merge_10, Type=0, Start="0", End=neg_5)
neg_7 = Negative(Value=彫り厚み_4)
merge_11 = Merge(Data1=geo_9, Data2=geo_10)
move_15 = Move(Geometry=brep_cp_2.Point, Motion=neg_6)  # -> Geometry, Transform
pl = PlaneNormal(Origin=evalsrf.Point, ZAxis=evalsrf.Normal)
project_2 = ProjectPoint(Point=divide_8.Points, Direction=Z_9, Geometry=top_srf_4)  # -> Point, Index
amp_4 = Amplitude(Vector=evalsrf.Normal, Amplitude=neg_7)
scale = Scale(Geometry=ext, Center=xy_4, Factor=division_6)  # -> Geometry, Transform
join_8 = JoinCurves(Curves=merge_11, Preserve=True)  # -> flatten(Curves)
subtraction_7 = Subtraction(A=expression_14, B=中央掘り込み_掘り込み深さ_4)
sph = Sphere(Base=move_15.Geometry, Radius=sphere_r)
neg_8 = Negative(Value=中央掘り込み_掘り込み深さ_4)
move_16 = Move(Geometry=pl, Motion=amp_4)  # -> Geometry, Transform
Z_10 = UnitZ(Factor=subtraction_7)
project_3 = Project(Curve=join_8, Brep=item_19, Direction=Vector(0, 0, 1))
Z_11 = UnitZ(Factor=neg_8)
花弁crv = Geometry(scale.Geometry)
lng_3 = ListLength(List=move_16.Geometry)
move_17 = Move(Geometry=project_2.Point, Motion=Z_10)  # -> Geometry, Transform
move_18 = Move(Geometry=project_2.Point, Motion=Z_11)  # -> Geometry, Transform
planar = Planar(Curve=project_3)  # -> Planar, Plane, Deviation
sph_2 = Sphere(Base=move_17.Geometry, Radius=expression_14)
project_4 = Project(Geometry=project_3, Plane=planar.Plane)  # -> Geometry, Transform
deplane = DeconstructPlane(Plane=planar.Plane)  # -> Origin, XAxis, YAxis, ZAxis
random = Random(Range="-1 To 1", Number=lng_3, Seed=散乱_seed_3)
division_8 = Division(A=1, B=花弁筋本数_2)
expression_16 = Expression(x=花弁枚数_2, Expression="2*Pi/x/2")
花中央掘り込みボリューム = Geometry(sph_2)
花中央掘り込みボリューム_2 = Geometry(simplify(flatten(花中央掘り込みボリューム)))
xz_8 = XZPlane(Origin=Point(0, 0, 0))
xy_8 = XYPlane(Origin=Point(0, 0, 0))
pi_2 = Pi(Factor=random)
item_20 = ListItem(List=花弁crv, Index=0, Wrap=True)  # -> Item, Item1
amp_5 = Amplitude(Vector=deplane.ZAxis, Amplitude=Slider(8, range=0..100))
clscrv = CloseCurve(Curve=project_4.Geometry, CloseType=0, Bulge=0.5, Tolerance=0)  # -> Closed, R
花中央掘り込みpt = Geometry(move_18.Geometry)
花中央掘り込みpt_2 = Geometry(花中央掘り込みpt)
series_6 = Series(Start=0, Step=division_8, Count=expr("x+1", 花弁筋本数_2))
X_7 = UnitX(Factor=1)
rotate_16 = Rotate(Geometry=move_16.Geometry, Angle=pi_2, Plane=move_16.Geometry)  # -> Geometry, Transform
extr_2 = Extrude(Base=clscrv.Closed, Direction=amp_5)
line_4 = LineSDL(Start=xy_8, Direction=X_7, Length="1000")
Z_12 = UnitZ(Factor=彫り厚み_3)
tweencrv = TweenCurve(CurveA=item_20.Item, CurveB=item_20.Item1, Factor=series_6, BlendType=0)
tweencrv_2 = TweenCurve(CurveA=item_20.Item, CurveB=item_20.Item1, Factor=0.5, BlendType=0)
rotate_17 = Rotate(Geometry=line_4, Angle=expr("-x", expression_16), Plane=xy_8)  # -> Geometry, Transform
cap = CapHoles(Brep=extr_2)
rotate_18 = Rotate(Geometry=line_4, Angle=expression_16, Plane=xy_8)  # -> Geometry, Transform
neg_9 = Negative(Value=Z_12)
divide_9 = DivideCurve(Curve=tweencrv, Count="5", Kinks=False)  # -> Points, Tangents, Parameters
divide_10 = DivideCurve(Curve=tweencrv_2, Count="5", Kinks=False)  # -> Points, Tangents, Parameters
end_11 = EndPoints(Curve=rotate_17.Geometry)  # -> Start, End
end_12 = EndPoints(Curve=rotate_18.Geometry)  # -> Start, End
project_5 = ProjectPoint(Point=divide_10.Points, Direction="{0,0,1}", Geometry=topsrf)  # -> Point, Index
panel_11 = Panel(extr_2)
project_6 = ProjectPoint(Point=divide_9.Points, Direction="{0,0,1}", Geometry=topsrf)  # -> Point, Index
merge_12 = Merge(Data1=end_11.End, Data2=end_12.End, Data3=end_11.Start)
intcrv_12 = Interpolate(Vertices=project_5.Point, Degree=3, Periodic=False, KnotStyle=1)  # -> flatten(Curve), Length, Domain
intcrv_13 = Interpolate(Vertices=project_6.Point, Degree=3, Periodic=False, KnotStyle=1)  # -> flatten(Curve), Length, Domain
pline = PolyLine(Vertices=merge_12, Closed=True)
Z_13 = UnitZ(Factor="100")
boundary_2 = BoundarySurfaces(Edges=pline)
move_19 = Move(Geometry=intcrv_12.Curve, Motion=neg_9)  # -> simplify(Geometry), Transform
move_20 = Move(Geometry=intcrv_13.Curve, Motion=neg_9)  # -> simplify(Geometry), Transform
neg_10 = Negative(Value=花弁先オフセット_2)
重なりスケール最小値_2 = Data(重なりスケール最小値)
重なり高さギャップ_3 = Data(重なり高さギャップ)
重なり間回転_2 = Data(重なり間回転)
彫り厚み_5 = Data(彫り厚み)
重なり層数_3 = Data(重なり層数)
花弁枚数_3 = Data(花弁掘り込み_花弁枚数)
larger = LargerThan(FirstNumber=花弁筋本数_2, SecondNumber="0")  # -> LargerThan, OrEqualTo
# 花弁１枚のパス
extr_3 = Extrude(Base=boundary_2, Direction=Z_13)
花中央掘り込み = Geometry(花中央掘り込みボリューム)
ext_2 = ExtendCurve(Curve=move_19.Geometry, Type=0, Start=neg_10, End=neg_10)
花中央掘り込みpt_3 = Geometry(花中央掘り込みpt)
ext_3 = ExtendCurve(Curve=move_20.Geometry, Type=0, Start=neg_10, End=neg_10)
散乱_2 = Data(散乱_toggle)
散乱_3 = Data(散乱_toggle)
subtraction_8 = Subtraction(A=重なり高さギャップ_3, B=彫り厚み_5)
中央部半径_3 = Data(中央部半径)
皿中心pt_2 = Geometry(pt_5)
filter_6 = StreamFilter(Gate=larger.LargerThan, Stream0=ext_2, Stream1=ext_3)
trim_3 = TrimWithBrep(Curve=filter_6, Brep=extr_3)  # -> Inside, Outside
sph_3 = Sphere(Base=皿中心pt_2, Radius=expr("x/2", 中央部半径_3))
one_over_x = OneOverX(Value=重なり層数_3)
geo_11 = Geometry(flatten(trim_3.Inside))
series_7 = Series(Start=one_over_x, Step=one_over_x, Count=重なり層数_3)
twn2nums_2 = TweenTwoNumbers(NumberA=重なりスケール最小値_2, NumberB="1", Factor=series_7)
twn2nums_3 = TweenTwoNumbers(NumberA="0", NumberB=重なり高さギャップ_3, Factor=series_7)
ビット径_6 = Data(ビット径_2)
trim_4 = TrimWithBrep(Curve=geo_11, Brep=sph_3)  # -> Inside, Outside
addition_7 = Addition(A=subtraction_8, B=彫り厚み_5)
geo_12 = Geometry(trim_4.Outside)
geo_13 = Geometry(flatten(geo_12))
multiplication_5 = Multiplication(A=twn2nums_2, B=花弁枚数_3)
multiplication_6 = Multiplication(A=twn2nums_2, B=彫り半径_3)
scale_2 = Scale(Geometry=geo_13, Center=xy_4, Factor=graft(twn2nums_2))  # -> Geometry, Transform
round_3 = Round(Number=multiplication_5)  # -> Nearest, Floor, Ceiling
division_9 = Division(A=twn2nums_3, B=multiplication_6)
Z_14 = UnitZ(Factor=subtraction_8)
deplane_2 = DeconstructPlane(Plane=xy_4)  # -> Origin, XAxis, YAxis, ZAxis
# 回転コピー
pipe = Pipe(Curve=flatten(geo_12), Radius=expr("x/2", ビット径_6), Caps=2)  # -> flatten(Pipe)
subtraction_9 = Subtraction(A=twn2nums_3, B=彫り厚み_5)
atan = ArcTangent(Value=division_9)  # -> graft(Result)
move_21 = Move(Geometry=scale_2.Geometry, Motion=Z_14)  # -> simplify(Geometry), Transform
expression_17 = Expression(x=round_3.Ceiling, Expression="2*Pi/x")
Z_15 = UnitZ(Factor=expr("x/2", ビット径_6))
division_10 = Division(A="2*Pi", B=花弁枚数_2)
Z_16 = UnitZ(Factor=subtraction_9)
move_22 = Move(Geometry=pipe, Motion=Z_15)  # -> flatten(Geometry), Transform
series_8 = Series(Start=0, Step=expression_17, Count=round_3.Ceiling)
rot3d = Rotate3D(Geometry=move_21.Geometry, Angle=atan, Center=xy_4, Axis=deplane_2.YAxis)  # -> Geometry, Transform
series_9 = Series(Start=0, Step=division_10, Count=花弁枚数_2)
group = Group(Objects=rot3d.Geometry)
rotate_19 = Rotate(Geometry=flatten(geo_12), Angle=graft(series_9), Plane=PlaneXY(0, 0, 0))  # -> flatten(Geometry), Transform
rotate_20 = Rotate(Geometry=move_22.Geometry, Angle=graft(series_9), Plane=PlaneXY(0, 0, 0))  # -> flatten(Geometry), Transform
move_23 = Move(Geometry=simplify(group), Motion=simplify(graft(Z_16)))  # -> Geometry, Transform
pi_3 = Pi(Factor=重なり間回転_2)
series_10 = Series(Start=0, Step=pi_3, Count=重なり層数_3)
rotate_21 = Rotate(Geometry=simplify(move_23.Geometry), Angle=simplify(series_8), Plane=xy_4)  # -> Geometry, Transform
rotate_22 = Rotate(Geometry=simplify(rotate_21.Geometry), Angle=simplify(graft(series_10)), Plane=xy_4)  # -> Geometry, Transform
Z_17 = UnitZ(Factor=expr("x/2", ビット径_6))
花弁枚数_4 = Data(花弁枚数_2)
ungroup = Ungroup(Group=rotate_22.Geometry)
花弁枚数_5 = Data(花弁枚数_2)
expression_18 = Expression(x=花弁枚数_4, Expression="Pi/x")
花弁彫込パス = Geometry(flatten(ungroup))
pipe_2 = Pipe(Curve=flatten(花弁彫込パス), Radius=expr("x/2", ビット径_6), Caps=2)  # -> flatten(Pipe)
move_24 = Move(Geometry=pipe_2, Motion=Z_17)  # -> flatten(Geometry), Transform
expression_19 = Expression(x=花弁枚数_5, Expression="Pi/x")
rotate_23 = Rotate(Geometry=花弁彫込パス, Angle=expression_18, Plane=PlaneXY(0, 0, 0))  # -> Geometry, Transform
花弁回転_2 = Data(花弁回転)
rotate_24 = Rotate(Geometry=move_24.Geometry, Angle=expression_19, Plane=PlaneXY(0, 0, 0))  # -> Geometry, Transform
filter_7 = StreamFilter(Gate=花弁回転_2, Stream0=花弁彫込パス, Stream1=rotate_23.Geometry)
pln_2 = Plane(xy_4)
pln_3 = Plane(pln_2)
filter_8 = StreamFilter(Gate=花弁回転_2, Stream0=move_24.Geometry, Stream1=rotate_24.Geometry)
花弁彫込パス_2 = Geometry(filter_7)
花弁彫込パス_3 = Geometry(花弁彫込パス_2)
group_2 = Group(Objects=flatten([花弁彫込パス_3, 花中央掘り込みpt_2]))
花弁彫込パス_4 = Geometry(花弁彫込パス_2)
merge_13 = Merge(Data1=花弁彫込パス_4, Data2=花中央掘り込みpt_3)  # -> flatten(Result)
加工ボリューム = Geometry(filter_8)
花弁加工ボリューム = Geometry(simplify(flatten(加工ボリューム)))
group_3 = Group(Objects=[花弁加工ボリューム, 花中央掘り込みボリューム_2])
orient = Orient(Geometry=group_3, Source=pln_3, Target=rotate_16.Geometry)  # -> Geometry, Transform
transform_2 = Transform(Geometry=group_2, Transform=orient.Transform)  # -> simplify(Geometry)
ungroup_2 = Ungroup(Group=orient.Geometry)  # -> flatten(Objects)
ungroup_3 = Ungroup(Group=transform_2)  # -> simplify(Objects)
加工ボリューム_2 = Geometry(ungroup_2)
加工パス = Geometry(ungroup_3)
花弁加工ボリューム_2 = Geometry(加工ボリューム)
加工ボリューム_3 = Geometry(加工ボリューム_2)
加工パス_2 = Geometry(加工パス)
merge_14 = Merge(Data1=花弁加工ボリューム_2, Data2=花中央掘り込み)  # -> flatten(Result)
filter_9 = StreamFilter(Gate=散乱_3, Stream0=merge_14, Stream1=加工ボリューム_3)
加工ボリューム_4 = Geometry(filter_9)
filter_10 = StreamFilter(Gate=散乱_2, Stream0=merge_13, Stream1=加工パス_2)
加工パス_3 = Geometry(filter_10)
加工パス_4 = Geometry(加工パス_3)  # disabled
filtertype = FilterByType(ObjectType=list_3, Geometry=加工パス_4, invertFilter=False, returnNulls=False)  # -> ExcludedGeometry, IncludedGeometry; disabled
filtertype_2 = FilterByType(ObjectType=list_2, Geometry=加工パス_4, invertFilter=False, returnNulls=False)  # -> ExcludedGeometry, IncludedGeometry; disabled
project_7 = Project(Geometry=filtertype_2.IncludedGeometry, Plane=xy)  # -> Geometry, Transform; disabled
project_8 = Project(Geometry=filtertype.IncludedGeometry, Plane=xy)  # -> Geometry, Transform; disabled
offcrv = OffsetCurve(
    Curve=filtertype_2.IncludedGeometry,
    Plane=PlaneXY(0, 0, 0),
    Distance=number_slider,
    BothSides=neg_2,
    Kinks=0,
    CapType=panel_5)  # disabled
cir_4 = Circle(Plane=project_8.Geometry, Radius=number_slider_2)  # disabled
boundary_3 = BoundarySurfaces(Edges=offcrv)  # disabled
object = ModelObject(Object=cir_4, Layer=panel_6)  # disabled
object_2 = ModelObject(Object=project_7.Geometry, Layer=panel_6)  # disabled
list_4 = ValueList({"AngularDimension", "Arc", "Block", "Brep", "Circle", "Curve", "Dimension", "Ellipse", "Extrusion", "Hatch", "Leader", "Line", "LinearDimension", "Mesh", "Point", "Polyline", "Polysurface", "RadialDimension", "Surface", "Text", "TextDot"}, selected="Curve")  # disabled
list_5 = ValueList({"AngularDimension", "Arc", "Block", "Brep", "Circle", "Curve", "Dimension", "Ellipse", "Extrusion", "Hatch", "Leader", "Line", "LinearDimension", "Mesh", "Point", "Polyline", "Polysurface", "RadialDimension", "Surface", "Text", "TextDot"}, selected="Point")  # disabled
tab太さ = Slider(6, range=0..20)  # disabled
加工パス_5 = Geometry(加工パス_3)  # disabled
外形掘り込みピッチ_5 = Data(外形掘り込みピッチ_2)  # disabled
外形カットパス_裏_2 = Geometry(外形カットパス_裏)  # disabled
裏面仕上げパス_2 = Geometry(裏面仕上げパス)  # disabled
外形パス_裏_2 = Geometry(外形パス_裏)  # disabled
filtertype_3 = FilterByType(ObjectType=list_4, Geometry=加工パス_5, invertFilter=False, returnNulls=False)  # -> ExcludedGeometry, flatten(IncludedGeometry); disabled
filtertype_4 = FilterByType(ObjectType=list_5, Geometry=加工パス_5, invertFilter=False, returnNulls=False)  # -> ExcludedGeometry, flatten(IncludedGeometry); disabled
material_3 = Geometry(material)  # disabled
ビット径_7 = Data(ビット径_2)  # disabled
tickness = ValueList({"3", "6", "9", "12", "15", "18", "21", "24", "30", "36"}, selected="18")  # disabled
# 加工パス
panel_12 = Panel("{500,0,0}")  # disabled
jig_crv = Geometry(<curve referenced from the Rhino model>)  # disabled
material_4 = Geometry(material_3)  # disabled
外形掘り込みピッチ_6 = Data(外形掘り込みピッチ_2)  # disabled
花中央掘り込みpt_4 = Geometry(filtertype_4.IncludedGeometry)  # disabled
外形カットパス_表_2 = Geometry(外形カットパス_表)  # disabled
表面仕上げパス_2 = Geometry(表面仕上げパス)  # disabled
# 粗削り
外形パス_裏_3 = Geometry(外形パス_裏_2)  # disabled
material_5 = Geometry(material_3)  # disabled
外形掘り込みピッチ_7 = Data(外形掘り込みピッチ_5)  # disabled
外形パス_表_2 = Geometry(外形パス_表)  # disabled
# 裏返し
debox = DeconstructBox(Box=material_4)  # -> Plane, X, Y, Z; disabled
pt_9 = Point(panel_12)  # disabled
material_6 = Geometry(material)  # disabled
# 仕上パス
裏面仕上げパス_3 = Geometry(裏面仕上げパス_2)  # disabled
ビット径_8 = Data(ビット径_2)  # disabled
彫込パス = Geometry(filtertype_3.IncludedGeometry)  # disabled
boxrec_2 = BoxRectangle(Rectangle=jig_crv, Height=tickness)  # disabled
dedomain = DeconstructDomain(Domain=debox.Z)  # -> Start, End; disabled
面出し範囲_材料オフセット = Slider(5, range=0..100)  # disabled
extgeo = ExtendedGeometry([<elefrontblock referenced from the Rhino model> x4])  # disabled
jig = Geometry(boxrec_2)  # disabled
num = Number(外形掘り込みピッチ_5)  # disabled
num_2 = Number(debox.Z)  # disabled
avr = Average(Input=[dedomain.Start, dedomain.End])  # disabled
panel_13 = Panel("10")  # disabled
debox_2 = DeconstructBox(Box=material_5)  # -> Plane, X, Y, Z; disabled
面出しビット頂点深さ = Panel("3")  # disabled
# jig
toggle_3 = GroupToggle(ToggleActive=True, ToggleVisible=False)  # disabled
# 面出し
外形カットパス_表_3 = Geometry(外形カットパス_表_2)  # disabled
list_6 = ValueList({"00_レイアウト", "2D", "2D::0", "2D::00_", "2D::00_::00_hideline", "3D", "3D::ClippingPlane", "3D::Layer 02", "3D::Layer 03", "3D::Layer 04", "3D::Layer 05", "By Parent", "CAM", "CAM::baseline", "CAM::biss", "CAM::cut", "CAM::line", "CAM::pocket", "CAM::pt", "CAM::sheet", "CAM::tab", "VisualARQ Locked Levels"}, selected="CAM::biss")  # disabled
material_7 = Geometry(material_6)  # disabled
ビット径_9 = Data(ビット径_8)  # disabled
integer_division_4 = IntegerDivision(A=num_2, B=num)  # disabled
extgeo_r6 = ExtendedGeometryR6([<elefrontblock referenced from the Rhino model> x12])  # disabled
series_11 = Series(Start=外形掘り込みピッチ_7, Step=外形掘り込みピッチ_7, Count=panel_13)  # disabled
cut_depth_offset = DigitScroller(Scroller_Digits=12, Scroller_Prefix="Cut Depth Offset", Scroller_Radix=9, Scroller_Value=0.2)  # disabled
xy_9 = XYPlane(Origin=Point(0, 0, 0))  # disabled
Z_18 = UnitZ(Factor=avr)  # disabled
dedomain_2 = DeconstructDomain(Domain=debox_2.Z)  # -> Start, End; disabled
deblock_r6 = DeconstructBlockR6(Block=extgeo_r6)  # -> Name, Plane, Geometry; disabled
Z_19 = UnitZ(Factor=series_11)  # -> graft(UnitVector); disabled
series_12 = Series(Start=0, Step=num, Count=integer_division_4)  # -> reverse(Series); disabled
jog_オフセット = Panel("3")  # disabled
# 花弁彫り込みパス（効率化）
彫込パス_2 = Geometry(彫込パス)  # disabled
move_25 = Move(Geometry=xy_9, Motion=Z_18)  # -> Geometry, Transform; disabled
外形掘り込みピッチ_8 = Data(外形掘り込みピッチ_6)  # disabled
幅揃え深さ = Panel("12")  # disabled
ビット径_10 = Data(ビット径_8)  # disabled
# 幅揃えパス
material_8 = Geometry(material_6)  # disabled
debox_3 = DeconstructBox(Box=material_7)  # -> Plane, X, Y, Z; disabled
# 粗削り
外形パス_表_3 = Geometry(外形パス_表_2)  # disabled
外形掘り込みピッチ_9 = Data(外形掘り込みピッチ_6)  # disabled
material_9 = Geometry(material_6)  # disabled
filterlay_r6 = FilterByLayerR6(Geometry=deblock_r6.Geometry, Layer=list_6)  # -> flatten(Geometry); disabled
yz = YZPlane(Origin=move_25.Geometry)  # disabled
rotate_25 = Rotate(Geometry=裏面仕上げパス_2, Angle=expr("Pi", 1.570796327), Plane=yz)  # -> Geometry, Transform; disabled
rotate_26 = Rotate(Geometry=外形カットパス_裏_2, Angle=expr("Pi", 1.570796327), Plane=yz)  # -> Geometry, Transform; disabled
join_9 = JoinCurves(Curves=彫込パス_2, Preserve=False)  # disabled
Z_20 = UnitZ(Factor=series_12)  # disabled
volume = Volume(Geometry=material_3)  # -> Volume, Centroid; disabled
debox_4 = DeconstructBox(Box=material_8)  # -> Plane, X, Y, Z; disabled
panel_14 = Panel("3")  # disabled
dedomain_3 = DeconstructDomain(Domain=debox_3.Z)  # -> Start, End; disabled
addition_8 = Addition(A=tickness, B=cut_depth_offset)  # disabled
rotate_27 = Rotate(Geometry=material_4, Angle=expr("Pi", 1.570796327), Plane=yz)  # -> Geometry, Transform; disabled
dispatch = Dispatch(List=join_9, DispatchPattern=[True, False])  # -> ListA, ListB; disabled
move_26 = Move(Geometry=rotate_26.Geometry, Motion=Z_20)  # -> Geometry, Transform; disabled
series_13 = Series(Start=外形掘り込みピッチ_9, Step=外形掘り込みピッチ_9, Count=panel_14)  # disabled
item_21 = ListItem(List=外形カットパス_表_3, Index=0, Wrap=True)  # disabled
xy_10 = XYPlane(Origin=Point(0, 0, 0))  # disabled
subtraction_10 = Subtraction(A=dedomain_3.End, B=dedomain_3.Start, C=面出しビット頂点深さ)  # disabled
rectangle_2 = Rectangle(Plane=PlaneXY(0, 0, 0), XSize=debox_3.X, YSize=debox_3.Y, Radius=0)  # -> Rectangle, Length; disabled
expression_20 = Expression(r=ビット径_9, d=面出しビット頂点深さ, Expression="r*sin(acos(1-2*d/r))")  # disabled
dedomain_4 = DeconstructDomain(Domain=debox_4.X)  # -> Start, End; disabled

# ----
# Pocket
pocket_depth = DigitScroller(Scroller_Digits=12, Scroller_Prefix="Pocket Depth", Scroller_Radix=9, Scroller_Value=9)  # disabled
endmill_d = DigitScroller(Scroller_Digits=12, Scroller_Prefix="Endmill D", Scroller_Radix=9, Scroller_Value=12.7)  # disabled
start_depth = DigitScroller(Scroller_Digits=12, Scroller_Prefix="Start Depth", Scroller_Radix=9, Scroller_Value=0)  # disabled
z_step_mm = DigitScroller(Scroller_Digits=12, Scroller_Prefix="Z_Step(mm)", Scroller_Radix=9, Scroller_Value=6)  # disabled
xy_step = Slider(50, range=0..100)  # disabled
fillet_block = ExtendedGeometry([<elefrontblock referenced from the Rhino model> x4])  # disabled
material_10 = Geometry(jig)  # disabled
crv = Geometry([<curve referenced from the Rhino model> x6])  # disabled
pocket_230206 = Pocket_230206(
    crv=crv,
    start_depth=start_depth,
    pocet_depth=pocket_depth,
    endmill_d=endmill_d,
    xy_step=xy_step,
    z_step_mm=z_step_mm,
    B=material_10,
    fillet=fillet_block)  # disabled
pocket_path = Geometry(pocket_230206)  # disabled

expression_21 = Expression(x=tickness, y=pocket_depth, Expression="x-y")  # disabled
jig_t = Data(expression_21)  # disabled
dedomain_5 = DeconstructDomain(Domain=debox_4.Y)  # -> Start, End; disabled

# ----
# Cut
endmill_d_2 = DigitScroller(Scroller_Digits=12, Scroller_Prefix="Endmill D", Scroller_Radix=9, Scroller_Value=12.7)  # disabled
start_depth_2 = DigitScroller(Scroller_Digits=12, Scroller_Prefix="Start Depth", Scroller_Radix=9, Scroller_Value=0)  # disabled
z_step_mm_2 = DigitScroller(Scroller_Digits=12, Scroller_Prefix="Z_Step(mm)", Scroller_Radix=9, Scroller_Value=6)  # disabled
tab_d = DigitScroller(Scroller_Digits=12, Scroller_Prefix="Tab_D", Scroller_Radix=9, Scroller_Value=6)  # disabled
tab_l = DigitScroller(Scroller_Digits=12, Scroller_Prefix="Tab_L", Scroller_Radix=9, Scroller_Value=9)  # disabled
list_7 = ValueList({"Outside": 0, "Center": 1, "Inside": 2}, selected="Outside")  # disabled
fillet_block_2 = ExtendedGeometry()  # disabled
material_11 = Geometry(jig)  # disabled
crv_2 = Geometry(<curve referenced from the Rhino model>)  # disabled
tab_pt = Point()  # disabled
cut_path_230206 = CutPath_230206(
    cut_line=crv_2,
    material=material_11,
    start_depth=start_depth_2,
    cut_depth=addition_8,
    z_path=z_step_mm_2,
    endmill_d=endmill_d_2,
    tab_pt=tab_pt,
    tab_l=tab_l,
    tab_d=tab_d,
    offset=list_7,
    fillet=fillet_block_2)  # disabled
cut_path = Geometry(cut_path_230206)  # disabled

flip_10 = FlipCurve(Curve=dispatch.ListB)  # -> Curve, Flag; disabled
dedomain_6 = DeconstructDomain(Domain=debox_4.Z)  # -> Start, End; disabled
裏返し = Transform(rotate_27.Transform)  # disabled
裏返し_2 = Transform(裏返し)  # disabled
裏返し_3 = Transform(裏返し)  # disabled
transform_3 = Transform(Geometry=外形パス_裏_3, Transform=裏返し_2)  # disabled
transform_4 = Transform(Geometry=裏面仕上げパス_3, Transform=裏返し_3)  # disabled
皿表面 = Geometry(transform_4)  # disabled
move_27 = Move(Geometry=transform_3, Motion=Z_19)  # -> reverse(Geometry), Transform; disabled
end_13 = EndPoints(Curve=move_27.Geometry)  # -> Start, End; disabled
pdecon = Deconstruct(Point=end_13.Start)  # -> XComponent, YComponent, ZComponent; disabled
# tab
transform_5 = Transform(Geometry=volume.Centroid, Transform=rotate_27.Transform)  # disabled
Z_21 = UnitZ(Factor=series_13)  # -> graft(UnitVector); disabled
geo_14 = Geometry(flatten(move_26.Geometry))  # disabled
Z_22 = UnitZ(Factor=subtraction_10)  # disabled
# 中央部彫り込みパス
花中央掘り込みpt_5 = Geometry(花中央掘り込みpt_4)  # disabled

# ----
# biss
list_8 = ValueList({"Point", "Curve", "Arc", "Circle", "Ellipse", "Line", "Polyline", "Brep", "Surface", "Polysurface", "Extrusion", "Block", "Text", "TextDot", "Dimension", "LinearDimension", "AngularDimension", "RadialDimension", "Hatch", "Leader"}, selected="Curve")  # disabled
pocket_depth_2 = DigitScroller(Scroller_Digits=12, Scroller_Prefix="Pocket Depth", Scroller_Radix=9, Scroller_Value=1)  # disabled
endmill_d_3 = DigitScroller(Scroller_Digits=12, Scroller_Prefix="Endmill D", Scroller_Radix=9, Scroller_Value=12.7)  # disabled
start_depth_3 = DigitScroller(Scroller_Digits=12, Scroller_Prefix="Start Depth", Scroller_Radix=9, Scroller_Value=0)  # disabled
z_step_mm_3 = DigitScroller(Scroller_Digits=12, Scroller_Prefix="Z_Step(mm)", Scroller_Radix=9, Scroller_Value=4)  # disabled
xy_step_2 = Slider(50, range=0..100)  # disabled
filtertype_5 = FilterByType(ObjectType=list_8, Geometry=filterlay_r6, invertFilter=False, returnNulls=False)  # -> ExcludedGeometry, IncludedGeometry; disabled
fillet_block_3 = ExtendedGeometry([<elefrontblock referenced from the Rhino model> x4])  # disabled
material_12 = Geometry(jig)  # disabled
crv_3 = Geometry(filtertype_5.IncludedGeometry)  # disabled
pocket_230206_2 = Pocket_230206(
    crv=crv_3,
    start_depth=start_depth_3,
    pocet_depth=pocket_depth_2,
    endmill_d=endmill_d_3,
    xy_step=xy_step_2,
    z_step_mm=z_step_mm_3,
    B=material_12,
    fillet=fillet_block_3)  # disabled
pocket_path_2 = Geometry(pocket_230206_2)  # disabled

project_9 = Project(Geometry=item_21, Plane=xy_10)  # -> Geometry, Transform; disabled
Y = UnitY(Factor=debox_4.Y)  # disabled
pt_10 = ConstructPoint(XCoordinate=dedomain_4.Start, YCoordinate=dedomain_5.Start, ZCoordinate=dedomain_6.Start)  # disabled
smaller = SmallerThan(FirstNumber=pdecon.ZComponent, SecondNumber=dedomain_2.End)  # -> SmallerThan, OrEqualTo; disabled
weave = Weave(Pattern=[0, 1], Stream0=dispatch.ListA, Stream1=flip_10.Curve, NullGaps=False)  # disabled
move_28 = Move(Geometry=rectangle_2.Rectangle, Motion=Z_22)  # -> Geometry, Transform; disabled
panel_15 = Panel("2")  # disabled
xy_11 = XYPlane(Origin=transform_5)  # disabled
xz_9 = XZPlane(Origin=transform_5)  # disabled
panel_16 = Panel("""Pi/4
-Pi/4""")  # disabled
move_29 = Move(Geometry=外形パス_表_3, Motion=Z_21)  # -> Geometry, Transform; disabled
panel_17 = Panel("0.1")  # disabled
外形カットパス_裏_3 = Geometry(geo_14)  # disabled
Z_23 = UnitZ(Factor=panel_15)  # disabled
dispatch_2 = Dispatch(List=move_27.Geometry, DispatchPattern=smaller.SmallerThan)  # -> flatten(ListA), ListB; disabled
move_30 = Move(Geometry=project_9.Geometry, Motion=Z_22)  # -> Geometry, Transform; disabled
topoly = CurveToPolyline(Curve=weave, ToleranceDistance=0, ToleranceAngle=panel_17)  # -> Polyline, Segments; disabled
move_31 = Move(Geometry=pt_10, Motion=Y)  # -> Geometry, Transform; disabled
expression_22 = Expression(x=ビット径_10, Expression="x/2")  # disabled
rotate_28 = Rotate(Geometry=xz_9, Angle=panel_16, Plane=xy_11)  # -> Geometry, Transform; disabled
end_14 = EndPoints(Curve=move_29.Geometry)  # -> Start, End; disabled
move_32 = Move(Geometry=花中央掘り込みpt_5, Motion=Z_23)  # -> Geometry, Transform; disabled
offset_6 = OffsetCurve(Curve=move_28.Geometry, Distance=面出し範囲_材料オフセット, Corners=1)  # disabled
X_8 = UnitX(Factor=1)  # disabled
num_3 = Number(debox_4.Z)  # disabled
粗削り = Geometry(reverse(dispatch_2.ListA))  # disabled
expression_23 = Expression(x=ビット径_7, Expression="x/2")  # disabled
division_11 = Division(A=幅揃え深さ, B=外形掘り込みピッチ_8)  # disabled
series_14 = Series(Start=expression_20, Step=expression_20, Count=10)  # disabled
brepinc = PointInBrep(Brep=material_9, Point=end_14.Start, Strict=False)  # disabled
subtraction_11 = Subtraction(A=num_3, B=幅揃え深さ)  # disabled
pcx = CurvePlane(Curve=rotate_26.Geometry, Plane=rotate_28.Geometry)  # -> flatten(Points), ParamsC, ParamsP; disabled
Y_2 = UnitY(Factor=expression_22)  # disabled
Z_24 = UnitZ(Factor=jog_オフセット)  # disabled
line_5 = LineSDL(Start=move_31.Geometry, Direction=X_8, Length=debox_4.X)  # disabled
shift_3 = ShiftList(List=move_32.Geometry, Shift=1, Wrap=True)  # disabled
offset_7 = OffsetCurve(Curve=move_30.Geometry, Distance=series_14, Corners=1)  # -> flatten(Curve); disabled
dispatch_3 = Dispatch(List=move_29.Geometry, DispatchPattern=brepinc)  # -> flatten(ListA), ListB; disabled
round_4 = Round(Number=division_11)  # -> Nearest, Floor, Ceiling; disabled
addition_9 = Addition(A=expression_23, B=tab太さ)  # disabled
move_33 = Move(Geometry=topoly.Polyline, Motion=Z_24)  # -> Geometry, Transform; disabled
panel_18 = Panel("""0
1
2""")  # disabled
move_34 = Move(Geometry=line_5, Motion=Y_2)  # -> Geometry, Transform; disabled
panel_19 = Panel("0.1")  # disabled
series_15 = Series(Start=subtraction_11, Step=外形掘り込みピッチ_8, Count=round_4.Floor)  # -> reverse(Series); disabled
weave_2 = Weave(Pattern=panel_18, Stream0=花中央掘り込みpt_5, Stream1=move_32.Geometry, Stream2=shift_3, NullGaps=False)  # disabled
ccx_3 = CurveCurve(CurveA=offset_7, CurveB=offset_6)  # -> Points, ParamsA, ParamsB; disabled
shift_4 = ShiftList(List=move_33.Geometry, Shift=1, Wrap=False)  # disabled
ccx_4 = CurveCurve(CurveA=offset_7, CurveB=move_28.Geometry)  # -> Points, ParamsA, ParamsB; disabled
topoly_2 = CurveToPolyline(Curve=dispatch_3.ListA, ToleranceDistance=0, ToleranceAngle=panel_19)  # -> reverse(Polyline), Segments; disabled
sph_4 = Sphere(Base=pcx.Points, Radius=addition_9)  # disabled
end_15 = EndPoints(Curve=graft(move_33.Geometry))  # -> Start, simplify(End); disabled
explode_3 = Explode(Curve=topoly.Polyline, Recursive=True)  # -> Segments, simplify(Vertices); disabled
Z_25 = UnitZ(Factor=series_15)  # disabled
pline_2 = PolyLine(Vertices=weave_2, Closed=False)  # disabled
end_16 = EndPoints(Curve=graft(shift_4))  # -> simplify(Start), End; disabled
trim_5 = TrimWithRegion(Curve=offset_7, Region=offset_6)  # -> flatten(Inside), Outside; disabled
tstat_5 = TreeStatistics(Tree=ccx_3.Points)  # -> Paths, Length, Count; disabled
move_35 = Move(Geometry=move_34.Geometry, Motion=Z_25)  # -> Geometry, Transform; disabled
tstat_6 = TreeStatistics(Tree=ccx_4.Points)  # -> Paths, Length, Count; disabled
explode_4 = Explode(Curve=topoly_2.Polyline, Recursive=True)  # -> flatten(Segments), flatten(Vertices); disabled
tab = Geometry(sph_4)  # disabled
merge_15 = Merge(Data1=pocket_path, Data2=cut_path)  # disabled
中央部掘り込みパス = Geometry(pline_2)  # disabled
panel_20 = Panel("1")  # disabled
merge_16 = Merge(Data1=explode_3.Vertices, Data2=end_15.End, Data3=end_16.Start)  # -> flatten(Result); disabled
panel_21 = Panel("1")  # disabled
ext_4 = ExtendCurve(Curve=move_35.Geometry, Type=0, Start=ビット径_10, End=expr("x*2", ビット径_10))  # disabled
larger_2 = LargerThan(FirstNumber=tstat_5.Length, SecondNumber=panel_20)  # -> LargerThan, OrEqualTo; disabled
larger_3 = LargerThan(FirstNumber=tstat_6.Length, SecondNumber=panel_21)  # -> LargerThan, OrEqualTo; disabled
save = Button()  # disabled
pline_3 = PolyLine(Vertices=explode_4.Vertices, Closed=False)  # disabled
or = GateOr(A=larger_2.OrEqualTo, B=larger_3.LargerThan)  # disabled
pline_4 = PolyLine(Vertices=merge_16, Closed=False)  # disabled
dispatch_4 = Dispatch(List=ext_4, DispatchPattern=[True, False])  # -> ListA, ListB; disabled
dispatch_5 = Dispatch(List=offset_7, DispatchPattern=or)  # -> ListA, ListB; disabled
粗削り_2 = Geometry(reverse(pline_3))  # disabled
panel_22 = Panel("0.1")  # disabled
外形カットパス_裏_4 = Geometry()  # disabled
皿表面_2 = Geometry(皿表面)  # disabled
粗削り_3 = Geometry(粗削り)  # disabled
花びら = Geometry(pline_4)  # disabled
flip_11 = FlipCurve(Curve=dispatch_4.ListB)  # -> Curve, Flag; disabled
geo_15 = Geometry(dispatch_5.ListA)  # disabled
topoly_3 = CurveToPolyline(Curve=geo_15, ToleranceDistance=0, ToleranceAngle=panel_22)  # -> Polyline, Segments; disabled
weave_3 = Weave(Pattern=[0, 1], Stream0=dispatch_4.ListA, Stream1=flip_11.Curve, NullGaps=False)  # disabled

# ----
# Folder
# Filne name
preview_3 = ControlKnob(Decimals=0, Limit=False, Maximum=60, Minimum=0, Range=60, Value=0)  # disabled
zorigin = ValueList({"Table Surface", "Material Surface"}, selected="Table Surface")  # disabled
parts_name = Panel("jig")  # disabled
path_name = Panel(".sbp")  # disabled
path_2 = Geometry(flatten(merge_15))  # disabled
material_13 = Box(jig)  # disabled
save_2 = Data(save)  # disabled
set_pt = Panel("{0,0,0}")  # disabled
xy_speed_mm_s = Panel("75")  # disabled
safez = Panel("30")  # disabled
merge_17 = Merge(Data1=flatten(parts_name), Data2=flatten(path_name))  # disabled
home_pt = Panel("{0,0,45}")  # disabled
spindle_rpm = Panel("18000")  # disabled
z_speed_mm_s = Panel("25")  # disabled
panel_23 = Panel("_")  # disabled
join_10 = TextJoin(Text=merge_17, Join=panel_23)  # disabled
folder_name = Panel("D:\FD\")  # disabled
file_name = Panel(join_10)  # disabled
sbp_file_maker = SbpFileMaker(
    folder=folder_name,
    file=file_name,
    path=path_2,
    safez=safez,
    zorigin=zorigin,
    home_pt=home_pt,
    set_pt=set_pt,
    material_box=material_13,
    rpm=spindle_rpm,
    xy_speed=xy_speed_mm_s,
    z_speed=z_speed_mm_s,
    i=preview_3,
    save=save_2)  # -> info_2, sbp_file, table_base; disabled
info = Panel(sbp_file_maker.info_2)  # disabled

# ----
# Folder
# Filne name
zorigin_2 = ValueList({"Table Surface", "Material Surface"}, selected="Table Surface")  # disabled
preview_4 = ControlKnob(Decimals=0, Limit=False, Maximum=60, Minimum=0, Range=60, Value=0)  # disabled
path_name_2 = Panel("biss.sbp")  # disabled
folder_name_2 = Panel(folder_name)  # disabled
parts_name_2 = Panel(parts_name)  # disabled
path_3 = Geometry(flatten(pocket_path_2))  # disabled
save_3 = Data(save)  # disabled
material_14 = Box(jig)  # disabled
set_pt_2 = Panel("{0,0,0}")  # disabled
xy_speed_mm_s_2 = Panel("70")  # disabled
safez_2 = Panel("30")  # disabled
merge_18 = Merge(Data1=flatten(parts_name_2), Data2=flatten(path_name_2))  # disabled
spindle_rpm_2 = Panel("18000")  # disabled
home_pt_2 = Panel("{0,0,45}")  # disabled
z_speed_mm_s_2 = Panel("25")  # disabled
panel_24 = Panel("_")  # disabled
join_11 = TextJoin(Text=merge_18, Join=panel_24)  # disabled
file_name_2 = Panel(join_11)  # disabled
sbp_file_maker_2 = SbpFileMaker(
    folder=folder_name_2,
    file=file_name_2,
    path=path_3,
    safez=safez_2,
    zorigin=zorigin_2,
    home_pt=home_pt_2,
    set_pt=set_pt_2,
    material_box=material_14,
    rpm=spindle_rpm_2,
    xy_speed=xy_speed_mm_s_2,
    z_speed=z_speed_mm_s_2,
    i=preview_4,
    save=save_3)  # -> info_2, sbp_file, table_base; disabled
info_2 = Panel(sbp_file_maker_2.info_2)  # disabled

merge_19 = Merge(Data1=flatten(粗削り_3), Data2=flatten(皿表面_2), Data3=flatten(外形カットパス_裏_4))  # disabled
explode_5 = Explode(Curve=topoly_3.Polyline, Recursive=True)  # -> Segments, flatten(Vertices); disabled
explode_6 = Explode(Curve=weave_3, Recursive=True)  # -> Segments, flatten(Vertices); disabled
pline_5 = PolyLine(Vertices=explode_5.Vertices, Closed=False)  # disabled
中央部掘り込みパス_2 = Geometry(中央部掘り込みパス)  # disabled
外形カットパス_表_4 = Geometry()  # disabled
表面仕上げパス_3 = Geometry(表面仕上げパス_2)  # disabled
pline_6 = PolyLine(Vertices=explode_6.Vertices, Closed=False)  # disabled
粗削り_4 = Geometry(粗削り_2)  # disabled
花びら_2 = Geometry(花びら)  # disabled
面出しパス = Geometry(pline_5)  # disabled
面出しパス_2 = Geometry(面出しパス)  # disabled
幅そろえパス = Geometry(pline_6)  # disabled
幅そろえパス_2 = Geometry(幅そろえパス)  # disabled
merge_20 = Merge(
    Data1=flatten(粗削り_4),
    Data2=flatten(表面仕上げパス_3),
    Data3=flatten(花びら_2),
    Data4=flatten(中央部掘り込みパス_2),
    Data5=flatten(外形カットパス_表_4),
    Data6=flatten(幅そろえパス_2),
    Data7=flatten(面出しパス_2))  # disabled
# tab残し
trim_6 = TrimWithBreps(Curve=merge_19, Brep=tab)  # -> Inside, Outside; disabled
panel_25 = Panel("0.05")  # disabled
topoly_4 = CurveToPolyline(Curve=merge_20, ToleranceDistance=0, ToleranceAngle=panel_25)  # -> Polyline, Segments; disabled
geo_16 = Geometry(trim_6.Outside)  # disabled
geo_17 = Geometry(flatten(geo_16))  # disabled
加工パス_表 = Geometry(topoly_4.Polyline)  # disabled
material_15 = Geometry(material_6)  # disabled
panel_26 = Panel("0.05")  # disabled
topoly_5 = CurveToPolyline(Curve=geo_17, ToleranceDistance=0, ToleranceAngle=panel_26)  # -> Polyline, Segments; disabled
加工パス_裏 = Geometry(topoly_5.Polyline)  # disabled
material_16 = Geometry(material_3)  # disabled
number_slider_5 = Slider(2, range=0..10)  # disabled
pt_11 = Point([<point referenced from the Rhino model> x6])  # disabled
加工パス_裏_2 = Geometry(加工パス_裏)  # disabled
加工パス_表_2 = Geometry(topoly_4.Polyline)  # disabled
series_16 = Series(Start=0, Step=1, Count=number_slider_5)  # disabled
material_17 = Geometry(material_15)  # disabled
jig_t_2 = Data(jig_t)  # disabled
材料h_5 = Data(材料h_2)  # disabled
jig_crv_2 = Geometry(jig_crv)  # disabled
# 加工パス　セット
item_22 = ListItem(List=pt_11, Index=series_16, Wrap=True)  # disabled
debox_5 = DeconstructBox(Box=material_17)  # -> Plane, X, Y, Z; disabled
dedomain_7 = DeconstructDomain(Domain=debox_5.X)  # -> Start, End; disabled
dedomain_8 = DeconstructDomain(Domain=debox_5.Y)  # -> Start, End; disabled
dedomain_9 = DeconstructDomain(Domain=debox_5.Z)  # -> Start, End; disabled
pt_12 = ConstructPoint(XCoordinate=dedomain_7.Start, YCoordinate=dedomain_8.Start, ZCoordinate=dedomain_9.Start)  # disabled
addition_10 = Addition(A=jig_t_2, B=材料h_5)  # disabled
vec2pt_5 = Vector2Pt(PointA=pt_12, PointB=item_22, Unitize=False)  # -> Vector, Length; disabled
Z_26 = UnitZ(Factor=jig_t_2)  # disabled
boxrec_3 = BoxRectangle(Rectangle=jig_crv_2, Height=addition_10)  # disabled
boxrec_4 = BoxRectangle(Rectangle=jig_crv_2, Height=jig_t_2)  # disabled
addition_11 = Addition(A=vec2pt_5.Vector, B=Z_26)  # disabled
move_36 = Move(Geometry=加工パス_表_2, Motion=graft(addition_11))  # -> flatten(Geometry), Transform; disabled
move_37 = Move(Geometry=加工パス_裏_2, Motion=graft(addition_11))  # -> flatten(Geometry), Transform; disabled
jig_2 = Box(boxrec_3)  # disabled
move_38 = Move(Geometry=material_17, Motion=graft(addition_11))  # -> flatten(Geometry), Transform; disabled
clean = CleanTree(RemoveNulls=True, RemoveInvalid=True, RemoveEmpty=False, Tree=move_37.Geometry)  # disabled
加工パス_表_3 = Geometry(move_36.Geometry)  # disabled
material_18 = Geometry(move_38.Geometry)  # disabled
save_4 = Button()  # disabled

# ----
# 表preview
swatch_2 = ColourSwatch(SwatchColor=RGBA(163, 131, 83, 102))  # disabled
swatch_3 = ColourSwatch(SwatchColor=RGB(255, 0, 83))  # disabled
swatch_4 = ColourSwatch(SwatchColor=RGBA(163, 131, 83, 102))  # disabled
material_19 = Geometry(material_18)  # disabled
jig_3 = Geometry(boxrec_4)  # disabled
path_4 = Geometry(加工パス_表_3)  # disabled
preview_5 = CustomPreview(Geometry=material_19, Material=swatch_2)  # disabled
preview_6 = CustomPreview(Geometry=path_4, Material=swatch_3)  # disabled
preview_7 = CustomPreview(Geometry=jig_3, Material=swatch_4)  # disabled
toggle_4 = GroupToggle(ToggleActive=True, ToggleVisible=False)  # disabled

panel_27 = Panel(".")  # disabled
panel_28 = Panel("_")  # disabled

# ----
# 裏preview
swatch_5 = ColourSwatch(SwatchColor=RGBA(163, 131, 83, 102))  # disabled
swatch_6 = ColourSwatch(SwatchColor=RGB(255, 0, 83))  # disabled
swatch_7 = ColourSwatch(SwatchColor=RGBA(163, 131, 83, 102))  # disabled
material_20 = Geometry(material_18)  # disabled
jig_4 = Geometry(boxrec_4)  # disabled
path_5 = Geometry(clean)  # disabled
preview_8 = CustomPreview(Geometry=material_20, Material=swatch_5)  # disabled
preview_9 = CustomPreview(Geometry=path_5, Material=swatch_6)  # disabled
preview_10 = CustomPreview(Geometry=jig_4, Material=swatch_7)  # disabled
toggle_5 = GroupToggle(ToggleActive=True, ToggleVisible=False)  # disabled

folder_name_3 = Panel("H:\マイドライブ\プロジェクト\おはなのこざら\FD\")  # disabled

# ----
# READ
# SAVE
date = Panel("240609")
update_param = Trigger(Interval=-1000, TimerInterval=1000, Target=selobj)
save_5 = Button()
set_data = Button()
list_9 = ItemSelector(
    tsort.Keys,
    {"01_suisen_240310.csv", "01_suisen_240322.csv", "01_suisen_240812.csv", "02_ume_240228.csv", "02_ume_240302.csv", "02_ume_240330.csv", "02_ume_240629.csv", "03_tampopo_240302.csv", "03_tampopo_240322.csv", "03_tampopo_240426.csv"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}, selected="09_cosmos_240322.csv")
update_file = Trigger(Interval=-1000, TimerInterval=1000, Target=path)

panel_29 = Panel(list_9)
search_text = SearchText(relay_2=directory, relay=panel_29)  # -> match_text_2, index_2
file = ReadFile(File=search_text.match_text_2, PerLineParse=True)
csv_2 = ReadCSV(CSVString=file, Delimiter=",", DataStruct=False)  # -> Headers, flatten(Values)
format = Format(Format="{0}_{1}", Culture=127, Data0=panel_3, Data1=date)

filename = ItemSelector(
    format,
    {"01_suisen_240609", "02_ume_240609", "03_tampopo_240609", "04_sakura_240609", "05_magaret_240609", "06_azisai_240609", "07_nichi_240609", "08_himawari_240609", "09_cosmos_240609", "10_kinmoku_240609", "11_rindo_240609", "12_tubaki_240609"}, selected="05_magaret_240609")

panel_30 = Panel(format)
data_12 = Data(graft(csv_2.Headers))
panel_31 = Panel(filename)
search_text_2 = SearchText(relay_2=param_info_2.NickName, relay=data_12)  # -> match_text_2, index_2
filter_11 = StreamFilter(Gate=set_data, Stream1=csv_2.Values)
item_23 = ListItem(List=selobj.ParamObjects, Index=search_text_2.index_2, Wrap=True)  # -> flatten(Item)
format_2 = Format(Format="{0}.csv", Culture=127, Data0=panel_31)
f_str2file = SaveStringToFile(S=csv, dir=panel, file=format_2, save=save_5)  # -> info; inputs S: list of String, dir: String, file: String, save: Boolean; same code as f_str2file
set_slider = SetSliderProperties(Slider=item_23, Value=filter_11)
cache = ContentCache(Name=panel_31, Content=[object, object_2], Action=Toggle(True))  # -> Name, Content, Result
parts_name_3 = Panel(list_9)  # disabled
split_3 = TextSplit(Text=parts_name_3, Separators=panel_27)  # disabled
item_24 = ListItem(List=split_3, Index=0, Wrap=True)  # disabled
concat = Concatenate(FragmentA=item_24, FragmentB=panel_28, FragmentC=number_slider_5)  # disabled

# ----
# Folder
# Filne name
parts_name_4 = Panel(concat)  # disabled
material_21 = Box(jig_2)  # disabled
zorigin_3 = ValueList({"Table Surface", "Material Surface"}, selected="Table Surface")  # disabled
path_6 = Geometry(flatten(加工パス_表_3))  # disabled
preview_11 = ControlKnob(Decimals=0, Limit=False, Maximum=60, Minimum=0, Range=60, Value=-1)  # disabled
path_name_3 = Panel("omote.sbp")  # disabled
save_6 = Data(save_4)  # disabled
set_pt_3 = Panel("{50,50,0}")  # disabled
safez_3 = Panel("36")  # disabled
xy_speed_mm_s_3 = Panel("90")  # disabled
merge_21 = Merge(Data1=flatten(parts_name_4), Data2=flatten(path_name_3))  # disabled
home_pt_3 = Panel("{800,0,50}")  # disabled
spindle_rpm_3 = Panel("18000")  # disabled
z_speed_mm_s_3 = Panel("80")  # disabled
panel_32 = Panel("_")  # disabled
join_12 = TextJoin(Text=merge_21, Join=panel_32)  # disabled
folder_name_4 = Panel("D:\FD\")  # disabled
file_name_3 = Panel(join_12)  # disabled
sbp_file_maker_3 = SbpFileMaker(
    folder=folder_name_4,
    file=file_name_3,
    path=path_6,
    safez=safez_3,
    zorigin=zorigin_3,
    home_pt=home_pt_3,
    set_pt=set_pt_3,
    material_box=material_21,
    rpm=spindle_rpm_3,
    xy_speed=xy_speed_mm_s_3,
    z_speed=z_speed_mm_s_3,
    i=preview_11,
    save=save_6)  # -> info_2, sbp_file, table_base; disabled
info_3 = Panel(sbp_file_maker_3.info_2)  # disabled

# ----
# Folder
# Filne name
parts_name_5 = Panel(parts_name_4)  # disabled
material_22 = Box(jig_2)  # disabled
zorigin_4 = ValueList({"Table Surface", "Material Surface"}, selected="Table Surface")  # disabled
path_7 = Geometry(flatten(clean))  # disabled
preview_12 = ControlKnob(Decimals=0, Limit=False, Maximum=60, Minimum=0, Range=60, Value=46)  # disabled
path_name_4 = Panel("ura.sbp")  # disabled
save_7 = Data(save_4)  # disabled
set_pt_4 = Panel(set_pt_3)  # disabled
xy_speed_mm_s_4 = Panel(xy_speed_mm_s_3)  # disabled
safez_4 = Panel(safez_3)  # disabled
merge_22 = Merge(Data1=flatten(parts_name_5), Data2=flatten(path_name_4))  # disabled
z_speed_mm_s_4 = Panel("80")  # disabled
home_pt_4 = Panel(home_pt_3)  # disabled
spindle_rpm_4 = Panel("18000")  # disabled
panel_33 = Panel("_")  # disabled
join_13 = TextJoin(Text=merge_22, Join=panel_33)  # disabled
folder_name_5 = Panel(folder_name_4)  # disabled
file_name_4 = Panel(join_13)  # disabled
sbp_file_maker_4 = SbpFileMaker(
    folder=folder_name_5,
    file=file_name_4,
    path=path_7,
    safez=safez_4,
    zorigin=zorigin_4,
    home_pt=home_pt_4,
    set_pt=set_pt_4,
    material_box=material_22,
    rpm=spindle_rpm_4,
    xy_speed=xy_speed_mm_s_4,
    z_speed=z_speed_mm_s_4,
    i=preview_12,
    save=save_7)  # -> info_2, sbp_file, table_base; disabled
info_4 = Panel(sbp_file_maker_4.info_2)  # disabled

list_10 = ValueList({"AngularDimension", "Arc", "Block", "Brep", "Circle", "Curve", "Dimension", "Ellipse", "Extrusion", "Hatch", "Leader", "Line", "LinearDimension", "Mesh", "Point", "Polyline", "Polysurface", "RadialDimension", "Surface", "Text", "TextDot"}, selected="Point")  # disabled
加工パス_6 = Geometry(加工パス_3)  # disabled
list_11 = ValueList({"AngularDimension", "Arc", "Block", "Brep", "Circle", "Curve", "Dimension", "Ellipse", "Extrusion", "Hatch", "Leader", "Line", "LinearDimension", "Mesh", "Point", "Polyline", "Polysurface", "RadialDimension", "Surface", "Text", "TextDot"}, selected="Curve")  # disabled
filtertype_6 = FilterByType(ObjectType=list_11, Geometry=加工パス_6, invertFilter=False, returnNulls=False)  # -> ExcludedGeometry, IncludedGeometry; disabled
filtertype_7 = FilterByType(ObjectType=list_10, Geometry=加工パス_6, invertFilter=False, returnNulls=False)  # -> ExcludedGeometry, IncludedGeometry; disabled
swatch_8 = ColourSwatch(SwatchColor=RGB(253, 0, 88))  # disabled
panel_34 = Panel("1.5")  # disabled
panel_35 = Panel("2")  # disabled
sph_5 = Sphere(Base=filtertype_7.IncludedGeometry, Radius=panel_35)  # disabled
toggle_6 = GroupToggle(ToggleActive=True, ToggleVisible=False)  # disabled

ext_5 = ExtendCurve(Curve=filtertype_6.IncludedGeometry, Type=0, Start=neg, End="0")

pipe_3 = Pipe(Curve=ext_5, Radius=panel_34, Caps=2)  # disabled
preview_13 = CustomPreview(Geometry=[pipe_3, sph_5], Material=swatch_8)  # disabled

加工ボリューム_5 = Geometry(加工ボリューム_4)
皿外形_4 = Geometry(top_srf)
dam = DataDam(DataB=皿外形_4, DataA=加工ボリューム_5, BufferDelay=10000000, BufferMode=0)  # -> DataB, DataA
preview_14 = CustomPreview(Geometry=[皿外形_4, 加工ボリューム_5], Material=ColourSwatch(SwatchColor=RGB(166, 127, 88)))
toggle_7 = GroupToggle(ToggleActive=True, ToggleVisible=False)  # disabled

sdiff = SolidDifference(BrepsA=dam.DataB, BrepsB=dam.DataA)  # disabled

皿形状 = Geometry(sdiff)

# ----
# 合板あて木で50オフセット治具
panel_36 = Panel("{500,-3000,0}")  # disabled
toggle_8 = GroupToggle(ToggleActive=True, ToggleVisible=False)  # disabled
endmill_d_4 = DigitScroller(Scroller_Digits=12, Scroller_Prefix="Endmill D", Scroller_Radix=9, Scroller_Value=6.35)  # disabled
endmill_d_5 = DigitScroller(Scroller_Digits=12, Scroller_Prefix="Endmill D", Scroller_Radix=9, Scroller_Value=6.35)  # disabled
panel_37 = Panel("{45,50,0}")  # disabled
panel_38 = Panel("{45,50,0}")  # disabled
panel_39 = Panel("1850")  # disabled
panel_40 = Panel("950")  # disabled
addition_12 = Addition(A=panel_36, B=panel_37)  # disabled
addition_13 = Addition(A=panel_36, B=panel_38)  # disabled
X_9 = UnitX(Factor=1)  # disabled
Y_3 = UnitY(Factor=1)  # disabled
line_6 = LineSDL(Start=addition_12, Direction=X_9, Length=panel_39)  # disabled
line_7 = LineSDL(Start=addition_13, Direction=Y_3, Length=panel_40)  # disabled
expression_24 = Expression(x=endmill_d_4, Expression="x/2")  # disabled
expression_25 = Expression(x=endmill_d_5, Expression="x/2")  # disabled
X_10 = UnitX(Factor=expression_25)  # disabled
Y_4 = UnitY(Factor=expression_24)  # disabled
move_39 = Move(Geometry=line_6, Motion=Y_4)  # -> Geometry, Transform; disabled
move_40 = Move(Geometry=line_7, Motion=X_10)  # -> Geometry, Transform; disabled
merge_23 = Merge(Data1=move_39.Geometry, Data2=move_40.Geometry)  # disabled
cut_depth_offset_2 = DigitScroller(Scroller_Digits=12, Scroller_Prefix="Cut Depth Offset", Scroller_Radix=9, Scroller_Value=0.2)  # disabled
save_8 = Button()  # disabled

# ----
# Plywood
tickness_2 = ValueList({"3", "6", "9", "12", "15", "18", "21", "24", "30", "36"}, selected="12")  # disabled
size = ValueList({"3*6": 0, "4*8": 1}, selected="3*6")  # disabled
pt_13 = Point(panel_36)  # disabled
plywood = Plywood(i=size, H=tickness_2, pt=pt_13)  # disabled
material_23 = Geometry(plywood)  # disabled

addition_14 = Addition(A=tickness_2, B=cut_depth_offset_2)  # disabled

# ----
# Cut
start_depth_4 = DigitScroller(Scroller_Digits=12, Scroller_Prefix="Start Depth", Scroller_Radix=9, Scroller_Value=0)  # disabled
endmill_d_6 = DigitScroller(Scroller_Digits=12, Scroller_Prefix="Endmill D", Scroller_Radix=9, Scroller_Value=6.35)  # disabled
z_step_mm_4 = DigitScroller(Scroller_Digits=12, Scroller_Prefix="Z_Step(mm)", Scroller_Radix=9, Scroller_Value=5)  # disabled
tab_d_2 = DigitScroller(Scroller_Digits=12, Scroller_Prefix="Tab_D", Scroller_Radix=9, Scroller_Value=6)  # disabled
tab_l_2 = DigitScroller(Scroller_Digits=12, Scroller_Prefix="Tab_L", Scroller_Radix=9, Scroller_Value=9)  # disabled
list_12 = ValueList({"Outside": 0, "Center": 1, "Inside": 2}, selected="Center")  # disabled
fillet_block_4 = ExtendedGeometry()  # disabled
crv_4 = Geometry(merge_23)  # disabled
material_24 = Geometry(material_23)  # disabled
tab_pt_2 = Point([<point referenced from the Rhino model> x4])  # disabled
cut_path_230206_2 = CutPath_230206(
    cut_line=crv_4,
    material=material_24,
    start_depth=start_depth_4,
    cut_depth=addition_14,
    z_path=z_step_mm_4,
    endmill_d=endmill_d_6,
    tab_pt=tab_pt_2,
    tab_l=tab_l_2,
    tab_d=tab_d_2,
    offset=list_12,
    fillet=fillet_block_4)  # disabled
cut_path_2 = Geometry(cut_path_230206_2)  # disabled

# ----
# Folder
# Filne name
zorigin_5 = ValueList({"Table Surface", "Material Surface"}, selected="Table Surface")  # disabled
preview_15 = ControlKnob(Decimals=0, Limit=False, Maximum=60, Minimum=0, Range=60, Value=0)  # disabled
parts_name_6 = Panel("50offset_X")  # disabled
path_name_5 = Panel(".sbp")  # disabled
save_9 = Data(save_8)  # disabled
path_8 = Geometry(flatten(cut_path_2))  # disabled
material_25 = Box(material_23)  # disabled
set_pt_5 = Panel("{0,0,0}")  # disabled
xy_speed_mm_s_5 = Panel("70")  # disabled
safez_5 = Panel("30")  # disabled
merge_24 = Merge(Data1=flatten(parts_name_6), Data2=flatten(path_name_5))  # disabled
home_pt_5 = Panel("{1200,0,45}")  # disabled
spindle_rpm_5 = Panel("18000")  # disabled
z_speed_mm_s_5 = Panel("25")  # disabled
panel_41 = Panel("_")  # disabled
join_14 = TextJoin(Text=merge_24, Join=panel_41)  # disabled
folder_name_6 = Panel("D:\FD\")  # disabled
file_name_5 = Panel(join_14)  # disabled
sbp_file_maker_5 = SbpFileMaker(
    folder=folder_name_6,
    file=file_name_5,
    path=path_8,
    safez=safez_5,
    zorigin=zorigin_5,
    home_pt=home_pt_5,
    set_pt=set_pt_5,
    material_box=material_25,
    rpm=spindle_rpm_5,
    xy_speed=xy_speed_mm_s_5,
    z_speed=z_speed_mm_s_5,
    i=preview_15,
    save=save_9)  # -> info_2, sbp_file, table_base; disabled
info_5 = Panel(sbp_file_maker_5.info_2)  # disabled

# ==== cluster SbpFileMaker
save = ClusterInput()
xy_speed = ClusterInput()
z_speed = ClusterInput()
i = ClusterInput()
material_box = ClusterInput()
home_pt = ClusterInput()
set_pt = ClusterInput()
rpm = ClusterInput()
zorigin = ClusterInput()
safez = ClusterInput()
folder = ClusterInput()
file = ClusterInput()
path = ClusterInput()
set_pt_2 = Geometry(set_pt)
bbox = BoundingBox(Content=material_box, Plane=PlaneXY(0, 0, 0))  # -> Box, Box_2
set_preview = SetPreview(relay_3=path, relay=material_box, set_to=set_pt, relay_2=i)  # -> G, M, data_2; disabled
material = Geometry(bbox.Box)

# ----
# Preview Path
panel = Panel("0.5")
geo = Geometry(path)
lng = ListLength(List=geo)
i_2 = Data(i)
dom = ConstructDomain(DomainStart="0.1", DomainEnd=panel)
end = EndPoints(Curve=geo)  # -> Start, End
series = Series(Start=0, Step=1, Count=lng)
bnd = Bounds(Numbers=series)
remap = RemapNumbers(Value=series, Source=bnd, Target=dom)  # -> Mapped, Clipped
toggle = GroupToggle(ToggleActive=True, ToggleVisible=False)  # disabled
hsl = ColourHSL(Alpha=1, Hue=remap.Mapped, Saturation=1, Luminance=0.5)
item = ListItem(List=geo, Index=i_2, Wrap=False)
swatch = ColourSwatch(SwatchColor=RGB(255, 59, 59))
end_2 = EndPoints(Curve=item)  # -> Start, End
preview = CustomPreview(Geometry=geo, Material=hsl)
tag = TextTag3D(Location=end.Start, Text=series, Size=Slider(3, range=0..10), Colour=hsl, Justification=5)
sph = Sphere(Base=end_2.Start, Radius=Slider(2, range=0..10))
previewlw = CustomPreviewLineweights(Geometry=item, Shader=swatch, Thickness=Slider(5, range=0..10), Absolute=False)
preview_2 = CustomPreview(Geometry=sph, Material=swatch)

# ----
# Set
bbox_2 = BoundingBox(Content=material_box, Plane=PlaneXY(0, 0, 0))  # -> Box, Box_2
debox = DeconstructBox(Box=bbox_2.Box)  # -> Plane, X, Y, Z
dedomain = DeconstructDomain(Domain=debox.X)  # -> Start, End
dedomain_2 = DeconstructDomain(Domain=debox.Y)  # -> Start, End
dedomain_3 = DeconstructDomain(Domain=debox.Z)  # -> Start, End
subtraction = Subtraction(A=dedomain.End, B=dedomain.Start)
subtraction_2 = Subtraction(A=dedomain_2.End, B=dedomain_2.Start)
subtraction_3 = Subtraction(A=dedomain_3.End, B=dedomain_3.Start)
pt = ConstructPoint(XCoordinate=dedomain.Start, YCoordinate=dedomain_2.Start, ZCoordinate=dedomain_3.Start)
deplane = DeconstructPlane(Plane=debox.Plane)  # -> Origin, XAxis, YAxis, ZAxis
material_x = Panel(subtraction)
material_y = Panel(subtraction_2)
material_z = Panel(subtraction_3)
addition = Addition(A=deplane.Origin, B=pt)
move2pt = MoveToPoint(Geometry=material_box, PointA=addition, PointB=set_pt)  # -> Moved, Vector, Transform
move = Move(Geometry=path, Motion=move2pt.Vector)  # -> Geometry, Transform

base_pt = Point(addition)
set_pt_3 = Geometry(base_pt)
swatch_2 = ColourSwatch(SwatchColor=RGB(147, 250, 246))
subtraction_4 = Subtraction(A=base_pt, B=set_pt_2)
sbp_file_maker_ver1_0_0 = GhPythonScript(
    L=move.Geometry,
    SafeZ=safez,
    Zorigin=zorigin,
    Home=home_pt,
    Material=move2pt.Moved,
    SpindleRPM=rpm,
    xy_Speed=xy_speed,
    z_Speed=z_speed)  # -> SBP_file, Time; inputs L: list of Polyline, Home: Point3d, Material: Box
# ---------- sbp_file_maker_ver1_0_0: Python ----------
__author__ = "tos.nishimura"
__version__ = "2022.10.24"


import rhinoscriptsyntax as rs
import Rhino
import scriptcontext
import System.Collections.Generic as SCG
import clr
clr.AddReference("Grasshopper")
from Grasshopper.Kernel.Data import GH_Path
from Grasshopper import DataTree
import math as m
import datetime

P = []
Pline = []
Path = []
SBP_file = []
massage = []
T = []


HomeX = Home[0]
HomeY = Home[1]
HomeZ = Home[2]
MSX = Material.X[0] #Material Set X
MSY = Material.Y[0] #Material Set Y
MSZ = Material.Z[0] #Material Set Z
MLX = Material.X[1] - MSX #Length of material in X
MLY = Material.Y[1] - MSY #Length of material in Y
MDZ = Material.Z[1] - MSZ #Depth of material in Z

if MDZ > SafeZ:
    rs.MessageBox("SafeZ is smaller than Material Depth! \nChange SafeZ Value", buttons=0)
    
xtemp = 0
ytemp = 0
ztemp = 0



"""------------------Setting-----------------------------------------------------"""
text="""

'----------------------------------------------------------------
'SHOPBOT ROUTER FILE IN MM
'GENERATED BY PARTWorks"""
SBP_file.Add(text)
SBP_file.Add("'Length of material in X = " + format(MLX,'.3f'))
SBP_file.Add("'Length of material in Y = " + format(MLY,'.3f'))
SBP_file.Add("'Depth of material in Z = " + format(MDZ,'.3f'))

SBP_file.Add("'Home Position Information = Bottom Left Corner, " +  Zorigin)
SBP_file.Add("'Home X = " + format(HomeX,'.3f') + " Home Y = " + format(HomeY,'.3f') + " Home Z = " + format(HomeZ,'.3f'))
SBP_file.Add("'Rapid clearance gap or Safe Z = " + format(SafeZ,'.3f'))
SBP_file.Add("'UNITS:MM")
SBP_file.Add("""'
IF %(25)=0 THEN GOTO UNIT_ERROR	'check to see software is set to standard
SA                             	'Set program to absolute coordinate mode
CN, 90
""")

SBP_file.Add("&PWSafeZ = " + format(SafeZ,'.3f') )
SBP_file.Add("&PWZorigin = " + Zorigin )
SBP_file.Add("&PWMatrial = " + format(MDZ,'.3f'))
SBP_file.Add("TR," + format(SpindleRPM,'.3f'))
SBP_file.Add("C6")
SBP_file.Add("PAUSE 2\n'")

SBP_file.Add("MS," + format(xy_Speed,'.1f') + ", " + format(z_Speed,'.1f'))
SBP_file.Add("JZ,"+ format(HomeZ,'.6f'))
SBP_file.Add("J2,"+ format(HomeX,'.6f') + ", " + format(HomeY,'.6f'))

"""-------------------SBP_file.Add(J3,M3)-------------------------------------------"""
T.Add(15)

for i in range(len(L)):
    P.Add([])
    for j in range(len(L[i])):
        P[i].Add(L[i][j])
        
    X = []
    Y = []
    Z = []
    for j in range(len(P[i])):
        X.Add(P[i][j][0])
        Y.Add(P[i][j][1])
        Z.Add(P[i][j][2])
    SBP_file.Add('J3, ' + format(X[0],'.6f')
        + ', ' + format(Y[0],'.6f')
        + ', ' + format(SafeZ,'.6f'))
    for j in range(len(P[i])):
        SBP_file.Add('M3, ' + format(X[j],'.6f')
        + ', ' + format(Y[j],'.6f')
        + ', ' + format(Z[j],'.6f'))
        if j > 1:
            dx2 = (X[j]-X[j-1])*(X[j]-X[j-1])
            dy2 = (Y[j]-Y[j-1])*(Y[j]-Y[j-1])
            dz2 = (Z[j]-Z[j-1])*(Z[j]-Z[j-1])
            T.Add(m.sqrt(dx2 + dy2 + dz2)/xy_Speed)
        else: 
            dx2 = (X[j]-xtemp)*(X[j]-xtemp)
            dy2 = (Y[j]-ytemp)*(Y[j]-ytemp)
            dz2 = (Z[j]-ztemp)*(Z[j]-ztemp)
            T.Add(m.sqrt(dx2 + dy2 + dz2)/xy_Speed)
        
        xtemp = X[j]
        ytemp = Y[j]
        Ztemp = Z[j]
    SBP_file.Add('J3, ' + format(X[len(P[i])-1],'.6f')
        + ', ' + format(Y[len(P[i])-1],'.6f')
        + ', ' + format(SafeZ,'.6f'))
    T.Add(2)
    
SBP_file.Add("JZ,"+ format(HomeZ,'.6f'))
SBP_file.Add("J2,"+ format(HomeX,'.6f') + ", " + format(HomeY,'.6f'))
T.Add(10)

SBP_file.Add("""'
'
'Turning router OFF
C7
END
'
'
UNIT_ERROR:
CN, 91                            'Run file explaining unit error
END



""")
sec = sum(T)
sec = int(sec)
Time = datetime.timedelta(seconds = sec)
print(Time)
# ---------- end sbp_file_maker_ver1_0_0 ----------
debox_2 = DeconstructBox(Box=material)  # -> Plane, X, Y, Z
panel_2 = Panel(set_pt_2)
number_slider = Slider(20, range=0..100)
dedomain_4 = DeconstructDomain(Domain=debox_2.X)  # -> Start, End

# ----
# Table
panel_3 = Panel("2440")
rectangle = Rectangle(Plane=PlaneXY(0, 0, 0), XSize=panel_3, YSize="1220", Radius=0)  # -> Rectangle, Length
boxrec = BoxRectangle(Rectangle=rectangle.Rectangle, Height="-60")
inverse = InverseTransform(Transform=move2pt.Transform)
xy = XYPlane(Origin=Point(0, 0, 0))
transform = Transform(Geometry=boxrec, Transform=inverse)
transform_2 = Transform(Geometry=xy, Transform=inverse)
preview_3 = CustomPreview(Geometry=transform, Material=ColourSwatch(SwatchColor=RGBA(51, 51, 51, 66)))
table_base = ClusterOutput(transform_2)

dedomain_5 = DeconstructDomain(Domain=debox_2.Y)  # -> Start, End
dedomain_6 = DeconstructDomain(Domain=debox_2.Z)  # -> Start, End
subtraction_5 = Subtraction(A=dedomain_4.End, B=dedomain_4.Start)
subtraction_6 = Subtraction(A=dedomain_5.End, B=dedomain_5.Start)
subtraction_7 = Subtraction(A=dedomain_6.End, B=dedomain_6.Start)
concat = Concatenate(FragmentA="Set Pt         : ", FragmentB=panel_2)
swatch_3 = ColourSwatch(SwatchColor=RGB(102, 102, 102))
sph_2 = Sphere(Base=subtraction_4, Radius=Slider(5, range=0..10))
split = TextSplit(Text=file, Separators=".")
sph_3 = Sphere(Base=set_pt_3, Radius=Slider(5, range=0..10))
merge = Merge(Data1=subtraction_5, Data2=subtraction_6, Data3=subtraction_7)
concat_2 = Concatenate(FragmentA="Estimated Time : ", FragmentB=sbp_file_maker_ver1_0_0.Time)  # -> flatten(Result)
item_2 = ListItem(List=split, Index=0, Wrap=True)
preview_4 = CustomPreview(Geometry=sph_2, Material=swatch_3)
roundf = RoundToFactor(NumberX=merge, Factor="0.1", RoundType=0)  # -> Rounded, Difference, MultiplierR, MultiplierX
tag_2 = TextTag3D(Location=subtraction_4, Text="Table   { 0, 0, 0}", Size=number_slider, Colour=swatch_3, Justification=2)
preview_5 = CustomPreview(Geometry=sph_3, Material=swatch_2)
tag_3 = TextTag3D(Location=set_pt_3, Text=concat, Size=number_slider, Colour=swatch_2, Justification=2)
concat_3 = Concatenate(FragmentA="FileName       : ", FragmentB=file)  # -> flatten(Result)
concat_4 = Concatenate(FragmentA=item_2, FragmentB="_info.txt")
item_3 = ListItem(List=roundf.Rounded, Index=0, Wrap=True)  # -> Item, Item1, Item2
pt_2 = ConstructPoint(XCoordinate=item_3.Item, YCoordinate=item_3.Item1, ZCoordinate=item_3.Item2)
panel_4 = Panel(pt_2)
deplane_2 = DeconstructPlane(Plane=debox_2.Plane)  # -> Origin, XAxis, YAxis, ZAxis
pt_3 = ConstructPoint(XCoordinate=dedomain_4.End, YCoordinate=dedomain_5.End, ZCoordinate=dedomain_6.End)
concat_5 = Concatenate(FragmentA="Material Size  : ", FragmentB=panel_4)
join = TextJoin(Text=sbp_file_maker_ver1_0_0.SBP_file)
f_str2file = SaveStringToFile(S=sbp_file_maker_ver1_0_0.SBP_file, dir=folder, file=file, save=save)  # -> info; inputs S: list of String, dir: String, file: String, save: Boolean
# ---------- f_str2file: C# ----------
                           /*
    froGH - a sparse collection of (in)utilities for Grasshopper

    Save string to file

    code by Alessio Erioli

    froGH by Co-de-iT is licensed under a Creative Commons Attribution 4.0 International License.
    http://creativecommons.org/licenses/by/4.0/

    */

    initComp();



    if (save){
      if (!Directory.Exists(dir)) Directory.CreateDirectory(dir);

      String target = dir + file;

      System.IO.File.WriteAllLines(target, S.ToArray());
      info = "file saved as: " + target;
    } else {
      info = "press save button to save file";
    }
# ---------- f_str2file: C# additional code ----------
  void initComp(){
    Component.Name = "Save String to File";
    Component.NickName = "f_Str2File";
    Component.Description = "Saves a text sequence to a file";

    Component.Params.Input[0].Name = "String";
    Component.Params.Input[0].Description = "string to save (as List)";
    Component.Params.Input[1].Name = "directory";
    Component.Params.Input[1].Description = "directory where the string file is saved";
    Component.Params.Input[2].Name = "fileName";
    Component.Params.Input[2].Description = "file name and extension (ex: myText.txt)";
    Component.Params.Input[3].Name = "save";
    Component.Params.Input[3].Description = "activate saving - attach a button and click to save";
    Component.Params.Output[0].Name = "info";
    Component.Params.Output[0].Description = "information on the saving process";
  }
# ---------- end f_str2file ----------
addition_2 = Addition(A=deplane_2.Origin, B=pt_3)
preview_6 = CustomPreview(Geometry=material, Material=ColourSwatch(SwatchColor=RGBA(176, 136, 88, 58)))
panel_5 = Panel(lng)
tag_4 = TextTag3D(Location=addition_2, Text=concat_5, Size=number_slider, Colour=swatch_2, Justification=8)
sbp_file = ClusterOutput(sbp_file_maker_ver1_0_0.SBP_file)
panel_6 = Panel(concat)
concat_6 = Concatenate(FragmentA="Path Count     : ", FragmentB=panel_5)
panel_7 = Panel(concat_5)
panel_8 = Panel(concat_6)
merge_2 = Merge(Data1=panel_8, Data2=panel_7, Data3=panel_6)  # -> flatten(Result)
info = Panel(merge_2)
data = Data(info)
merge_3 = Merge(Data1=concat_3, Data2=data, Data3=concat_2)
f_str2file_2 = SaveStringToFile(S=merge_3, dir=folder, file=concat_4, save=save)  # -> info; inputs S: list of String, dir: String, file: String, save: Boolean; same code as f_str2file
info_2 = ClusterOutput(merge_3)

# ==== cluster SearchText
relay = ClusterInput()
relay_2 = ClusterInput()
len = TextLength(Text=relay_2)
tdist = TextDistance(TextA=relay_2, TextB=relay, Case=True)
len_2 = TextLength(Text=relay)
lng = ListLength(List=relay_2)
series = Series(Start=0, Step=1, Count=lng)
subtraction = Subtraction(A=len, B=tdist)
equals = Equality(FirstNumber=subtraction, SecondNumber=len_2)  # -> Equality, Inequality
dispatch = Dispatch(List=relay_2, DispatchPattern=equals.Equality)  # -> ListA, ListB
dispatch_2 = Dispatch(List=series, DispatchPattern=equals.Equality)  # -> ListA, ListB
match_text = Data(simplify(dispatch.ListA))
index = Data(simplify(dispatch_2.ListA))
index_2 = ClusterOutput(index)
match_text_2 = ClusterOutput(match_text)

# ==== cluster Pocket_230206
fillet = ClusterInput()
B = ClusterInput()
fillet_2 = Geometry(fillet)
debox = DeconstructBox(Box=B)  # -> Plane, X, Y, Z
crv = ClusterInput()
dedomain = DeconstructDomain(Domain=debox.X)  # -> Start, End
pocet_depth = ClusterInput()
start_depth = ClusterInput()
dedomain_2 = DeconstructDomain(Domain=debox.Y)  # -> Start, End
z_step_mm = ClusterInput()
xy_step = ClusterInput()
endmill_d = ClusterInput()
dedomain_3 = DeconstructDomain(Domain=debox.Z)  # -> Start, End
material_height = Number(debox.Z)
pocet_depth_2 = Number(pocet_depth)
crv_2 = Curve(simplify(graft(crv)))
start_depth_2 = Number(start_depth)
pt = ConstructPoint(XCoordinate=dedomain.Start, YCoordinate=dedomain_2.Start, ZCoordinate=dedomain_3.Start)
z_step_mm_2 = Number(z_step_mm)
xy_step_2 = Number(xy_step)
endmill_d_2 = Number(endmill_d)
image = ImageSampler(
    FilePath="C:\Users\offic\Downloads\ViewCapture20221107_144819.jpg",
    Filter="Value",
    Interpolate=True,
    Umax=1492,
    Umin=100,
    Vmax=931,
    Vmin=100,
    Wrap=0)
division = Division(A=xy_step_2, B="90")
integer_division = IntegerDivision(A=pocet_depth_2, B=z_step_mm_2)
subtraction = Subtraction(A=material_height, B=start_depth_2)
multiplication = Multiplication(A=endmill_d_2, B=division)
set_pt = Point(simplify(pt))
neg = Negative(Value=z_step_mm_2)
series = Series(Start=pocet_depth_2, Step=neg, Count=expr("x+1", integer_division))
planar = Planar(Curve=crv_2)  # -> Planar, Plane, Deviation
xy = XYPlane(Origin=set_pt)
item = ListItem(List=planar.Plane, Index=0, Wrap=True)
rev = ReverseList(List=series)
larger = LargerThan(FirstNumber=rev, SecondNumber="0")  # -> LargerThan, OrEqualTo
division_2 = Division(A=endmill_d_2, B="2")
dispatch = Dispatch(List=rev, DispatchPattern=larger.LargerThan)  # -> ListA, ListB
subtraction_2 = Subtraction(A=subtraction, B=dispatch.ListA)
polyoffset = PolylineOffset(Polylines=crv_2, Distance=division_2, Plane=item, Tolerance=0.001, ClosedFillet=2, OpenFillet=1, Miter=2)  # -> Contour, simplify(Holes)
series_2 = Series(Start=0, Step=multiplication, Count=Slider(100, range=0..100))
geo = Geometry(simplify(polyoffset.Holes))
polyoffset_2 = PolylineOffset(Polylines=geo, Distance=series_2, Plane=planar.Plane, Tolerance=0.001, ClosedFillet=2, OpenFillet=1, Miter=0)  # -> Contour, simplify(Holes)
clean = CleanTree(RemoveNulls=True, RemoveInvalid=True, RemoveEmpty=True, Tree=polyoffset_2.Holes)
tstat = TreeStatistics(Tree=clean)  # -> Paths, Length, Count
geo_2 = Geometry(simplify(flatten(geo)))
tstat_2 = TreeStatistics(Tree=geo)  # -> Paths, Length, Count
item_2 = ListItem(List=tstat.Paths, Index=0, Wrap=True)
lng = ListLength(List=tstat_2.Paths)
chars = Characters(Text=item_2)  # -> Result, Unicode
equals = Equality(FirstNumber=lng, SecondNumber="1")  # -> Equality, Inequality
lng_2 = ListLength(List=chars.Result)
filter = StreamFilter(Gate=equals.Equality, Stream0=geo, Stream1=geo_2)

# ----
# fillet
deblock = DeconstructBlock(Block=fillet_2)  # -> Name, Plane, flatten(Geometry)
list = ValueList({"base", "biss", "cut", "dim", "fillet", "layout", "line", "pocket", "sheet", "tab"}, selected="fillet")
item_3 = ListItem(List=fillet_2, Index=0, Wrap=True)
list_2 = ValueList({"Point": 0, "Curve": 1, "Arc": 2, "Circle": 3, "Ellipse": 4, "Line": 5, "Polyline": 6, "Surface": 7, "Brep": 8, "Mesh": 9, "Polysurface": 10, "Block": 11, "Text": 12, "TextDot": 13, "Dimension": 14, "LinearDimension": 15, "AngularDimension": 16, "Hatch": 17, "Leader": 18}, selected="Line")
filterlay = FilterByLayer(Geometry=deblock.Geometry, Layer=list)
null = NullItem(Item=item_3)  # -> NullFlags, InvalidFlags, Description
filtertype = FilterByType(Geometry=filterlay, ObjectType=list_2)
clean_2 = CleanTree(RemoveNulls=True, RemoveInvalid=True, RemoveEmpty=False, Tree=filtertype)
explode = Explode(Curve=filter, Recursive=True)  # -> Segments, Vertices
end = EndPoints(Curve=clean_2)  # -> Start, End
cp = ClosestPoint(Point=end.Start, Cloud=explode.Vertices)  # -> ClosestPoint, CPIndex, Distance
smaller = SmallerThan(FirstNumber=cp.Distance, SecondNumber="0.1")  # -> SmallerThan, OrEqualTo
dispatch_2 = Dispatch(List=cp.ClosestPoint, DispatchPattern=smaller.SmallerThan)  # -> ListA, ListB
dispatch_3 = Dispatch(List=end.End, DispatchPattern=smaller.SmallerThan)  # -> ListA, ListB
dispatch_4 = Dispatch(List=cp.CPIndex, DispatchPattern=smaller.SmallerThan)  # -> ListA, ListB
ins = InsertItems(List=explode.Vertices, Item=dispatch_3.ListA, Indices=dispatch_4.ListA, Wrap=True)
expression = Expression(x=dispatch_4.ListA, Expression="2*x")
ins_2 = InsertItems(List=ins, Item=dispatch_2.ListA, Indices=expression, Wrap=True)
pline = PolyLine(Vertices=ins_2, Closed=False)
match = MatchTree(Tree=pline, Guide=filter)
filter_2 = StreamFilter(Gate=null.NullFlags, Stream0=match, Stream1=filter)

expression_2 = Expression(x=lng_2, Expression="((x-2)+1)/2")
subtraction_3 = Subtraction(A=expression_2, B="1")
flatten = FlattenTree(Tree=clean, Path="{0}")
trim = TrimTree(Tree=clean, Depth=subtraction_3)
equals_2 = Equality(FirstNumber=subtraction_3, SecondNumber="0")  # -> Equality, Inequality
filter_3 = StreamFilter(Gate=equals_2.Equality, Stream0=trim, Stream1=flatten)
geo_3 = Geometry(filter_3)
# Pocket範囲外のoffset lineを削除
tstat_3 = TreeStatistics(Tree=filter)  # -> Paths, Length, Count
tstat_4 = TreeStatistics(Tree=geo_3)  # -> Paths, Length, Count
compare = PathCompare(Path=graft(tstat_3.Paths), Mask=tstat_4.Paths)
ma = MassAddition(Input=compare)  # -> flatten(Result), PartialResults
dispatch_5 = Dispatch(List=tstat_3.Paths, DispatchPattern=ma.Result)  # -> ListA, ListB
branch = TreeBranch(Tree=geo_3, Path=tstat_4.Paths, MaintainPaths=True)
branch_2 = TreeBranch(Tree=filter, Path=dispatch_5.ListB, MaintainPaths=True)
merge = Merge(Data1=branch_2, Data2=branch)
end_2 = EndPoints(Curve=merge)  # -> Start, End
incurves = PointInCurves(Point=end_2.Start, Curves=filter)  # -> Relationship, Index, Point
tstat_5 = TreeStatistics(Tree=filter_2)  # -> Paths, Length, Count
equals_3 = Equality(FirstNumber=incurves.Relationship, SecondNumber="2")  # -> Equality, Inequality
lng_3 = ListLength(List=tstat_5.Paths)
dispatch_6 = Dispatch(List=merge, DispatchPattern=equals_3.Equality)  # -> ListA, ListB
equals_4 = Equality(FirstNumber=lng_3, SecondNumber="1")  # -> Equality, Inequality
geo_4 = Geometry(dispatch_6.ListA)
match_2 = MatchTree(Tree=geo_4, Guide=filter_2)
filter_4 = StreamFilter(Gate=equals_4.Equality, Stream0=match_2, Stream1=flatten(geo_4))  # -> simplify(Stream)
merge_2 = Merge(Data1=filter_2, Data2=filter_4)
Z = UnitZ(Factor=subtraction_2)  # -> simplify(UnitVector)
panel = Panel(filter_2)
rev_2 = ReverseList(List=merge_2)
project = Project(Geometry=rev_2, Plane=xy)  # -> simplify(graft(Geometry)), Transform
move = Move(Geometry=project.Geometry, Motion=Z)  # -> simplify(Geometry), Transform
tstat_6 = TreeStatistics(Tree=move.Geometry)  # -> Paths, Length, Count
item_4 = ListItem(List=tstat_6.Paths, Index=0, Wrap=True)
chars_2 = Characters(Text=item_4)  # -> Result, Unicode
lng_4 = ListLength(List=chars_2.Result)
expression_3 = Expression(x=lng_4, Expression="((x-2)+1)/2")
subtraction_4 = Subtraction(A=expression_3, B="1")
subtraction_5 = Subtraction(A=expression_3, B="2")
trim_2 = TrimTree(Tree=move.Geometry, Depth=subtraction_5)
path_mapper = PathMapper(trim_2, source="{A;B}(i)", target="{A;i}(B)")
flip = FlipMatrix(Data=move.Geometry)
equals_5 = Equality(FirstNumber=subtraction_4, SecondNumber="0")  # -> Equality, Inequality
geo_5 = Geometry(flatten(path_mapper))
geo_6 = Geometry(flatten(flip))
gate = StreamGate(Gate=0)  # -> Target0, Target1
filter_5 = StreamFilter(Gate=equals_5.Equality, Stream0=geo_5, Stream1=geo_6)
clean_3 = CleanTree(RemoveNulls=True, RemoveInvalid=True, RemoveEmpty=True, Tree=filter_5)
T = ClusterOutput(clean_3)

# ==== cluster Plywood
pt = ClusterInput()
i = ClusterInput()
curve = Curve(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)
curve_2 = Curve(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)
merge = Merge(Data1=curve, Data2=curve_2)
item = ListItem(List=merge, Index=i, Wrap=True)
pt_2 = Point(pt)
H = ClusterInput()
null = NullItem(Item=pt_2)  # -> NullFlags, InvalidFlags, Description
boxrec = BoxRectangle(Rectangle=item, Height=H)
xy = XYPlane(Origin=Point(0, 0, 0))
move2pt = MoveToPoint(Geometry=boxrec, PointA=xy, PointB=pt_2)  # -> Moved, Vector, Transform
filter = StreamFilter(Gate=null.NullFlags, Stream0=move2pt.Moved, Stream1=boxrec)
s_0 = ClusterOutput(filter)

# ==== cluster CutPath_230206
material = ClusterInput()
tab_d = ClusterInput()
start_depth = ClusterInput()
cut_depth = ClusterInput()
z_path = ClusterInput()
cut_line = ClusterInput()
offset = ClusterInput()
fillet = ClusterInput()
tab_pt = ClusterInput()
tab_l = ClusterInput()
endmill_d = ClusterInput()
debox = DeconstructBox(Box=material)  # -> Plane, X, Y, Z
dedomain = DeconstructDomain(Domain=debox.X)  # -> Start, End
dedomain_2 = DeconstructDomain(Domain=debox.Y)  # -> Start, End
dedomain_3 = DeconstructDomain(Domain=debox.Z)  # -> Start, End
pt = ConstructPoint(XCoordinate=dedomain.Start, YCoordinate=dedomain_2.Start, ZCoordinate=dedomain_3.Start)
subtraction = Subtraction(A=dedomain_3.End, B=dedomain_3.Start)
xy = XYPlane(Origin=pt)

# ----
# Outside, Center, Inside
panel = Panel("2")
division = Division(A=endmill_d, B=panel)
neg = Negative(Value=division)
offcrv = OffsetCurve(Curve=cut_line, Plane=PlaneXY(0, 0, 0), Distance=division, BothSides=neg, Kinks=0, CapType=0)
end = EndPoints(Curve=offcrv)  # -> Start, End
incurve = PointInCurve(Point=end.Start, Curve=graft(cut_line))  # -> Relationship, Point
equals = Equality(FirstNumber=incurve.Relationship, SecondNumber="0")  # -> Equality, Inequality
equals_2 = Equality(FirstNumber=incurve.Relationship, SecondNumber="2")  # -> Equality, Inequality
dispatch = Dispatch(List=offcrv, DispatchPattern=equals.Equality)  # -> ListA, ListB
dispatch_2 = Dispatch(List=offcrv, DispatchPattern=equals_2.Equality)  # -> ListA, ListB
panel_2 = Panel(offset)
outside = Geometry(flatten(dispatch.ListA))
center = Geometry(flatten(cut_line))
inside = Geometry(flatten(dispatch_2.ListA))
filter = StreamFilter(Gate=panel_2, Stream0=outside, Stream1=center, Stream2=inside)
project = Project(Geometry=filter, Plane=xy)  # -> Geometry, Transform

material_height = Data(subtraction)
project_2 = Project(Geometry=fillet, Plane=xy)  # -> Geometry, Transform
neg_2 = Negative(Value=cut_depth)
subtraction_2 = Subtraction(A=material_height, B=start_depth)
multiplication = Multiplication(A=tab_d, B="2")
project_3 = Project(Geometry=tab_pt, Plane=xy)  # -> Geometry, Transform
division_2 = Division(A=tab_l, B="2")
division_3 = Division(A=endmill_d, B="2")
integer_division = IntegerDivision(A=cut_depth, B=z_path)
addition = Addition(A=division_2, B=division_3)
neg_3 = Negative(Value=multiplication)
Z = UnitZ(Factor=neg_3)
series = Series(Start=neg_2, Step=z_path, Count=expr("x+1", integer_division))
Z_2 = UnitZ(Factor=tab_d)
move = Move(Geometry=project_3.Geometry, Motion=Z_2)  # -> Geometry, Transform
cir = Circle(Plane=move.Geometry, Radius=addition)
extr = Extrude(Base=cir, Direction=Z)
rev = ReverseList(List=series)
capex = CapHolesEx(Brep=extr)  # -> Brep, Caps, Solid
addition_2 = Addition(A=subtraction_2, B=rev)
Z_3 = UnitZ(Factor=addition_2)
addition_3 = Addition(A=dedomain_3.Start, B=tab_d)

# ----
# fillet
list = ValueList({"base", "biss", "cut", "dim", "fillet", "layout", "line", "pocket", "sheet", "tab"}, selected="fillet")
deblock = DeconstructBlock(Block=project_2.Geometry)  # -> Name, Plane, Geometry
list_2 = ValueList({"Point": 0, "Curve": 1, "Arc": 2, "Circle": 3, "Ellipse": 4, "Line": 5, "Polyline": 6, "Surface": 7, "Brep": 8, "Mesh": 9, "Polysurface": 10, "Block": 11, "Text": 12, "TextDot": 13, "Dimension": 14, "LinearDimension": 15, "AngularDimension": 16, "Hatch": 17, "Leader": 18}, selected="Line")
item = ListItem(List=project_2.Geometry, Index=0, Wrap=True)
filterlay = FilterByLayer(Geometry=deblock.Geometry, Layer=list)
explode = Explode(Curve=project.Geometry, Recursive=True)  # -> Segments, Vertices
null = NullItem(Item=item)  # -> NullFlags, InvalidFlags, Description
filtertype = FilterByType(Geometry=filterlay, ObjectType=list_2)
lng = ListLength(List=explode.Vertices)
clean = CleanTree(RemoveNulls=True, RemoveInvalid=True, RemoveEmpty=False, Tree=filtertype)
cull_i = CullIndex(List=explode.Vertices, Indices=expr("x-1", lng), Wrap=True)
end_2 = EndPoints(Curve=clean)  # -> Start, End
lng_2 = ListLength(List=end_2.Start)
cps = ClosestPoints(Point=end_2.Start, Cloud=simplify(cull_i), Count=lng_2)  # -> ClosestPoint, CPIndex, Distance
cp = ClosestPoint(Point=cull_i, Cloud=end_2.Start)  # -> ClosestPoint, CPIndex, Distance
smaller = SmallerThan(FirstNumber=cps.Distance, SecondNumber="0.1")  # -> SmallerThan, OrEqualTo
smaller_2 = SmallerThan(FirstNumber=cp.Distance, SecondNumber="0.1")  # -> SmallerThan, OrEqualTo
dispatch_3 = Dispatch(List=cps.ClosestPoint, DispatchPattern=smaller.SmallerThan)  # -> ListA, ListB
dispatch_4 = Dispatch(List=cps.CPIndex, DispatchPattern=smaller.SmallerThan)  # -> ListA, ListB
dispatch_5 = Dispatch(List=cp.CPIndex, DispatchPattern=smaller_2.SmallerThan)  # -> ListA, ListB
trim = TrimTree(Tree=dispatch_4.ListA, Depth=1)
trim_2 = TrimTree(Tree=dispatch_3.ListA, Depth=1)  # -> simplify(Tree)
item_2 = ListItem(List=end_2.End, Index=dispatch_5.ListA, Wrap=True)  # -> simplify(Item)
merge = Merge(Data1=item_2, Data2=trim_2)
ins = InsertItems(List=cull_i, Item=merge, Indices=expr("x+1", trim), Wrap=True)  # -> simplify(List)
pline = PolyLine(Vertices=ins, Closed=True)  # -> simplify(flatten(Polyline))
filter_2 = StreamFilter(Gate=null.NullFlags, Stream0=pline, Stream1=project.Geometry)

topoly = CurveToPolyline(Curve=filter_2, ToleranceDistance=0, ToleranceAngle=Slider(0.1, range=0..0.1))  # -> Polyline, Segments
move_2 = Move(Geometry=topoly.Polyline, Motion=graft(Z_3))  # -> simplify(Geometry), Transform
item_3 = ListItem(List=move_2.Geometry, Index=0, Wrap=True)
end_3 = EndPoints(Curve=item_3)  # -> Start, End
pdecon = Deconstruct(Point=end_3.Start)  # -> XComponent, YComponent, ZComponent
larger = LargerThan(FirstNumber=pdecon.ZComponent, SecondNumber=addition_3)  # -> LargerThan, OrEqualTo
dispatch_6 = Dispatch(List=move_2.Geometry, DispatchPattern=larger.LargerThan)  # -> ListA, ListB
split = SplitWithBreps(Curve=simplify(dispatch_6.ListB), Brep=simplify(capex.Brep))  # -> Curve, Points
midpt = CurveMiddle(Curve=split.Curve)
brepsinc = PointInBreps(Brep=capex.Brep, Point=midpt, Strict=False)  # -> Inside, Index
dispatch_7 = Dispatch(List=split.Curve, DispatchPattern=brepsinc.Inside)  # -> ListA, ListB
end_4 = EndPoints(Curve=dispatch_7.ListA)  # -> Start, End
pdecon_2 = Deconstruct(Point=end_4.Start)  # -> XComponent, YComponent, ZComponent
subtraction_3 = Subtraction(A=addition_3, B=pdecon_2.ZComponent)
Z_4 = UnitZ(Factor=subtraction_3)
move_3 = Move(Geometry=dispatch_7.ListA, Motion=Z_4)  # -> Geometry, Transform
weave = Weave(Pattern=brepsinc.Inside, Stream0=dispatch_7.ListB, Stream1=move_3.Geometry, NullGaps=False)
explode_2 = Explode(Curve=weave, Recursive=True)  # -> Segments, Vertices
trim_3 = TrimTree(Tree=explode_2.Vertices, Depth=1)
pline_2 = PolyLine(Vertices=trim_3, Closed=False)
tstat = TreeStatistics(Tree=pline_2)  # -> Paths, Length, Count
item_4 = ListItem(List=tstat.Paths, Index=0, Wrap=True)
panel_3 = Panel(merge)
chars = Characters(Text=item_4)  # -> Result, Unicode
lng_3 = ListLength(List=chars.Result)
expression = Expression(x=lng_3, Expression="((x-2)+1)/2")
subtraction_4 = Subtraction(A=expression, B="1")
trim_4 = TrimTree(Tree=pline_2, Depth=subtraction_4)
match = MatchTree(Tree=dispatch_6.ListA, Guide=larger.LargerThan)
match_2 = MatchTree(Tree=trim_4, Guide=larger.LargerThan)
null_2 = NullItem(Item=trim_4)  # -> NullFlags, InvalidFlags, Description
p_n_c = PickNChoose(Pattern=null_2.NullFlags, Stream0=match_2, Stream1=dispatch_6.ListB)
merge_2 = Merge(Data1=p_n_c, Data2=match)
clean_2 = CleanTree(RemoveNulls=True, RemoveInvalid=True, RemoveEmpty=True, Tree=merge_2)
flip = FlipMatrix(Data=clean_2)  # -> flatten(Data)
clean_3 = CleanTree(RemoveNulls=True, RemoveInvalid=True, RemoveEmpty=True, Tree=flip)
T = ClusterOutput(clean_3)

# ==== cluster SetPreview
relay = ClusterInput()
set_to = ClusterInput()
relay_2 = ClusterInput()
relay_3 = ClusterInput()
set_pt = Geometry(set_to)
bbox = BoundingBox(Content=relay, Plane=PlaneXY(0, 0, 0))  # -> Box, Box_2
material = Geometry(bbox.Box)

# ----
# Set
bbox_2 = BoundingBox(Content=relay, Plane=PlaneXY(0, 0, 0))  # -> Box, Box_2
debox = DeconstructBox(Box=bbox_2.Box)  # -> Plane, X, Y, Z
dedomain = DeconstructDomain(Domain=debox.X)  # -> Start, End
dedomain_2 = DeconstructDomain(Domain=debox.Y)  # -> Start, End
dedomain_3 = DeconstructDomain(Domain=debox.Z)  # -> Start, End
subtraction = Subtraction(A=dedomain.End, B=dedomain.Start)
subtraction_2 = Subtraction(A=dedomain_2.End, B=dedomain_2.Start)
subtraction_3 = Subtraction(A=dedomain_3.End, B=dedomain_3.Start)
pt = ConstructPoint(XCoordinate=dedomain.Start, YCoordinate=dedomain_2.Start, ZCoordinate=dedomain_3.Start)
deplane = DeconstructPlane(Plane=debox.Plane)  # -> Origin, XAxis, YAxis, ZAxis
material_x = Panel(subtraction)
material_y = Panel(subtraction_2)
material_z = Panel(subtraction_3)
addition = Addition(A=deplane.Origin, B=pt)
move2pt = MoveToPoint(Geometry=relay, PointA=addition, PointB=set_to)  # -> Moved, Vector, Transform
move = Move(Geometry=relay_3, Motion=move2pt.Vector)  # -> Geometry, Transform
M = ClusterOutput(move2pt.Moved)
G = ClusterOutput(move.Geometry)

base_pt = Point(addition)

# ----
# Table
panel = Panel("2440")
rectangle = Rectangle(Plane=PlaneXY(0, 0, 0), XSize=panel, YSize="1220", Radius=0)  # -> Rectangle, Length
boxrec = BoxRectangle(Rectangle=rectangle.Rectangle, Height="-60")
inverse = InverseTransform(Transform=move2pt.Transform)
transform = Transform(Geometry=boxrec, Transform=inverse)
preview = CustomPreview(Geometry=transform, Material=ColourSwatch(SwatchColor=RGBA(51, 51, 51, 66)))

# ----
# Preview Path
panel_2 = Panel("0.5")
geo = Geometry(relay_3)
lng = ListLength(List=geo)
i = Data(relay_2)
dom = ConstructDomain(DomainStart="0.1", DomainEnd=panel_2)
end = EndPoints(Curve=geo)  # -> Start, End
series = Series(Start=0, Step=1, Count=lng)
bnd = Bounds(Numbers=series)
remap = RemapNumbers(Value=series, Source=bnd, Target=dom)  # -> Mapped, Clipped
toggle = GroupToggle(ToggleActive=True, ToggleVisible=False)  # disabled
hsl = ColourHSL(Alpha=1, Hue=remap.Mapped, Saturation=1, Luminance=0.5)
item = ListItem(List=geo, Index=i, Wrap=False)
swatch = ColourSwatch(SwatchColor=RGB(255, 59, 59))
end_2 = EndPoints(Curve=item)  # -> Start, End
preview_2 = CustomPreview(Geometry=geo, Material=hsl)
tag = TextTag3D(Location=end.Start, Text=series, Size=Slider(3, range=0..10), Colour=hsl, Justification=5)
sph = Sphere(Base=end_2.Start, Radius=Slider(2, range=0..10))
previewlw = CustomPreviewLineweights(Geometry=item, Shader=swatch, Thickness=Slider(5, range=0..10), Absolute=False)
preview_3 = CustomPreview(Geometry=sph, Material=swatch)

set_pt_2 = Geometry(base_pt)
swatch_2 = ColourSwatch(SwatchColor=RGB(147, 250, 246))
debox_2 = DeconstructBox(Box=material)  # -> Plane, X, Y, Z
panel_3 = Panel(set_pt)
number_slider = Slider(20, range=0..100)
dedomain_4 = DeconstructDomain(Domain=debox_2.X)  # -> Start, End
dedomain_5 = DeconstructDomain(Domain=debox_2.Y)  # -> Start, End
dedomain_6 = DeconstructDomain(Domain=debox_2.Z)  # -> Start, End
subtraction_4 = Subtraction(A=dedomain_4.End, B=dedomain_4.Start)
subtraction_5 = Subtraction(A=dedomain_5.End, B=dedomain_5.Start)
subtraction_6 = Subtraction(A=dedomain_6.End, B=dedomain_6.Start)
concat = Concatenate(FragmentA="Set Pt         : ", FragmentB=panel_3)
sph_2 = Sphere(Base=set_pt_2, Radius=Slider(5, range=0..10))
merge = Merge(Data1=subtraction_4, Data2=subtraction_5, Data3=subtraction_6)
roundf = RoundToFactor(NumberX=merge, Factor="0.1", RoundType=0)  # -> Rounded, Difference, MultiplierR, MultiplierX
preview_4 = CustomPreview(Geometry=sph_2, Material=swatch_2)
tag_2 = TextTag3D(Location=set_pt_2, Text=concat, Size=number_slider, Colour=swatch_2, Justification=2)
item_2 = ListItem(List=roundf.Rounded, Index=0, Wrap=True)  # -> Item, Item1, Item2
pt_2 = ConstructPoint(XCoordinate=item_2.Item, YCoordinate=item_2.Item1, ZCoordinate=item_2.Item2)
panel_4 = Panel(pt_2)
deplane_2 = DeconstructPlane(Plane=debox_2.Plane)  # -> Origin, XAxis, YAxis, ZAxis
pt_3 = ConstructPoint(XCoordinate=dedomain_4.End, YCoordinate=dedomain_5.End, ZCoordinate=dedomain_6.End)
concat_2 = Concatenate(FragmentA="Material Size  : ", FragmentB=panel_4)
addition_2 = Addition(A=deplane_2.Origin, B=pt_3)
preview_5 = CustomPreview(Geometry=material, Material=ColourSwatch(SwatchColor=RGBA(176, 136, 88, 58)))
panel_5 = Panel(lng)
tag_3 = TextTag3D(Location=addition_2, Text=concat_2, Size=number_slider, Colour=swatch_2, Justification=8)
panel_6 = Panel(concat)
concat_3 = Concatenate(FragmentA="Path Count     : ", FragmentB=panel_5)
panel_7 = Panel(concat_2)
panel_8 = Panel(concat_3)
merge_2 = Merge(Data1=panel_8, Data2=panel_7, Data3=panel_6)  # -> flatten(Result)
info = Panel(merge_2)
data = Data(info)
data_2 = ClusterOutput(data)
