# Grasshopper definition flower_plate_sara.gh (Grasshopper 1.0.8)
# plug-ins: Planthopper, Pufferfish, Pancake

d = Slider(0, range=0..4)
a = Slider(0, range=0..4)
n = Slider(0, range=0..5)
f = Slider(0, range=0..4)
counter = Counter(Interval=10000)
count = Panel(counter)
smaller = SmallerThan(FirstNumber=count, SecondNumber="750")  # -> SmallerThan, OrEqualTo
folder = Panel("H:\マイドライブ\project\flower_plate_webapp\modelpreview\models\")  # disabled
直径 = Series(Start="150", Step="10", Count="5")
item = ListItem(List=直径, Index=d, Wrap=True)
丸み = Series(Start="0", Step="2", Count="5")
item_2 = ListItem(List=丸み, Index=a, Wrap=True)
filter = StreamFilter(Gate=smaller.SmallerThan, Stream1=counter)
花弁数 = Series(Start="3", Step="1", Count="6")
item_3 = ListItem(List=花弁数, Index=n, Wrap=True)
ふくらみ = Series(Start="20", Step="20", Count="5")
item_4 = ListItem(List=ふくらみ, Index=f, Wrap=True)
expression = Expression(x=counter, Expression="1")  # disabled
folder_2 = Panel("H:\マイドライブ\project\flower_plate_webapp\modelpreview\models\")
crossref = CrossReference(ListA=直径, ListB=丸み, ListC=花弁数, ListD=ふくらみ, CrossMode=1)  # -> ListA, ListB, ListC, ListD
bool = Boolean(expression)  # disabled
item_5 = ListItem(List=crossref.ListD, Index=filter, Wrap=True)
item_6 = ListItem(List=crossref.ListC, Index=filter, Wrap=True)
item_7 = ListItem(List=crossref.ListA, Index=filter, Wrap=True)
item_8 = ListItem(List=crossref.ListB, Index=filter, Wrap=True)
format = Format(Format="d{0}_a{1}_n{2}_f{3}", Culture=127, Data0=item_7, Data1=item_8, Data2=item_6, Data3=item_5)
filename = Panel(format)
panel = Panel(".stl")  # disabled
concat = Concatenate(FragmentA=folder, FragmentB=filename, FragmentC=panel)  # disabled
hukurami = GetNumber(item_5, AtLeast=1, AtMost=1, Maximum=1.797693135e+308, Minimum=-1.797693135e+308, TreeAccess=False)
takaku_a = GetNumber(item_8, AtLeast=1, AtMost=1, Maximum=1.797693135e+308, Minimum=-1.797693135e+308, TreeAccess=False)
kabensu = GetNumber(item_6, AtLeast=1, AtMost=1, Maximum=1.797693135e+308, Minimum=-1.797693135e+308, TreeAccess=False)
# INPUT
dia = GetNumber(item_7, AtLeast=1, AtMost=1, Maximum=1.797693135e+308, Minimum=-1.797693135e+308, TreeAccess=False)
panel_2 = Panel("芯密度")
panel_3 = Panel("芯径")
panel_4 = Panel("花径")
panel_5 = Panel("膨らみ")
panel_6 = Panel("先形状")
panel_7 = Panel("花弁数")
膨らみ = Slider(41, range=0..100)
花弁数_2 = Slider(5, range=3..20)
takaku_a_2 = Slider(7.3, range=0..10)
concat_2 = Concatenate(FragmentA=folder_2, FragmentB=filename, FragmentC=".glb")
花径 = Slider(55, range=0..100)
先形状 = Slider(20, range=0..100)
number_slider = Slider(15, range=0..100)
multiplication = Multiplication(A=dia, B="0.1")
height = GetNumber(multiplication, AtLeast=1, AtMost=1, Maximum=1.797693135e+308, Minimum=-1.797693135e+308, TreeAccess=False)
takaku_n = GetNumber(kabensu, AtLeast=1, AtMost=1, Maximum=1.797693135e+308, Minimum=-1.797693135e+308, TreeAccess=False)
hanakei = GetNumber(花径, AtLeast=1, AtMost=1, Maximum=1.797693135e+308, Minimum=-1.797693135e+308, TreeAccess=False)
sakikei = GetNumber(先形状, AtLeast=1, AtMost=1, Maximum=1.797693135e+308, Minimum=-1.797693135e+308, TreeAccess=False)
外形_r_ko = Slider(66, range=0..100)
外形_t_c = Slider(3.2, range=0..10)
外形_t_e = Slider(1.7, range=0..10)
外形_hk = Slider(2.4, range=0..10)
外形_rko = Slider(18, range=0..100)
# 皿外形
外形_d1 = Slider(6, range=0..125)
expression_2 = Expression(x=takaku_a, Expression="(10-x)/100")
外形_rc = Slider(60, range=0..125)
外形_wk = Slider(0.9, range=0..10)
expression_3 = Expression(x=hanakei, y=dia, Expression="y*x/100/2")
expression_4 = Expression(x=sakikei, Expression="x/100")
expression_5 = Expression(x=hukurami, Expression="x/20")
input = DataInput(
    Destination="H:\マイドライブ\project\完了\おはなのこざら\paramdata\角皿外形.ghdata",
    RelativePath="H:\マイドライブ\project\完了\おはなのこざら\paramdata\角皿外形.ghdata|..\..\完了\おはなのこざら\paramdata\角皿外形.ghdata",
    UpdateDelay=50000)  # -> 皿内側半径, d1, rc, 皿高さ, 中央厚み, 縁厚み, 高台高さ, 高台外半径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
皿外形n角形 = Data(takaku_n)
高台外半径 = Data(外形_r_ko)
高台影響半径 = Data(外形_rko)
多角形a = Data(expression_2)
皿外形n角形_2 = Data(input.皿外形n角形)
高台高さ = Data(外形_hk)
皿内側直径 = Data(dia)
高台影響半径_2 = Data(input.高台影響半径)
高台外半径_2 = Data(input.高台外半径)
中央厚み = Data(外形_t_c)
縁厚み = Data(外形_t_e)
高台幅 = Data(外形_wk)
多角形a_2 = Data(input.多角形a)
data = Data(外形_d1)
data_2 = Data(外形_rc)
皿内側半径 = Data(input.皿内側半径)
高台高さ_2 = Data(input.高台高さ)
中央厚み_2 = Data(input.中央厚み)
縁厚み_2 = Data(input.縁厚み)
皿高さ = Data(height)
高台幅_2 = Data(input.高台幅)
data_3 = Data(input.d1)
data_4 = Data(input.rc)
皿高さ_2 = Data(input.皿高さ)
材料w = Slider(180, range=0..1000)
材料l = Slider(12, range=0..1000)
材料h = Slider(50, range=0..1000)
花弁掘り込み_花弁中央半径 = Slider(4.2, range=0..10)
重なり層数 = Slider(1, range=0..10)
重なり高さギャップ = Slider(10, range=0..10)
外形掘り込みピッチ = Slider(10, range=0..10)
仕上彫りピッチ = Slider(0.6, range=0..3)
花弁掘り込み_花弁回転 = Slider(1, range=0..1)
花弁掘り込み_多角形回転 = Slider(1, range=0..1)
ビット径 = Slider(12.7, range=0..20)
中央掘り込み_掘り込み深さ = Slider(0.8, range=0..10)
花弁掘り込み_花弁角度 = Slider(0.01, range=0..1)
花弁掘り込み_花弁筋本数 = Slider(9, range=0..20)
花弁掘り込み_花弁先形状 = Slider(0.81, range=0..1)
花弁掘り込み_花弁先オフセット = Slider(0.1, range=0..10)
中央掘り込み_中央部半径 = Slider(9, range=0..100)
中央掘り込み_円周沿い点ピッチ = Slider(3, range=0..10)
# 彫り込み
花弁掘り込み_td = Slider(0.8, range=0..10)
中央掘り込み_同心円数 = Slider(3, range=0..20)
花弁掘り込み_中央部直径 = Slider(17, range=0..125)
entwine = Entwine(
    Branch00=皿内側半径,
    Branch01=data_3,
    Branch02=data_4,
    Branch03=皿高さ_2,
    Branch04=中央厚み_2,
    Branch05=縁厚み_2,
    Branch06=高台高さ_2,
    Branch07=高台外半径_2,
    Branch08=高台幅_2,
    Branch09=高台影響半径_2,
    Branch010=皿外形n角形_2,
    Branch011=多角形a_2,
    FlattenInputs=True)
output = DataOutput(
    皿内側半径=皿内側直径,
    d1=data,
    rc=data_2,
    皿高さ=皿高さ,
    中央厚み=中央厚み,
    縁厚み=縁厚み,
    高台高さ=高台高さ,
    高台外半径=高台外半径,
    高台幅=高台幅,
    高台影響半径=高台影響半径,
    皿外形n角形=皿外形n角形,
    多角形a=多角形a,
    Destination="H:\マイドライブ\project\完了\おはなのこざら\paramdata\角皿外形.ghdata",
    RelativePath="H:\マイドライブ\project\完了\おはなのこざら\paramdata\角皿外形.ghdata|..\..\完了\おはなのこざら\paramdata\角皿外形.ghdata")
entwine_2 = Entwine(
    Branch00=皿内側直径,
    Branch01=data,
    Branch02=data_2,
    Branch03=皿高さ,
    Branch04=中央厚み,
    Branch05=縁厚み,
    Branch06=高台高さ,
    Branch07=高台外半径,
    Branch08=高台幅,
    Branch09=高台影響半径,
    Branch010=皿外形n角形,
    Branch011=多角形a,
    FlattenInputs=True)
list = ValueList({"slider": 0, "input": 1}, selected="slider")
filter_2 = StreamFilter(Gate=list, Stream0=entwine_2, Stream1=entwine)
外形掘り込みピッチ_2 = Data(外形掘り込みピッチ)
仕上彫りピッチ_2 = Data(仕上彫りピッチ)
ビット径_2 = Data(ビット径)
材料w_2 = Data(材料w)
材料l_2 = Data(材料l)
材料h_2 = Data(材料h)
中央掘り込み_掘り込み深さ_2 = Data(中央掘り込み_掘り込み深さ)
中央掘り込み_掘り込み深さ_3 = Data(中央掘り込み_中央部半径)
中央掘り込み_円周沿い点ピッチ_2 = Data(中央掘り込み_円周沿い点ピッチ)
中央掘り込み_同心円数_2 = Data(中央掘り込み_同心円数)
重なり高さギャップ_2 = Data(重なり高さギャップ)
花弁先オフセット = Data(花弁掘り込み_花弁先オフセット)
重なり層数_2 = Data(重なり層数)
bang = ExplodeTree(Data=filter_2)  # -> Branch0, Branch1, Branch2, Branch3, Branch4, Branch5, Branch6, Branch7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
花弁筋本数 = Data(花弁掘り込み_花弁筋本数)
花弁中央半径 = Data(花弁掘り込み_花弁中央半径)
彫り厚み = Data(花弁掘り込み_td)
多角形回転 = Data(花弁掘り込み_多角形回転)
花弁枚数 = Data(kabensu)
ふくらみ_2 = Data(expression_5)
花弁回転 = Data(花弁掘り込み_花弁回転)
中央部半径 = Data(花弁掘り込み_中央部直径)
花弁角度 = Data(花弁掘り込み_花弁角度)
花弁先 = Data(expression_4)
彫り半径 = Data(expression_3)
皿外形n角形_3 = Data(bang.Branch10)
高台影響半径_3 = Data(bang.Branch9)
高台外半径_3 = Data(bang.Branch7)
多角形a_3 = Data(bang.Branch11)
皿内側直径_2 = Data(bang.Branch0)
高台高さ_3 = Data(bang.Branch6)
縁厚み_3 = Data(bang.Branch5)
中央厚み_3 = Data(bang.Branch4)
高台幅_3 = Data(bang.Branch8)
data_5 = Data(bang.Branch1)
data_6 = Data(bang.Branch2)
皿高さ_3 = Data(bang.Branch3)
皿内側直径_3 = Data(皿内側直径_2)
data_7 = Data(data_6)
皿高さ_4 = Data(皿高さ_3)
中央厚み_4 = Data(中央厚み_3)
縁厚み_4 = Data(縁厚み_3)
高台外半径_4 = Data(高台外半径_3)
高台幅_4 = Data(高台幅_3)
高台影響半径_4 = Data(高台影響半径_3)
多角形a_4 = Data(多角形a_3)
data_8 = Data(data_5)
皿外形n角形_4 = Data(皿外形n角形_3)
高台高さ_4 = Data(高台高さ_3)
皿内側直径_4 = Data(皿内側直径_3)
data_9 = Data(data_7)
data_10 = Data(data_8)
中央厚み_5 = Data(中央厚み_4)
皿高さ_5 = Data(皿高さ_4)
高台高さ_5 = Data(高台高さ_4)
subtraction = Subtraction(A=皿高さ_5, B=中央厚み_5, C=高台高さ_5)
expression_6 = Expression(x=皿内側直径_4, Expression="x/2")
皿深さ = Data(subtraction)
皿深さ_2 = Data(皿深さ)
皿深さ_3 = Data(皿深さ)
expression_7 = Expression(H=皿深さ_3, d=data_10, Expression="H*d/100")
皿内側半径_2 = Data(expression_6)
皿内側半径_3 = Data(皿内側半径_2)
皿内側半径_4 = Data(皿内側半径_2)
皿内側半径_5 = Data(皿内側半径_2)
expression_8 = Expression(R=皿内側半径_4, D=皿深さ_2, Expression="(R^2+D^2)/(2*D)")
expression_9 = Expression(R=皿内側半径_5, c=data_9, Expression="R*c/100")
d1 = Data(expression_7)
d1_2 = Data(d1)
d1_3 = Data(d1)
rc = Data(expression_9)
rc_2 = Data(rc)
expression_10 = Expression(d=d1_3, r=rc_2, Expression="atan(d/r)*2")
thetac = Data(expression_10)
expression_11 = Expression(D=d1_2, c=thetac, Expression="D/(1-cos(c))")
thetac_2 = Data(expression_10)
rt = Data(expression_8)
rt_2 = Data(rt)
division = Division(A=皿内側半径_3, B=rt_2)
asin = ArcSine(Value=division)
shita0 = Data(asin)
ac = Data(expression_11)
皿外形cp = Slider(36, range=0..100)
皿外形n角形_5 = Data(皿外形n角形_4)
多角形a_5 = Data(多角形a_4)
高台影響半径_5 = Data(高台影響半径_4)
皿内側半径_6 = Data(皿内側半径_2)
高台外半径_5 = Data(高台外半径_4)
高台幅_5 = Data(高台幅_4)
皿高さ_6 = Data(皿高さ_4)
皿内側半径_7 = Data(皿内側半径_2)
thetac_3 = Data(thetac_2)
# 内側ライン
中央厚み_6 = Data(中央厚み_4)
ac_2 = Data(ac)
縁厚み_5 = Data(縁厚み_4)
高台高さ_6 = Data(高台高さ_4)
series = Series(Start=0, Step=expr("1/x", 皿外形cp), Count=expr("x+1", 皿外形cp))
data_11 = Data(data_8)
ac_3 = Data(ac)
中央厚み_7 = Data(中央厚み_4)
縁厚み_6 = Data(縁厚み_4)
xy = XYPlane(Origin=Point(0, 0, 0))
# 高台ライン
expression_12 = Expression(H=皿内側半径_6, d=高台外半径_5, Expression="H*d/100")
addition = Addition(A=中央厚み_6, B=高台高さ_6, C=ac_2)
expression_13 = Expression(t=series, n=皿外形n角形_5, a=多角形a_5, Expression="1-a+a*cos(2*Pi*t*n)")
pt = ConstructPoint(XCoordinate=皿内側半径_7, YCoordinate=0, ZCoordinate=皿高さ_6)
twn2nums = TweenTwoNumbers(NumberA=中央厚み_7, NumberB=縁厚み_6, Factor=expr("x/100", data_11))
subtraction_2 = Subtraction(A=expression_12, B=高台幅_5)
expression_14 = Expression(t=series, Expression="2*Pi*t")
expression_15 = Expression(x=縁厚み_5, Expression="x/2")
pt_2 = ConstructPoint(XCoordinate=0, YCoordinate=0, ZCoordinate=addition)
expression_16 = Expression(x=thetac_3, Expression="x+3/2*Pi")
Z = UnitZ(Factor=1)
pt_3 = ConstructPoint(XCoordinate=subtraction_2, YCoordinate=0, ZCoordinate=0)
pt_4 = ConstructPoint(XCoordinate=expression_12, YCoordinate=0, ZCoordinate=0)
縁フィレット = Data(expression_15)
p0 = Point(pt_2)
dom = ConstructDomain(DomainStart="3/2*Pi", DomainEnd=expression_16)
addition_2 = Addition(A=ac_3, B=twn2nums)
xz = XZPlane(Origin=pt_4)
X = UnitX(Factor="200")
xz_2 = XZPlane(Origin=pt_3)
xz_3 = XZPlane(Origin=p0)
cir = Circle(Plane=xz, Radius=高台影響半径_5)
neg = Negative(Value=中央厚み_7)
cir_2 = Circle(Plane=xz_2, Radius=高台影響半径_5)
arc = Arc(Plane=xz_3, Radius=ac_2, Angle=dom)  # -> Arc, Length
Z_2 = UnitZ(Factor=neg)
eval = EvaluateCurve(Curve=reparameterize(arc.Arc), Parameter="1")  # -> Point, Tangent, Angle
arc_2 = ArcSED(Start=eval.Point, End=pt, Direction=eval.Tangent)  # -> Arc, Plane, Radius
ln = Line(StartPoint=pt_3, EndPoint=pt_4)
merge = Merge(Data1=arc.Arc, Data2=arc_2.Arc)
join = JoinCurves(Curves=merge, Preserve=False)
p1 = Point(arc_2.Plane)
p1_2 = Point(p1)
p0_2 = Point(p0)
p0_3 = Point(p0_2)
re = Data(arc_2.Radius)
re_2 = Data(re)
addition_3 = Addition(A=縁厚み_6, B=re_2)
arc_top = Geometry(join)
# ライン合成
arc_top_2 = Geometry(arc_top)
# 外側ライン
arc_top_3 = Geometry(arc_top)
end = EndPoints(Curve=arc_top_2)  # -> Start, End
explode = Explode(Curve=arc_top_3, Recursive=True)  # -> Segments, Vertices
item_9 = ListItem(List=explode.Segments, Index=0, Wrap=True)  # -> Item, Item1
end_2 = EndPoints(Curve=item_9.Item1)  # -> Start, End
end_3 = EndPoints(Curve=item_9.Item)  # -> Start, End
vec2pt = Vector2Pt(PointA=p1_2, PointB=end_2.End, Unitize=False)  # -> Vector, Length
vec2pt_2 = Vector2Pt(PointA=p0_3, PointB=end_3.End, Unitize=False)  # -> Vector, Length
eval_2 = EvaluateCurve(Curve=arc_top_3, Parameter="0")  # -> Point, Tangent, Angle
amp = Amplitude(Vector=vec2pt_2.Vector, Amplitude=addition_2)
amp_2 = Amplitude(Vector=vec2pt.Vector, Amplitude=addition_3)
move = Move(Geometry=p1_2, Motion=amp_2)  # -> Geometry, Transform
move_2 = Move(Geometry=p0_3, Motion=amp)  # -> Geometry, Transform
move_3 = Move(Geometry=end_3.Start, Motion=Z_2)  # -> Geometry, Transform
arc_3 = ArcSED(Start=move_3.Geometry, End=move_2.Geometry, Direction=eval_2.Tangent)  # -> Arc, Plane, Radius
eval_3 = EvaluateCurve(Curve=reparameterize(arc_3.Arc), Parameter="1")  # -> Point, Tangent, Angle
end_4 = EndPoints(Curve=arc_3.Arc)  # -> Start, End
arc_4 = ArcSED(Start=end_4.End, End=move.Geometry, Direction=eval_3.Tangent)  # -> Arc, Plane, Radius
merge_2 = Merge(Data1=arc_3.Arc, Data2=arc_4.Arc)
join_2 = JoinCurves(Curves=merge_2, Preserve=False)
arc_bottom = Geometry(join_2)
arc_bottom_2 = Geometry(arc_bottom)
ccx = CurveCurve(CurveA=arc_bottom_2, CurveB=cir)  # -> Points, ParamsA, ParamsB
ccx_2 = CurveCurve(CurveA=arc_bottom_2, CurveB=cir_2)  # -> Points, ParamsA, ParamsB
item_10 = ListItem(List=ccx.ParamsA, Index=0, Wrap=True)  # -> Item, Item1
item_11 = ListItem(List=ccx_2.ParamsA, Index=0, Wrap=True)  # -> Item, Item1
eval_4 = EvaluateCurve(Curve=arc_bottom_2, Parameter=item_10.Item1)  # -> Point, Tangent, Angle
eval_5 = EvaluateCurve(Curve=arc_bottom_2, Parameter=item_11.Item)  # -> Point, Tangent, Angle
merge_3 = Merge(Data1=item_11.Item, Data2=item_10.Item1)
neg_2 = Negative(Value=eval_4.Tangent)
shatter = Shatter(Curve=arc_bottom_2, Parameters=merge_3)
arc_5 = ArcSED(Start=eval_5.Point, End=pt_3, Direction=eval_5.Tangent)  # -> Arc, Plane, Radius
arc_6 = ArcSED(Start=eval_4.Point, End=pt_4, Direction=neg_2)  # -> Arc, Plane, Radius
item_12 = ListItem(List=shatter, Index=0, Wrap=True)  # -> Item, Item1, Item2
merge_4 = Merge(
    Data1=flatten(item_12.Item),
    Data2=flatten(arc_5.Arc),
    Data3=flatten(ln),
    Data4=flatten(arc_6.Arc),
    Data5=flatten(item_12.Item2))
join_3 = JoinCurves(Curves=merge_4, Preserve=False)
crv_bottom = Geometry(join_3)
crv_bottom_2 = Geometry(crv_bottom)
end_5 = EndPoints(Curve=crv_bottom_2)  # -> Start, End
ln_2 = Line(StartPoint=end.End, EndPoint=end_5.End)
join_4 = JoinCurves(Curves=flatten([arc_top_2, crv_bottom_2, ln_2]), Preserve=False)
fillet = Fillet(Curve=flatten(join_4), Radius=縁フィレット)
外形ライン = Geometry(fillet)
# 多角形
外形ライン_2 = Geometry(外形ライン)
end_6 = EndPoints(Curve=外形ライン_2)  # -> Start, End
line = LineSDL(Start=end_6.Start, Direction=Z, Length="200")
move_4 = Move(Geometry=line, Motion=X)  # -> Geometry, Transform
crvprox = CurveProximity(CurveA=外形ライン_2, CurveB=move_4.Geometry)  # -> PointA, PointB, Distance
crv_cp = CurveClosestPoint(Point=crvprox.PointA, Curve=外形ライン_2)  # -> Point, Parameter, Distance
shatter_2 = Shatter(Curve=外形ライン_2, Parameters=crv_cp.Parameter)
join_5 = JoinCurves(Curves=shatter_2, Preserve=False)
rotate = Rotate(Geometry=join_5, Angle=expression_14, Plane=xy)  # -> Geometry, Transform
scale_nu = ScaleNU(Geometry=rotate.Geometry, Plane=rotate.Geometry, ScaleX=expression_13, ScaleY=1, ScaleZ=1)  # -> Geometry, Transform
item_13 = ListItem(List=shatter_2, Index=0, Wrap=True)  # -> Item, Item1
merge_5 = Merge(Data1=graft(rotate.Transform), Data2=graft(scale_nu.Transform))
comp = Compound(Transforms=merge_5)
transform = Transform(Geometry=crvprox.PointA, Transform=comp)  # -> flatten(Geometry)
intcrv = Interpolate(Vertices=transform, Degree=3, Periodic=False, KnotStyle=1)  # -> Curve, Length, Domain
railrev = RailRevolution(Curve=item_13.Item1, Rail=intcrv.Curve, Axis=line, Scale=False)
railrev_2 = RailRevolution(Curve=item_13.Item, Rail=intcrv.Curve, Axis=line, Scale=False)
join_6 = BrepJoin(Breps=[railrev_2, railrev])  # -> Breps, Closed
bottom_arc = Geometry(item_13.Item1)
bottom_srf = Geometry(railrev)
皿外形 = Geometry(join_6.Breps)
top_arc = Geometry(item_13.Item)
top_srf = Geometry(railrev_2)
# 花弁形状
彫り厚み_2 = Data(彫り厚み)
中央厚み_8 = Data(中央厚み_4)
高台高さ_7 = Data(高台高さ_4)
花弁中央半径_2 = Data(花弁掘り込み_花弁中央半径)
花弁角度_2 = Data(花弁掘り込み_花弁角度)
彫り半径_2 = Data(彫り半径)
ふくらみ_3 = Data(ふくらみ_2)
addition_4 = Addition(A=中央厚み_8, B=高台高さ_7)
subtraction_3 = Subtraction(A=addition_4, B=彫り厚み_2)
花弁先オフセット_2 = Data(花弁掘り込み_花弁先オフセット)
花弁筋本数_2 = Data(花弁掘り込み_花弁筋本数)
花弁枚数_2 = Data(花弁枚数)
彫り厚み_3 = Data(彫り厚み)
中央掘り込み_円周沿い点ピッチ_3 = Data(中央掘り込み_円周沿い点ピッチ_2)
# 花弁１枚のパス
topsrf = Geometry(top_srf)
pt_5 = ConstructPoint(XCoordinate=0, YCoordinate=0, ZCoordinate=subtraction_3)
# 中央部掘り込み
中央掘り込み_掘り込み深さ_4 = Data(中央掘り込み_掘り込み深さ_2)
中央掘り込み_同心円数_3 = Data(中央掘り込み_同心円数_2)
中央掘り込み_掘り込み深さ_5 = Data(中央掘り込み_掘り込み深さ_3)
division_2 = Division(A=彫り半径_2, B=花弁中央半径_2)
pt_6 = ConstructPoint(XCoordinate=花弁中央半径_2, YCoordinate=0, ZCoordinate=0)
皿中心pt = Geometry(pt_5)
ビット径_3 = Data(ビット径_2)
# 回転コピー
花弁回転_2 = Data(花弁回転)
vec = Vector(皿中心pt)
xy_2 = XYPlane(Origin=皿中心pt)
addition_5 = Addition(A=vec, B=pt_6)
top_srf_2 = Geometry(top_srf)
ビット径_4 = Data(ビット径_2)
pt_7 = ConstructPoint(XCoordinate=0, YCoordinate="1", ZCoordinate=0)
xy_3 = XYPlane(Origin=Point(0, 0, 0))
division_3 = Division(A="2*Pi", B=花弁枚数_2)
pi = Pi(Factor=花弁角度_2)
addition_6 = Addition(A=vec, B=pt_7)
expression_17 = Expression(x=ビット径_4, Expression="x/2")
division_4 = Division(A=中央掘り込み_掘り込み深さ_5, B=中央掘り込み_同心円数_3)
series_2 = Series(Start=0, Step=division_3, Count=花弁枚数_2)
expression_18 = Expression(x=花弁枚数_2, Expression="2*Pi/x/2")
division_5 = Division(A=1, B=花弁筋本数_2)
series_3 = Series(Start=expr("x/2", division_4), Step=division_4, Count=中央掘り込み_同心円数_3)
xz_4 = XZPlane(Origin=Point(0, 0, 0))
xy_4 = XYPlane(Origin=Point(0, 0, 0))
rotate_2 = Rotate(Geometry=addition_6, Angle=expr("-x", pi), Plane=xy_2)  # -> flatten(Geometry), Transform
expression_19 = Expression(x=中央掘り込み_同心円数_3, Expression="2*Pi/x")
series_4 = Series(Start=0, Step=division_5, Count=expr("x+1", 花弁筋本数_2))
pt_8 = Point(xy_2)
X_2 = UnitX(Factor=1)
cir_3 = Circle(Plane=xy_3, Radius=series_3)
X_3 = UnitX(Factor=ふくらみ_3)
line_2 = LineSDL(Start=xy_4, Direction=X_2, Length="1000")
series_5 = Series(Start=0, Step=expression_19, Count=中央掘り込み_同心円数_3)
Z_3 = UnitZ(Factor=彫り厚み_3)
len = Length(Curve=cir_3)
move_5 = Move(Geometry=rotate_2.Geometry, Motion=X_3)  # -> Geometry, Transform
xz_5 = XZPlane(Origin=Point(0, 0, 0))
mirror = Mirror(Geometry=rotate_2.Geometry, Plane=PlaneYZ(0, 0, 0))  # -> Geometry, Transform
rotate_3 = Rotate(Geometry=line_2, Angle=expr("-x", expression_18), Plane=xy_4)  # -> Geometry, Transform
rotate_4 = Rotate(Geometry=line_2, Angle=expression_18, Plane=xy_4)  # -> Geometry, Transform
rotate_5 = Rotate(Geometry=cir_3, Angle=series_5, Plane=xy_3)  # -> Geometry, Transform
neg_3 = Negative(Value=Z_3)
integer_division = IntegerDivision(A=len, B=中央掘り込み_円周沿い点ピッチ_3)
custom_mesh_settings = SettingsCustom(
    StitchSeams=False,
    SimplePlanes=False,
    Refine=False,
    MinCount=16,
    MaxCount=400,
    AspectRatio=20,
    MaxDistance=0,
    MaxAngle=60,
    MinEdge=0,
    MaxEdge=0)
mirror_2 = Mirror(Geometry=move_5.Geometry, Plane=xz_5)  # -> flatten(Geometry), Transform
end_7 = EndPoints(Curve=rotate_3.Geometry)  # -> Start, End
end_8 = EndPoints(Curve=rotate_4.Geometry)  # -> Start, End
divide = DivideCurve(Curve=rotate_5.Geometry, Count=integer_division, Kinks=False)  # -> flatten(Points), Tangents, Parameters
Z_4 = UnitZ(Factor=expr("x/2", ビット径_3))
merge_6 = Merge(
    Data1=flatten(pt_8),
    Data2=flatten(move_5.Geometry),
    Data3=flatten(addition_5),
    Data4=flatten(mirror_2.Geometry),
    Data5=flatten(pt_8))
merge_7 = Merge(Data1=end_7.End, Data2=end_8.End, Data3=end_7.Start)
jagged = SettingsSpeed()
subtraction_4 = Subtraction(A=mirror.Geometry, B=pt_8)
subtraction_5 = Subtraction(A=rotate_2.Geometry, B=pt_8)
花弁枚数_3 = Data(花弁枚数_2)
Z_5 = UnitZ(Factor=1)
花弁枚数_4 = Data(花弁枚数_2)
expression_20 = Expression(x=花弁枚数_3, Expression="Pi/x")
pline = PolyLine(Vertices=merge_7, Closed=True)
project = ProjectPoint(Point=divide.Points, Direction=Z_5, Geometry=top_srf_2)  # -> Point, Index
subtraction_6 = Subtraction(A=expression_17, B=中央掘り込み_掘り込み深さ_4)
expression_21 = Expression(x=花弁枚数_4, Expression="Pi/x")
Z_6 = UnitZ(Factor="100")
boundary = BoundarySurfaces(Edges=pline)
neg_4 = Negative(Value=中央掘り込み_掘り込み深さ_4)
neg_5 = Negative(Value=花弁先オフセット_2)
Z_7 = UnitZ(Factor=subtraction_6)
Z_8 = UnitZ(Factor=neg_4)
intcrv_t = InterpolateT(Vertices=merge_6, TangentStart=subtraction_5, TangentEnd=subtraction_4, KnotStyle=Slider(2, range=0..10))  # -> Curve, Length, Domain
larger = LargerThan(FirstNumber=花弁筋本数_2, SecondNumber="0")  # -> LargerThan, OrEqualTo
extr = Extrude(Base=boundary, Direction=Z_6)
move_6 = Move(Geometry=project.Point, Motion=Z_7)  # -> Geometry, Transform
move_7 = Move(Geometry=project.Point, Motion=Z_8)  # -> Geometry, Transform
divide_2 = DivideCurve(Curve=intcrv_t.Curve, Count=2, Kinks=False)  # -> Points, Tangents, Parameters
custom_mesh_settings_2 = SettingsCustom(
    StitchSeams=False,
    SimplePlanes=True,
    Refine=False,
    MinCount=16,
    MaxCount=400,
    AspectRatio=20,
    MaxDistance=0,
    MaxAngle=60,
    MinEdge=Slider(0.4, range=0..1),
    MaxEdge=0)
sph = Sphere(Base=move_6.Geometry, Radius=expression_17)
花中央掘り込みpt = Geometry(move_7.Geometry)
shatter_3 = Shatter(Curve=intcrv_t.Curve, Parameters=divide_2.Parameters)  # -> flatten(Segments)
中央部半径_2 = Data(中央部半径)
花中央掘り込みボリューム = Geometry(sph)
number_slider_2 = Slider(6, range=0..10)
item_14 = ListItem(List=flatten(shatter_3), Index=0, Wrap=True)  # -> Item, Item1
sunion = SolidUnion(Breps=花中央掘り込みボリューム)
flip = FlipCurve(Curve=item_14.Item1)  # -> Curve, Flag
custom_mesh_settings_3 = SettingsCustom(
    StitchSeams=False,
    SimplePlanes=False,
    Refine=False,
    MinCount=16,
    MaxCount=400,
    AspectRatio=20,
    MaxDistance=0,
    MaxAngle=60,
    MinEdge=0,
    MaxEdge=0)  # disabled
msphere = MeshSphere(Base=花中央掘り込みpt, Radius=Slider(0.7, range=0..10), UCount=number_slider_2, VCount=number_slider_2)
merge_8 = Merge(Data1=item_14.Item, Data2=flip.Curve)  # -> flatten(Result)
花弁先_2 = Data(花弁先)
mesh = MeshBrep(Brep=花中央掘り込みボリューム, Settings=custom_mesh_settings_3)  # disabled
neg_6 = Negative(Value=花弁先_2)
ext = ExtendCurve(Curve=merge_8, Type=0, Start="0", End=neg_6)
munion = MeshUnion(Meshes=mesh)  # disabled
scale = Scale(Geometry=ext, Center=xy_2, Factor=division_2)  # -> Geometry, Transform
花弁crv = Geometry(scale.Geometry)
花弁crv_2 = Geometry(花弁crv)
item_15 = ListItem(List=花弁crv_2, Index=0, Wrap=True)  # -> Item, Item1
tweencrv = TweenCurve(CurveA=item_15.Item, CurveB=item_15.Item1, Factor=series_4, BlendType=0)
tweencrv_2 = TweenCurve(CurveA=item_15.Item, CurveB=item_15.Item1, Factor=0.5, BlendType=0)
divide_3 = DivideCurve(Curve=tweencrv, Count="5", Kinks=False)  # -> Points, Tangents, Parameters
divide_4 = DivideCurve(Curve=tweencrv_2, Count="5", Kinks=False)  # -> Points, Tangents, Parameters
project_2 = ProjectPoint(Point=divide_4.Points, Direction="{0,0,1}", Geometry=topsrf)  # -> Point, Index
project_3 = ProjectPoint(Point=divide_3.Points, Direction="{0,0,1}", Geometry=topsrf)  # -> Point, Index
intcrv_2 = Interpolate(Vertices=project_2.Point, Degree=3, Periodic=False, KnotStyle=1)  # -> flatten(Curve), Length, Domain
intcrv_3 = Interpolate(Vertices=project_3.Point, Degree=3, Periodic=False, KnotStyle=1)  # -> flatten(Curve), Length, Domain
move_8 = Move(Geometry=intcrv_2.Curve, Motion=neg_3)  # -> simplify(Geometry), Transform
move_9 = Move(Geometry=intcrv_3.Curve, Motion=neg_3)  # -> simplify(Geometry), Transform
ext_2 = ExtendCurve(Curve=move_8.Geometry, Type=0, Start=neg_5, End=neg_5)
ext_3 = ExtendCurve(Curve=move_9.Geometry, Type=0, Start=neg_5, End=neg_5)
filter_3 = StreamFilter(Gate=larger.LargerThan, Stream0=ext_2, Stream1=ext_3)
trim = TrimWithBrep(Curve=filter_3, Brep=extr)  # -> Inside, Outside
geo = Geometry(flatten(trim.Inside))
pln = Plane(xy_2)
pln_2 = Plane(pln)
皿中心pt_2 = Geometry(pln_2)
sph_2 = Sphere(Base=皿中心pt_2, Radius=expr("x/2", 中央部半径_2))
trim_2 = TrimWithBrep(Curve=geo, Brep=sph_2)  # -> Inside, Outside
geo_2 = Geometry(flatten(trim_2.Outside))
rotate_6 = Rotate(Geometry=flatten(geo_2), Angle=graft(series_2), Plane=PlaneXY(0, 0, 0))  # -> flatten(Geometry), Transform
pipe = Pipe(Curve=flatten(geo_2), Radius=expr("x/2", ビット径_3), Caps=2)  # -> flatten(Pipe)
pipe_2 = Pipe(Curve=flatten(rotate_6.Geometry), Radius=expr("x/2", ビット径_3), Caps=2)  # -> flatten(Pipe)
mesh_2 = MeshBrep(Brep=pipe, Settings=jagged)
move_10 = Move(Geometry=pipe_2, Motion=Z_4)  # -> flatten(Geometry), Transform
move_11 = Move(Geometry=mesh_2, Motion=Z_4)  # -> flatten(Geometry), Transform
move_12 = Move(Geometry=pipe, Motion=Z_4)  # -> flatten(Geometry), Transform
rotate_7 = Rotate(Geometry=rotate_6.Geometry, Angle=expression_20, Plane=PlaneXY(0, 0, 0))  # -> Geometry, Transform
munion_2 = MeshUnion(Meshes=move_11.Geometry)  # disabled
sunion_2 = SolidUnion(Breps=move_12.Geometry)
filter_4 = StreamFilter(Gate=花弁回転_2, Stream0=rotate_6.Geometry, Stream1=rotate_7.Geometry)
rotate_8 = Rotate(Geometry=flatten(sunion_2), Angle=graft(series_2), Plane=PlaneXY(0, 0, 0))  # -> flatten(Geometry), Transform
rotate_9 = Rotate(Geometry=rotate_8.Geometry, Angle=expression_21, Plane=PlaneXY(0, 0, 0))  # -> Geometry, Transform
filter_5 = StreamFilter(Gate=花弁回転_2, Stream0=rotate_8.Geometry, Stream1=rotate_9.Geometry)
加工ボリューム = Geometry(filter_5)
花弁彫込パス = Geometry(filter_4)
pipe_3 = Pipe(Curve=花弁彫込パス, Radius=Slider(0.3, range=0..10), Caps=1)  # -> flatten(Pipe)
mesh_3 = MeshBrep(Brep=pipe_3, Settings=custom_mesh_settings_2)
merge_9 = Merge(Data1=加工ボリューム, Data2=sunion)  # -> flatten(Result)
merge_10 = Merge(Data1=mesh_3, Data2=msphere)  # -> flatten(Result)
sunion_3 = SolidUnion(Breps=merge_9)
加工ボリューム_2 = Geometry(merge_9)
加工パスdisplay = Geometry(merge_10)
加工パスdisplay_2 = Geometry(加工パスdisplay)
皿外形_2 = Geometry(皿外形)
加工ボリューム_3 = Geometry(加工ボリューム_2)
jagged_2 = SettingsSpeed()
mesh_4 = MeshBrep(Brep=皿外形_2, Settings=jagged_2)  # disabled
clean = CleanTree(RemoveNulls=True, RemoveInvalid=True, RemoveEmpty=False, Tree=加工ボリューム_3)  # disabled
swatch = ColourSwatch(SwatchColor=RGBA(204, 182, 145, 183))
panel_8 = Panel(mesh_4)
mdif = MeshDifference(MeshesA=mesh_4, MeshesB=clean)  # disabled
sdiff = SolidDifference(BrepsA=皿外形_2, BrepsB=加工ボリューム_3)
jagged_3 = SettingsSpeed()
preview = CustomPreview(Geometry=mdif, Material=swatch)
mesh_5 = MeshBrep(Brep=sdiff, Settings=jagged_3)
mesh_6 = Mesh(mesh_5)
pcexportstl = ExportSTL(Mesh=mesh_6, Relocate=True, SavePath=concat, SaveAsBinaryFile=True, SaveNow=bool, LastSaveLocalization="neutral,N")  # disabled
panel_9 = Panel(pcexportstl)  # disabled
glb_export = Python3Script(geo=mesh_6, filename=concat_2, run=Toggle(True))  # -> out, a; inputs geo: Mesh, filename: String, run: Boolean
# ---------- glb_export: Python ----------
import rhinoscriptsyntax as rs
import scriptcontext as sc
import Rhino
import System # <--- 【重要】この行を追加します

# Rhinoドキュメントと再描画の設定を初期化
doc = Rhino.RhinoDoc.ActiveDoc
sc.doc = doc

# スクリプトの実行中は再描画を一時停止
doc.Views.RedrawEnabled = False

# 最終的な結果メッセージ
a = "Ready to Export (Set 'run' to True)"

if run and filename:
    
    # ジオメトリ(geo)が存在するかどうかを確認 (Type HintがMeshであることを前提)
    if not geo:
        a = "Export Failed: No input geometry"
        print(a)
        
    try:
        # 1. ジオメトリをRhinoドキュメントに追加（ベイク）
        baked_object_id = doc.Objects.Add(geo)
        
        # 2. ベイク成功の確認 (System.Guid.Emptyを使用)
        if baked_object_id != System.Guid.Empty: 
            
            # 3. ベイクされたオブジェクトを選択
            rs.SelectObject(baked_object_id)
            
            # 4. Rhinoの「Export」コマンドをGLB形式で実行
            command = '_-Export "{}" _Enter'.format(filename)
            Rhino.RhinoApp.RunScript(command, True)
            
            # 5. エクスポートに使用した一時オブジェクトを削除
            rs.DeleteObject(baked_object_id)
            
            # 6. 選択状態を解除してクリーンアップ
            rs.UnselectObject(baked_object_id)
            
            # 7. 成功メッセージ
            a = "Export Successful: {}".format(filename)
            print(a)
        
        else:
            a = "Export Failed: Baking failed"
            print(a)

    except Exception as e:
        a = "Export Error: {}".format(e)
        print(a)

else:
    # runがFalseの場合の初期メッセージ
    pass

# 処理が完了したら、最後に再描画を有効に戻す
doc.Views.RedrawEnabled = True
# ---------- end glb_export ----------
mcol = MeshColours(Mesh=加工パスdisplay_2, Colours=ColourSwatch(SwatchColor=RGB(64, 59, 50)))
mcol_2 = MeshColours(Mesh=mesh_4, Colours=swatch)
merge_11 = Merge(Data1=mesh_4, Data2=mcol)  # -> flatten(Result)
cache = ContentCache(Content=mesh_5)
mjoin = MeshJoin(Meshes=mdif)
pcexportas = ExportAs(Overwrite=False, Export=False, CompMode=False, LastSaveLocalization="neutral,N")  # -> OK, ExportCommand
c_bake = ContextBake(Content=mjoin)
